# Grasshopper definition 190903_TriangleGeneration_smallscale_01_cg.gh (Grasshopper 1.0.7)

d = Slider(5, range=0..100)
toggle = BooleanToggle(False)
pt = Point([<point referenced from the Rhino model> x4])
pt_2 = Point(<point referenced from the Rhino model>)
pln = Plane(Plane(origin=(523.8805311, -0.3481666342, 0), x=(-1, 0, 0), y=(0, 1, 0)))
pln_2 = Plane(Plane(origin=(253.3121363, -293.7578269, 0), x=(0, 1, 0), y=(-1, 0, 0)))
python = PythonScript(
    points=pt,
    attractor=pt_2,
    d=d,
    test=Button(),
    number_of_bars=Slider(1, range=0..50),
    bar_len_min=Slider(150, range=0..1000),
    bar_len_max=Slider(300, range=0..1000),
    trys=Slider(30, range=0..100),
    pickup_station_0=pln,
    start_end_position=pln_2)  # -> vert_endpts, vert_lns, edge_lns, fs, lines; inputs points: list of Point3d, attractor: Point3d
# ---------- python: Python ----------
from compas_ghpython import unload_modules
from compas_ghpython import utilities
from compas_ghpython.utilities import xdraw_frame
from compas_ghpython.artists.networkartist import NetworkArtist
from spatial_structures.bar_structure import Bar_Structure
from coop_assembly.geometry_generation.generate_triangles import generate_first_tetra, generate_structure_no_points
from coop_assembly.geometry_generation.fabrication_planes import generate_planes_glue
from coop_assembly.data_structure.data_structure_compas import Overall_Structure
from coop_assembly.help_functions.helpers_geometry import update_bar_lengths
from coop_assembly.help_functions.drawing import draw_network_inv_gh

import rhinoscriptsyntax as rs

        
unload_modules("coop_assembly")
        
def main():
            
    iterations = int(number_of_bars)
            
    points_compas = [(p[0],p[1],p[2]) for p in points]
    attr_compas = [attractor[0], attractor[1], attractor[2]]
            
    b_struct    = Bar_Structure()
    o_struct    = Overall_Structure(b_struct)
            
    b_struct, o_struct = generate_first_tetra(o_struct, b_struct, d/2, points_compas)
    update_bar_lengths(b_struct)
            
    b_struct = generate_structure_no_points(o_struct, b_struct, True, d/2, iterations, bar_len_min, bar_len_max, trys, attr=attr_compas)
        
            
    vert_endpts, vert_lns, edge_lns = draw_network_inv_gh(b_struct)
            
    global pickup_station_0, start_end_position
    
    pickup_station_0 = rhino_plane_to_frame(pickup_station_0)
    start_end_position = rhino_plane_to_frame(start_end_position)
            
    frames = generate_planes_glue(b_struct, d/2, pickup_station_0, iterations+5, start_end_position, start_end_position)
    print(frames)
    
#   list of three points of a frame (origin, x, y) 
    fs = []
    lines = []
    for frame in frames:
        ps = []
        for point in frame:
            p = rs.AddPoint(point)
            ps.append(p)
        fs.append(rs.PlaneFromPoints(ps[0], ps[1], ps[2]))
    for i in range(1, len(fs)):
        line = rs.AddLine(fs[i][0], fs[i-1][0])
        lines.append(line)
    return vert_endpts, vert_lns, edge_lns, fs, lines
   
   
def rhino_plane_to_frame(plane):
# converts rhino planes to 3-pt frames
    origin = plane.Origin
    x_vec = plane.XAxis
    y_vec = plane.YAxis
    x_pt = [origin.X + x_vec.X, origin.Y + x_vec.Y, origin.Z + x_vec.Z]
    y_pt = [origin.X + y_vec.X, origin.Y + y_vec.Y, origin.Z + y_vec.Z]
    new_origin = [origin.X, origin.Y, origin.Z]
    pts = [origin, x_pt, y_pt]
    
    return pts
        
        
vert_endpts, vert_lns, edge_lns, fs, lines = main()
# ---------- end python ----------
panel = Panel(python.fs)
line = Line(python.lines)
item = ListItem(List=panel, Index=Slider(4, range=0..1000), Wrap=True)
division = Division(A=d, B=2)
pln_3 = Plane(python.fs)
panel_2 = Panel(item)
pipe = Pipe(Curve=python.vert_lns, Radius=division, Caps=0)  # -> flatten(Pipe)
item_2 = ListItem(List=pipe, Index=Slider(10, range=0..10), Wrap=True)
preview = CustomPreview(Geometry=item_2)
