# Grasshopper definition 190903_TriangleGeneration_smallscale_01_sp.gh (Grasshopper 1.0.7)

d = Slider(5, range=0..100)
button = Button()
pt = Point([<point referenced from the Rhino model> x4])
pt_2 = Point(<point referenced from the Rhino model>)
pln = Plane(Plane(origin=(523.8805311, -0.3481666342, 0), x=(-1, 0, 0), y=(0, 1, 0)))
pln_2 = Plane(Plane(origin=(253.3121363, -293.7578269, 0), x=(0, 1, 0), y=(-1, 0, 0)))
python = PythonScript(
    points=pt,
    attractor=pt_2,
    d=d,
    test=Toggle(False),
    number_of_bars=Slider(1, range=0..50),
    bar_len_min=Slider(150, range=0..1000),
    bar_len_max=Slider(300, range=0..1000),
    trys=Slider(30, range=0..100),
    pickup_station_0=pln,
    start_end_position=pln_2)  # -> vert_endpts, vert_lns, edge_lns, fs, lines, b_struct; inputs points: list of Point3d, attractor: Point3d
# ---------- python: Python ----------
from compas_ghpython import unload_modules
from compas_ghpython import utilities
from compas_ghpython.utilities import xdraw_frame
from compas_ghpython.artists.networkartist import NetworkArtist
from spatial_structures.bar_structure import Bar_Structure
from coop_assembly.geometry_generation.generate_triangles import generate_first_tetra, generate_structure_no_points
from coop_assembly.geometry_generation.fabrication_planes import generate_planes_glue
from coop_assembly.data_structure.data_structure_compas import Overall_Structure
from coop_assembly.help_functions.helpers_geometry import update_bar_lengths
from coop_assembly.help_functions.drawing import draw_network_inv_gh

import rhinoscriptsyntax as rs

        
unload_modules("coop_assembly")
        
def main():
            
    iterations = int(number_of_bars)
            
    points_compas = [(p[0],p[1],p[2]) for p in points]
    attr_compas = [attractor[0], attractor[1], attractor[2]]
            
    b_struct    = Bar_Structure()
    o_struct    = Overall_Structure(b_struct)
            
    b_struct, o_struct = generate_first_tetra(o_struct, b_struct, d/2, points_compas)
    update_bar_lengths(b_struct)
            
    b_struct = generate_structure_no_points(o_struct, b_struct, True, d/2, iterations, bar_len_min, bar_len_max, trys, attr=attr_compas)
        
            
    vert_endpts, vert_lns, edge_lns = draw_network_inv_gh(b_struct)
            
    global pickup_station_0, start_end_position
    
    pickup_station_0 = rhino_plane_to_frame(pickup_station_0)
    start_end_position = rhino_plane_to_frame(start_end_position)
            
    frames = generate_planes_glue(b_struct, d/2, pickup_station_0, iterations+5, start_end_position, start_end_position)
    print(frames)
    
#   list of three points of a frame (origin, x, y) 
    fs = []
    lines = []
    for frame in frames:
        ps = []
        for point in frame:
            p = rs.AddPoint(point)
            ps.append(p)
        fs.append(rs.PlaneFromPoints(ps[0], ps[1], ps[2]))
    for i in range(1, len(fs)):
        line = rs.AddLine(fs[i][0], fs[i-1][0])
        lines.append(line)
    return vert_endpts, vert_lns, edge_lns, fs, lines, b_struct
   
   
def rhino_plane_to_frame(plane):
# converts rhino planes to 3-pt frames
    origin = plane.Origin
    x_vec = plane.XAxis
    y_vec = plane.YAxis
    x_pt = [origin.X + x_vec.X, origin.Y + x_vec.Y, origin.Z + x_vec.Z]
    y_pt = [origin.X + y_vec.X, origin.Y + y_vec.Y, origin.Z + y_vec.Z]
    new_origin = [origin.X, origin.Y, origin.Z]
    pts = [origin, x_pt, y_pt]
    
    return pts
        
        
vert_endpts, vert_lns, edge_lns, fs, lines, b_struct = main()
# ---------- end python ----------
panel = Panel(python.fs)
line = Line(python.lines)
item = ListItem(List=panel, Index=Slider(4, range=0..1000), Wrap=True)
division = Division(A=d, B=2)
number_slider = Slider(8, range=0..10)
panel_2 = Panel(item)
pln_3 = Plane(python.fs)
python_2 = GhPythonScript(b_struct=python.b_struct)  # -> out, planes, planes_all
# ---------- python_2: Python ----------
import Rhino.Geometry as rg

planes = []
for v in b_struct.vertex:
    gp = b_struct.vertex[v]["gripping_plane"]
    pl = rg.Plane(rg.Point3d(gp[0][0], gp[0][1],gp[0][2]), rg.Point3d(gp[1][0], gp[1][1],gp[1][2]), rg.Point3d(gp[2][0], gp[2][1],gp[2][2]))
    planes.append(pl)

planes_all = []
for i,v in enumerate(b_struct.vertex):
    gp_all = b_struct.vertex[v]["gripping_planes_all"]
    planes_all.append([])
    for gp in gp_all:
        pl = rg.Plane(rg.Point3d(gp[0][0], gp[0][1],gp[0][2]), rg.Point3d(gp[1][0], gp[1][1],gp[1][2]), rg.Point3d(gp[2][0], gp[2][1],gp[2][2]))
        planes_all[i].append(pl)
# ---------- end python_2 ----------
pipe = Pipe(Curve=python.vert_lns, Radius=division, Caps=0)  # -> flatten(Pipe)
item_2 = ListItem(List=python_2.planes_all, Index=0, Wrap=True)
item_3 = ListItem(List=pipe, Index=number_slider, Wrap=True)
item_4 = ListItem(List=python_2.planes, Index=number_slider, Wrap=True)
preview = CustomPreview(
    Geometry=item_3,
    Material={diffuse=RGB(221, 160, 221), emission=RGB(66, 48, 66), shine=0.5, specular=RGB(255, 255, 255), transparency=0})
preview_2 = CustomPreview(
    Geometry=item_4,
    Material={diffuse=RGB(221, 160, 221), emission=RGB(66, 48, 66), shine=0.5, specular=RGB(255, 255, 255), transparency=0})
pt_3 = Point([<point referenced from the Rhino model> x5])
item_5 = ListItem(List=pt_3, Index=Slider(0, range=0..11), Wrap=True)
dom = ConstructDomain(DomainStart=Slider(0, range=0..100), DomainEnd=Slider(4, range=0..100))
subset = SubList(List=pt_3, Domain=dom, Wrap=True)  # -> List, Index
number_slider_2 = Slider(2.5, range=0..100)
python_3 = PythonScript(points=pt_3, r=number_slider_2, y=Toggle(True))  # -> out, pts_netw, lns_netw, pts_inv, lns_inv, o_st, b_st; inputs points: list of Point3d
# ---------- python_3: Python ----------
import pickle
import random

from compas_ghpython import unload_modules
unload_modules("lws_geometry")
unload_modules("coop_assembly")
unload_modules("compas_fab")
unload_modules("core")

from compas.geometry import *
from compas.utilities.xfunc import XFunc
from compas_ghpython.artists import NetworkArtist
from compas_ghpython.utilities.drawing import xdraw_network
from compas.datastructures.network import Network
from coop_assembly.geometry_generation.main import main_gh_simple
from coop_assembly.help_functions.drawing import draw_network_inv_gh

dict_nodes = {}
for i,p in enumerate(points):
    if i > 2:
        nodes       = points[0:i]
        dists       = [distance_point_point(points[i], n) for n in nodes]
        nodes_inds  = [j for y,j in sorted(zip(dists,range(0,i)))] 
        nodes_fin = nodes_inds[0:3]
        
        dict_nodes[str(i)]= nodes_fin

points = [(p[0], p[1], p[2]) for p in points]

supports_bars = [(0,1), (1,2), (2,0)]
supports_nodes = [0, 1, 2, 4]
load_bars = [(4,5)]

load = (0,0,-2000)
print("about to run")
data = main_gh_simple(points, dict_nodes, r, supports_nodes, supports_bars, load_bars, load, correct=False)

o_st = Network.from_data(data[1])
b_st = Network.from_data(data[0])
#o_st = data[1]
#b_st = data[0]

pts_new, lns_netw = xdraw_network(o_st)
pts_inv, lns_inv, lns_conn  = draw_network_inv_gh(b_st)
# ---------- end python_3 ----------
line_2 = Line(python_3.lns_netw)
line_3 = Line(python_3.lns_inv)
pipe_2 = Pipe(Curve=python_3.lns_inv, Radius=number_slider_2, Caps=0)
item_6 = ListItem(List=line_3, Index=Slider(3, range=0..50), Wrap=True)
pt_4 = Point(python_3.pts_netw)
preview_3 = CustomPreview(Geometry=pipe_2, Shader=ColourSwatch(SwatchColor=RGBA(61, 200, 255, 168)))
item_7 = ListItem(List=pt_4, Index=Slider(3, range=0..20), Wrap=True)
