# Grasshopper definition 200824_ExampleTriangleGeneration_01_cg.gh (Grasshopper 1.0.7)

pt = Point([<point referenced from the Rhino model> x4])
pt_2 = Point(<point referenced from the Rhino model>)
pt_3 = Point(<point referenced from the Rhino model>)
number_slider = Slider(25, range=0..100)
python = PythonScript(points=pt, points_con=pt_2, r=number_slider, test=Button(), number_of_bars=Slider(15, range=0..25))  # -> out, vert_endpts, vert_lns, edge_lns; inputs points: list of Point3d, points_con: list of Point3d
# ---------- python: Python ----------
from compas_ghpython import unload_modules
from compas_ghpython.artists.networkartist import NetworkArtist
from spatial_structures.bar_structure import Bar_Structure
from coop_assembly.geometry_generation.generate_triangles import generate_first_tetra, generate_structure_no_points
from coop_assembly.data_structure.data_structure_compas import Overall_Structure
from coop_assembly.help_functions.helpers_geometry import update_bar_lengths
from coop_assembly.help_functions.drawing import draw_network_inv_gh

unload_modules("coop_assembly")

def main():
    
    iterations = int(number_of_bars)
    
    points_compas = [(p[0],p[1],p[2]) for p in points]
    print points_compas
    points_con_compas = [(p[0],p[1],p[2]) for p in points_con]
    
    b_struct    = Bar_Structure()
    o_struct    = Overall_Structure(b_struct)
    
    b_struct, o_struct = generate_first_tetra(o_struct, b_struct, r/2, points_compas)
    update_bar_lengths(b_struct)
    
    b_struct = generate_structure_no_points(o_struct, b_struct, True, r/2, iterations, points_con_compas)

    
    vert_endpts, vert_lns, edge_lns = draw_network_inv_gh(b_struct)
    
    return vert_endpts, vert_lns, edge_lns 


vert_endpts, vert_lns, edge_lns = main()
# ---------- end python ----------
division = Division(A=number_slider, B=2)
pipe = Pipe(Curve=python.vert_lns, Radius=division, Caps=0)  # -> flatten(Pipe)
item = ListItem(List=pipe, Index=Slider(1, range=0..10), Wrap=True)
preview = CustomPreview(
    Geometry=item,
    Material={diffuse=RGB(221, 160, 221), emission=RGB(66, 48, 66), shine=0.5, specular=RGB(255, 255, 255), transparency=0})
panel = Panel(python.out)
