# Grasshopper definition 190906_ExampleTetras_sp.gh (Grasshopper 1.0.7)

pt = Point([<point referenced from the Rhino model> x5])
item = ListItem(List=pt, Index=Slider(0, range=0..11), Wrap=True)
dom = ConstructDomain(DomainStart=Slider(0, range=0..100), DomainEnd=Slider(4, range=0..100))
subset = SubList(List=pt, Domain=dom, Wrap=True)  # -> List, Index
number_slider = Slider(2.5, range=0..100)
python = PythonScript(points=pt, r=number_slider, y=Toggle(True))  # -> out, pts_netw, lns_netw, pts_inv, lns_inv, o_st, b_st; inputs points: list of Point3d
# ---------- python: Python ----------
import pickle
import random

from compas_ghpython import unload_modules
unload_modules("lws_geometry")
unload_modules("coop_assembly")
unload_modules("compas_fab")
unload_modules("core")

from compas.geometry import *
from compas.utilities.xfunc import XFunc
from compas_ghpython.artists import NetworkArtist
from compas_ghpython.utilities.drawing import xdraw_network
from compas.datastructures.network import Network
from coop_assembly.geometry_generation.main import main_gh_simple
from coop_assembly.help_functions.drawing import draw_network_inv_gh

dict_nodes = {}
for i,p in enumerate(points):
    if i > 2:
        nodes       = points[0:i]
        dists       = [distance_point_point(points[i], n) for n in nodes]
        nodes_inds  = [j for y,j in sorted(zip(dists,range(0,i)))] 
        nodes_fin = nodes_inds[0:3]
        
        dict_nodes[str(i)]= nodes_fin

points = [(p[0], p[1], p[2]) for p in points]

supports_bars = [(0,1), (1,2), (2,0)]
supports_nodes = [0, 1, 2, 4]
load_bars = [(4,5)]

load = (0,0,-2000)
print("about to run")
data = main_gh_simple(points, dict_nodes, r, supports_nodes, supports_bars, load_bars, load, correct=False)

o_st = Network.from_data(data[1])
b_st = Network.from_data(data[0])
#o_st = data[1]
#b_st = data[0]

pts_new, lns_netw = xdraw_network(o_st)
pts_inv, lns_inv, lns_conn  = draw_network_inv_gh(b_st)
# ---------- end python ----------
line = Line(python.lns_netw)
line_2 = Line(python.lns_inv)
pipe = Pipe(Curve=python.lns_inv, Radius=number_slider, Caps=0)
item_2 = ListItem(List=line_2, Index=Slider(3, range=0..50), Wrap=True)
pt_2 = Point(python.pts_netw)
preview = CustomPreview(Geometry=pipe, Shader=ColourSwatch(SwatchColor=RGBA(61, 200, 255, 168)))
item_3 = ListItem(List=pt_2, Index=Slider(3, range=0..20), Wrap=True)
