# Grasshopper definition 190919_DesignAndAssembly_stefana_cleaned.gh (Grasshopper 1.0.7)

panel = Panel("C:\Users\greyw\AppData\Local\Continuum\miniconda3\envs\coop_assembly_ws\python.exe")

# ----
# Settings
# --> Set your IP address
# --> Set robot IP address
server_address = ValueList({"192.168.10.1", "192.168.10.2", "192.168.10.3", "192.168.10.20", "127.0.0.1"}, selected="192.168.10.2")
ur_ip1 = ValueList({"192.168.10.10", "192.168.10.11", "192.168.10.12", "127.0.0.1"}, selected="192.168.10.10")
server_port = Integer(30003)
globals = PythonScript(server_address=server_address, server_port=server_port, ur_ip1=ur_ip1)  # inputs server_port: Int32
# ---------- globals: Python ----------
from scriptcontext import sticky as st

st["server_address"] = server_address
st["server_port"] = server_port

st["ur_ip1"] = ur_ip1
print st["ur_ip1"]
# ---------- end globals ----------

# ----
# Check if UR is available
ping = Button()
py = PythonScript(ip=ur_ip1, ping=ping)  # -> out, trigger
# ---------- py: Python ----------
from scriptcontext import sticky as st
from ur_online_control.communication import is_available

#print ip
guid = str(ghenv.Component.InstanceGuid)
txt_key = "txt_" + guid
if txt_key not in st:
    st[txt_key] = ""

if ping:
    
    available = is_available(ip)
    
    if available:
        st[txt_key] = "%s is up!" % ip
        trigger = True
    else:
        st[txt_key] = "%s is down!" % ip
        trigger = False

print st[txt_key]
# ---------- end py ----------
# add visualisation from paths
# add tool
panel_2 = Panel(py.out)

shrinked_by = Slider(1, range=0..10)
number_slider = Slider(5.3, range=0..50)

point = Point([<point referenced from the Rhino model> x4])
list_item = ListItem(List=point, Index=Slider(0, range=0..11), Wrap=True)
ghpython_script = PythonScript(
    points=point,
    r=number_slider,
    run=Toggle(True),
    use_rpc=Toggle(True),
    restart_rpc_server=Toggle(False),
    python_path=panel)  # -> out, pts_netw, lns_netw, pts_inv, lns_inv, o_st, b_st; inputs points: list of Point3d, use_rpc: Boolean, restart_rpc_server: Boolean
# ---------- ghpython_script: Python ----------
from compas_ghpython import unload_modules
unload_modules("coop_assembly")

python_path = python_path or 'pythonw'
print('python path: ', python_path)

if use_rpc:
    from compas.rpc import Proxy
    geo_gen_execute = Proxy('coop_assembly.geometry_generation.execute', python=python_path, url='http://127.0.0.1')
    if restart_rpc_server:
        geo_gen_execute.stop_server()
        geo_gen_execute.start_server()

from compas.geometry import distance_point_point
from compas_ghpython.utilities import draw_network
from compas.datastructures.network import Network
from coop_assembly.geometry_generation.main import main_gh_simple
from coop_assembly.help_functions.drawing import draw_network_inv_gh

dict_nodes = {}

for i, p in enumerate(points):
    if i > 2:
        nodes       = points[0:i]
        dists       = [distance_point_point(points[i], n) for n in nodes]
        nodes_inds  = [j for y,j in sorted(zip(dists,range(0,i)))] 
        nodes_fin = nodes_inds[0:3]
        
        dict_nodes[str(i)]= nodes_fin

points = [(p[0], p[1], p[2]) for p in points]

supports_bars = [(0,1), (1,2), (2,0)]
supports_nodes = [0, 1, 2, 4]
load_bars = [(4,5)]

load = (0,0,-2000)

if run:
    print("about to run in ghpython")
    if not use_rpc:
        # xfunc call
#        b_st_data, o_st_data = main_gh_simple(points, dict_nodes, r, \
#            correct=False, use_xfunc=True)
        b_st_data, o_st_data = main_gh_simple(points, dict_nodes, r, \
            correct=False, use_xfunc=True, python_path=python_path)
    else:
        b_st_data, o_st_data = geo_gen_execute.execute_from_points(
            points, dict_nodes, r, support_nodes=supports_nodes,
            support_bars=supports_bars, load_bars=load_bars, load=load, correct=False)
    
    o_st = Network.from_data(o_st_data)
    b_st = Network.from_data(b_st_data)
    o_st.struct_bar = b_st
    
    pts_new, lns_netw = draw_network(o_st)
    pts_inv, lns_inv, lns_conn  = draw_network_inv_gh(b_st)
# ---------- end ghpython_script ----------

bang = Button()
panel_3 = Panel("Unload libraries")
unload = PythonScript(bang=bang)
# ---------- unload: Python ----------
from compas_ghpython import unload_modules

unload_modules("compas")
unload_modules("ur_online_control")
unload_modules("ffw_2018")
# ---------- end unload ----------

subtraction = Subtraction(A=number_slider, B=shrinked_by)
panel_4 = Panel(ghpython_script.out)
list = ValueList({"no_tool": 0, "measurement_tool": 1, "sand_deposition_tool": 2, "earth_deposition_tool": 3, "clay_subtraction_tool": 4, "pack_tool": 5, "arch_2019july_tool3A": 6, "arch_2019july_tool3B": 7, "vault_test2_A": 8, "vault_test2_B": 9, "vault_test2_Measure": 10}, selected="vault_test2_A")
list_2 = ValueList({"robot 1": "robot_1", "robot 2": "robot_2", "robot 3": "robot_3", "archTest_robot_2", "robot_1/2", "robot_2/2", "robot_1/2_adjust", "robot_2/2_adjust"}, selected="robot 1")
tools = Tools(tool_id=list)  # -> tool_12, s_8
number_slider_2 = Slider(3, range=0..50)
base = PythonScript(rnum=list_2)  # -> base_frame
# ---------- base: Python ----------
from compas.geometry import Frame
#from compas.geometry import Transformation, Rotation
#from compas_ghpython import xdraw_frame
#import math
#import Rhino.Geometry as rg




# for robots 1 and 2


if rnum == "robot_1":
    origin = [0.0, 0.0, 0.0]
    xaxis = [0.5, 0.0, 0.0]
    yaxis = [0.0, 0.5, 0.0]

#if rnum == "robot_1":
#    origin = [-468.74, -100.60, 161.23]
#    xaxis = [0.71376, 0.70037, 0.00520]
#    yaxis = [-0.70037, 0.71364, 0.01408]
#    

if rnum == "robot_2":
    origin = [-468.74, -100.60, 161.23]
    xaxis = [0.71376, 0.70037, 0.00520]
    yaxis = [-0.70037, 0.71364, 0.01408]


if rnum == "robot_3":
    origin = [-110.14, 465.76, 167.41]
    xaxis = [0.71228, -0.70189, -0.00042]
    yaxis = [0.70182, 0.71220, 0.01506]

if rnum == "archTest_robot_2":
    origin = [0.0, -863.6, 0.0]
#    origin = [863.6, 0.0, 0.0]
#    xaxis = [-0.5, 0, 0]
#    yaxis = [0, -0.5, 0]
    xaxis = [0.0, 0.5, 0.0]
    yaxis = [-0.5, 0.0, 0.0]
#    

if rnum == "robot_1/2":
    origin = [0.94, -433.95, 21.84]
    xaxis = [-0.01817, -0.99982, 0.00520]
    yaxis = [0.99980, -0.01813, 0.00837]

if rnum == "robot_2/2":
    origin = [-4.67, -430.58, 20.93]
    xaxis = [0.01186, 0.99984, -0.01342]
    yaxis = [-0.99993, 0.01186, -0.00009]

if rnum == "robot_1/2_adjust":
    # 18.4+9.057 = 27.457
    origin = [3.0, -431.8, 26]
    xaxis = [0.0, -1.0, 0.0]
    yaxis = [1.0, 0.0, 0.0]
#    
#===========further away
#if rnum == "robot_1/2_adjust":
#    # 18.4+9.057 = 27.457
#    origin = [1.0, -445, 26]
#    xaxis = [0.0, -1.0, 0.0]
#    yaxis = [1.0, 0.0, 0.0]

if rnum == "robot_2/2_adjust":
    origin = [0.0, -431.8, 27.457]
    xaxis = [0.0, 1.0, 0.0]
    yaxis = [-1.0, 0.0, 0.0]

base_frame = Frame(list(origin), list(xaxis), list(yaxis))
print base_frame
# ---------- end base ----------

# ---- group: Robot1
# 1. load robot model
# 2. set tool
# 3. set basis
list_3 = ValueList({"UR3", "UR5", "UR10"}, selected="UR3")
robot = PythonScript(model=list_3)  # -> robot1
# ---------- robot: Python ----------
from ur_online_control.ur.ur10 import UR10
from ur_online_control.ur.ur5 import UR5
from ur_online_control.ur.ur3 import UR3
from scriptcontext import sticky as st

if model == "UR5":
    robot1 = UR5()
elif model == "UR10":
    robot1 = UR10()
elif model == "UR3":
    robot1 = UR3()
# ---------- end robot ----------
set_params = PythonScript(robot1=robot, tool=tools.tool_12, base_frame=base)  # -> robot1
# ---------- set_params: Python ----------
from ur_online_control.ur.ur10 import UR10
from ur_online_control.ur.ur5 import UR5
from scriptcontext import sticky as st
from ur_online_control.ur.tool import Tool
from compas.geometry import Frame


if tool:
    robot1.set_tool(tool)
else:
    robot1.set_tool(Tool(Frame.worldXY()))  
if base_frame:
    robot1.set_base(base_frame)

st["robot1"] = robot1
# ---------- end set_params ----------

# ----
pipe = Pipe(Curve=ghpython_script.lns_inv, Radius=subtraction, Caps=0)  # -> simplify(Pipe)
line = Line(ghpython_script.lns_netw)
line_2 = Line(ghpython_script.lns_inv)
point_2 = Point(ghpython_script.pts_netw)
custom_preview = CustomPreview(Geometry=pipe, Shader=ColourSwatch(SwatchColor=RGBA(61, 200, 255, 168)))
list_item_2 = ListItem(List=line_2, Index=number_slider_2, Wrap=True)
list_item_3 = ListItem(List=point_2, Index=Slider(3, range=0..20), Wrap=True)
pt = Point(<point referenced from the Rhino model>)  # disabled
crv = Curve(<curve referenced from the Rhino model>)  # disabled
crv_2 = Curve(<curve referenced from the Rhino model>)  # disabled

get = Button()
pose = PythonScript(get=get)  # -> pose_cartesian
# ---------- pose: Python ----------
from scriptcontext import sticky as st
from ur_online_control.ur_direct import get_current_pose_cartesian

server_address = st["server_address"]
server_port = 30005
ur_ip1 = st["ur_ip1"]
robot1 = st["robot1"]
tool_angle_axis = list(robot1.tool.tcp_frame.point) + robot1.tool.tcp_frame.axis_angle_vector
print tool_angle_axis

guid = str(ghenv.Component.InstanceGuid)
pose_cartesian_key = "pose_cartesian" + guid


if get:
    st[pose_cartesian_key] = get_current_pose_cartesian(server_address, server_port, ur_ip1, tool_angle_axis)

if pose_cartesian_key not in st:
    pose_cartesian = []
else:
    pose_cartesian = st[pose_cartesian_key]
# ---------- end pose ----------
panel_5 = Panel("get pose cartesian")
py_2 = PythonScript(pose_cartesian=pose)  # -> frame_WCS; inputs pose_cartesian: list
# ---------- py_2: Python ----------
import Rhino.Geometry as rg
from scriptcontext import sticky as st
from compas.geometry import Frame
from compas.geometry.xforms import Transformation

robot1 = st["robot1"]

print pose_cartesian
if pose_cartesian:
    #frame_RCS = Frame.from_pose_axis_angle_vector(pose_cartesian)
    frame_RCS = Frame.from_axis_angle_vector(axis_angle_vector=pose_cartesian[3:], point=pose_cartesian[:3])
    frame_WCS = robot1.get_frame_in_WCS(frame_RCS)
    
    print frame_RCS
# ---------- end py_2 ----------
panel_6 = Panel(pose)
draw = Draw(frame=py_2)  # -> G, C
preview = CustomPreview(Geometry=draw.G, Shader=draw.C)

get_2 = Button()
pose_2 = PythonScript(get=get_2, get_init=py.trigger)  # -> pose_joints
# ---------- pose_2: Python ----------
from scriptcontext import sticky as st
from ur_online_control.ur_direct import get_current_pose_joints
from compas_fab.robots import Configuration

server_address = st["server_address"]
server_port = 30005
ur_ip1 = st["ur_ip1"]
robot1 = st["robot1"]
tool_angle_axis = list(robot1.tool.tcp_frame.point) + robot1.tool.tcp_frame.axis_angle_vector
print tool_angle_axis

guid = str(ghenv.Component.InstanceGuid)
pose_joints_key = "pose_joints" + guid


if get or get_init:
    st[pose_joints_key] = get_current_pose_joints(server_address, server_port, ur_ip1, tool_angle_axis)
    
if pose_joints_key not in st:
    pose_joints = Configuration.from_revolute_values([0,0,0,0,0,0])
else:
    pose_joints = Configuration.from_revolute_values(st[pose_joints_key])

print pose_joints
# ---------- end pose_2 ----------
panel_7 = Panel("get pose joint")
panel_8 = Panel(pose_2)

pl = ConstructPlane(Origin=pt, XAxis=crv_2, YAxis=crv)  # disabled

# ----
# Direct UR control
read = Button()

mesh_join = MeshJoin(Meshes=tools.s_8)

# ---- group: Define joint positions
base_2 = Slider(-329.599, range=-360..360)
elbow = Slider(-111.454, range=-360..360)
wrist2 = Slider(-82.725, range=-360..360)
shoulder = Slider(-49.479, range=-360..360)
wrist1 = Slider(-190.504, range=-360..360)
wrist3 = Slider(91.571, range=-360..360)
ur1_q1_q6 = Data([base_2, shoulder, elbow, wrist1, wrist2, wrist3])

# ----
# Visualisation
# Choose from different options, which robot configuration to visualise
robot_2 = Data(set_params)
pose_joints = Data(pose_2)
py_3 = GhPythonScript(joint_values=ur1_q1_q6)  # -> configuration; inputs joint_values: list
# ---------- py_3: Python ----------
import math
from compas_fab.robots import Configuration

configuration = Configuration.from_revolute_values([math.radians(d) for d in joint_values])
# ---------- end py_3 ----------

python = GhPythonScript(read=read, bar_nb=Slider(3, range=0..50))  # -> out, list_joints_val, gripper_ctrl; inputs bar_nb: Int32
# ---------- python: Python ----------
import json

with open(r'C:\Users\greyw\Desktop\choreo_instances\result\choreo_result.json') as json_file:
    data = json.load(json_file)
    print len(data)

joint_traj_dict = data[bar_nb]


len_pick_approach = len(joint_traj_dict["pick_approach"]["points"])
len_pick_retreat = len(joint_traj_dict["pick_retreat"]["points"])
len_pick2place = len(joint_traj_dict["pick2place"]["points"])
len_place_approach = len(joint_traj_dict["place_approach"]["points"])
len_place_retreat = len(joint_traj_dict["place_retreat"]["points"])
len_place2pick = len(joint_traj_dict["place2pick"]["points"])

list_joints_val = []

pts_pick_approach = joint_traj_dict["pick_approach"]["points"]
for p in pts_pick_approach:
    vals = p["values"]
    list_joints_val.append(p)

pts_pick_retreat = joint_traj_dict["pick_retreat"]["points"]
for p in pts_pick_retreat:
    vals = p["values"]
    list_joints_val.append(p)
    
pts_pick2place = joint_traj_dict["pick2place"]["points"]
for p in pts_pick2place:
    vals = p["values"]
    list_joints_val.append(p)
    
pts_place_approach = joint_traj_dict["place_approach"]["points"]
for p in pts_place_approach:
    vals = p["values"]
    list_joints_val.append(p)
    
pts_place_retreat = joint_traj_dict["place_retreat"]["points"]
for p in pts_place_retreat:
    vals = p["values"]
    list_joints_val.append(p)
    
pts_place2pick = joint_traj_dict["place2pick"]["points"]
for p in pts_place2pick:
    vals = p["values"]
    list_joints_val.append(p)
    
#print(len_pick_approach+len_pick_retreat+len_pick2place+len_place_approach+len_place_retreat+len_place2pick)
#print len(list_joints_val)
print list_joints_val[0]["values"]

nb0 = 0
nb1 = len_pick_approach
nb2 = len_pick_approach + len_pick_retreat
nb3 = len_pick_approach + len_pick_retreat + len_pick2place
nb4 = len_pick_approach + len_pick_retreat + len_pick2place + len_place_approach
nb5 = len_pick_approach + len_pick_retreat + len_pick2place + len_place_approach + len_place_retreat

gripper_ctrl = [nb0, nb1, nb2, nb3, nb4, nb5]
# ---------- end python ----------
ghpython_script_2 = GhPythonScript(list_joints=python.list_joints_val)  # -> out, items; inputs list_joints: list
# ---------- ghpython_script_2: Python ----------
    
items = []
for j in list_joints:
    items.append(j['values'])

#print(items)
# ---------- end ghpython_script_2 ----------
list_item_4 = ListItem(List=ghpython_script_2.items, Index=Slider(0, range=0..100), Wrap=True)
panel_9 = Panel(list_item_4)

# ---- group: Define joint positions
base_3 = Slider(-329.599, range=-360..360)  # disabled
elbow_2 = Slider(-111.454, range=-360..360)  # disabled
wrist2_2 = Slider(-82.725, range=-360..360)  # disabled
wrist3_2 = Slider(91.571, range=-360..360)  # disabled
shoulder_2 = Slider(-49.479, range=-360..360)  # disabled
wrist1_2 = Slider(-190.504, range=-360..360)  # disabled
ur1_q1_q6_2 = Data([base_3, shoulder_2, elbow_2, wrist1_2, wrist2_2, wrist3_2])  # disabled

# ----
# Visualisation
# Choose from different options, which robot configuration to visualise
planes_wcs = Plane()  # disabled
pose_joints_2 = Data(pose_2)  # disabled
robot_3 = Data(set_params)  # disabled
back = Button()  # disabled
reset = Button()  # disabled
py_4 = GhPythonScript(joint_values=ur1_q1_q6_2)  # -> configuration; inputs joint_values: list; disabled; same code as py_3

# ---- group: Define plane in WCS, calculate joint positions
pt_2 = Point(Point(-57.48867812, -568.9400192, 535.0971902))  # disabled
xy = XYPlane(Origin=pt_2)  # disabled
deplane = DeconstructPlane(Plane=xy)  # -> Origin, XAxis, YAxis, ZAxis; disabled
multiplication = Multiplication(A=deplane.XAxis, B=-1)  # disabled
select_configuration = Slider(0, range=0..7)  # disabled
pl_2 = ConstructPlane(Origin=deplane.Origin, XAxis=multiplication, YAxis=deplane.YAxis)  # disabled
plane_wcs = Plane(pl)  # disabled
inverse = PythonScript(robot1=robot_3, plane_WCS=plane_wcs, idx=select_configuration)  # -> configuration, plane_WCS; inputs plane_WCS: Plane, idx: Int32; disabled
# ---------- inverse: Python ----------
import Rhino.Geometry as rg
from compas.geometry import Frame, Transformation
#from compas_ghpython import xdraw_frame
import math


#plane_WCS.Rotate(math.radians(-10), plane_WCS.YAxis, plane_WCS.Origin)
#plane_WCS.Rotate(math.radians(-10), plane_WCS.ZAxis, plane_WCS.Origin)

plane_WCS.Rotate(math.radians(90), plane_WCS.ZAxis, plane_WCS.Origin)

tcp_WCS = Frame(plane_WCS.Origin, plane_WCS.XAxis, plane_WCS.YAxis)
#print tcp_WCS

# transform frame to robot1 coordinate system
#tool_plane_in_RCS = self.get_tool_plane_in_RCS(tp_WCS)
tcp_RCS = robot1.get_frame_in_RCS(tcp_WCS)

tool0_RCS = robot1.get_tool0_frame_from_tcp_frame(tcp_RCS)

# calculate solutions to frame
solutions = robot1.inverse_kinematics(tool0_RCS)

if not len(solutions):
    q = [0,0,0,0,0,0]
else:
    idx = min(len(solutions) - 1, idx)
    q = solutions[idx]
    
#print q

configuration = q
print configuration
# ---------- end inverse ----------

# ---- group: Calculate joint positions for path
# Add init joint states
joint_states = Data([-0.1728179112, -1.415058186, 1.813991282, -1.971940356, -1.571654205, -3.308720436])  # disabled
init_configuration = Slider(2, range=0..7)  # disabled
py_5 = PythonScript(robot1=robot_3, planes_WCS=planes_wcs, configuration_idx=init_configuration, init_configuration=joint_states)  # -> configurations; inputs planes_WCS: list, configuration_idx: Int32, init_configuration: list; disabled
# ---------- py_5: Python ----------
from compas_ghpython import unload_modules
unload_modules('ur_online_control')
import Rhino.Geometry as rg
from compas.geometry import Frame 
from compas.geometry.xforms import Transformation
#from compas_ghpython import xdraw_frame
from ur_online_control.ur.kinematics import calculate_configurations_for_path, format_joint_positions


# TODO this must be optimized! matrix multiplication!
frames_tool0_RCS = []
for plane_WCS in planes_WCS:
    tcp_WCS = Frame(plane_WCS.Origin, plane_WCS.XAxis, plane_WCS.YAxis)
    tcp_RCS = robot1.get_frame_in_RCS(tcp_WCS)
    frames_tool0_RCS.append(robot1.get_tool0_frame_from_tcp_frame(tcp_RCS))
    

#configurations = calculate_configurations_for_path(frames_tool0_RCS, robot1.params, init_configuration)
configurations = calculate_configurations_for_path(frames_tool0_RCS, robot1, init_configuration)
#print configurations
configurations = configurations[min([configuration_idx, len(configurations) - 1])]

def format(numbers, k=4):
    #numbers = format_joint_positions(numbers)
    return "[" + ", ".join([("%." + str(k) + "f") % n for n in numbers]) + "]"
# ---------- end py_5 ----------
start = Button()  # disabled
step = Button()  # disabled
stop = Button()  # disabled
counter = CountThroughList(L=py_5, start=start, stop=stop, step=step, step_back=back, reset=reset, interval=100)  # -> item; inputs L: list, start: Boolean, stop: Boolean, step_back: Boolean; disabled
# ---------- counter: Python ----------
from scriptcontext import sticky as st
from compas_ghpython import update_component


# store data in component
guid = str(ghenv.Component.InstanceGuid)
counter_key = "counter_" + guid
running_key = "running_" + guid

if counter_key not in st:
    st[counter_key] = 0

if running_key not in st:
    st[running_key] = False

if start:
    st[running_key] = True

if stop:
    st[running_key] = False

if step:
    if st[counter_key] < len(L) - 1:
        st[counter_key] += 1

if step_back:
    if st[counter_key] < len(L) - 1:
        st[counter_key] -= 1

if reset:
    st[counter_key] = 0

if len(L):
    item = L[st[counter_key]]

if st[running_key]:
    if st[counter_key] < len(L) - 1:
        st[counter_key] += 1
        update_component(ghenv, interval)
    else:
        st[counter_key] = 0
        st[running_key] = False
# ---------- end counter ----------

# ---- group: Calculate joint positions for path / Shows joint positions along path
flip = BooleanToggle(True)  # disabled
l2t = PythonScript(L=py_5, flip=flip)  # -> T; inputs L: list, flip: Boolean; disabled
# ---------- l2t: Python ----------
from compas_ghpython import list_to_ghtree
L = [l.values for l in L]

if flip:
    L = zip(*L)
T = list_to_ghtree(L)
# ---------- end l2t ----------
graph = QuickGraph(l2t, SortOrder=0)  # disabled

# ---- group: Visualise / robot model brep
py_6 = PythonScript(model=list_3)  # -> n
# ---------- py_6: Python ----------
if model == "UR5":
    n = 0
if model == "UR10":
    n = 1
if model == "UR3":
    n = 2


#n = 2 
print n
# ---------- end py_6 ----------
ur5_brep = UR5Brep([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])
ur10_brep = UR10Brep([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])
ur10_brep_2 = UR10Brep([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])
show_brep = BooleanToggle(False)
filter = StreamFilter(Gate=py_6, Stream0=ur5_brep, Stream1=ur10_brep, Stream2=ur10_brep_2)

# ---- group: Visualise
list_4 = ValueList({"0 forward, from angles": 0, "1 forward, from joint trajectory": 1}, selected="1 forward, from joint trajectory")
filter_2 = StreamFilter(Gate=list_4, Stream0=ur1_q1_q6, Stream1=list_item_4)
draw_2 = PythonScript(input=list_4, robot1=robot_2, joint_values=filter_2, mesh=filter, brep=filter, show_brep=show_brep, tool=mesh_join)  # -> meshes, tool0_plane, tcp_plane, robot_brep, list_degree; inputs mesh: list, brep: list, show_brep: Boolean, tool: Mesh
# ---------- draw_2: Python ----------
from compas_ghpython import unload_modules
unload_modules("ur_online_control")

from compas_ghpython import draw_frame
from compas_ghpython import mesh_draw
from compas_ghpython.geometry.xforms import xform_from_transformation
from compas.geometry import Frame
from compas.geometry.xforms import Transformation
from compas_fab.robots import Configuration

from compas.datastructures import mesh_transformed

import Rhino.Geometry as rg
import Rhino
import math

import time

def mesh_update_vertices(mesh, vertices):
    for i in range(len(vertices)):
        mesh.vertex[i].update({'x': vertices[i][0], 'y': vertices[i][1], 'z': vertices[i][2]})

if joint_values:
    if input == 0:
        configuration = Configuration.from_revolute_values([math.radians(d) for d in joint_values])
    elif input == 1:
        configuration = Configuration.from_revolute_values([d for d in joint_values])
    list_joint_values = configuration.data["values"]
    list_degree = []
    for degree in list_joint_values:
        degree = math.degrees(degree)
        list_degree.append(degree)
    print list_degree
    #q = BaseConfiguration.from_joints(configuration)
    q = configuration
    print q
    #print q.joint_values
    
    #print robot1.get_forward_transformations(q)
    R0, R1, R2, R3, R4, R5 = robot1.get_forward_transformations(q)
    
    tool0_frame2 = robot1.tool0_frame.transformed(R5)
    #tcp_frame2 = Frame.from_transformation(Transformation.from_frame(tool0_frame2) * robot1.transformation_tool0_tcp)
    
    #print robot1.transformation_tool0_tcp
    #print robot1.transformation_tcp_tool0
    #print robot1.transformation_tool0_tcp * robot1.transformation_tcp_tool0
    #print tcp_frame2
    tcp_frame2 = Frame.from_transformation(Transformation.from_frame(tool0_frame2) * robot1.transformation_tcp_tool0)
    #print tcp_frame2
    
    #tool0_frame, tcp_frame = robot1.get_transformed_tool_frames(R5)
    
    tool0_frame = tool0_frame2
    tcp_frame = tcp_frame2
    
    m0, m1, m2, m3, m4, m5 = mesh
    for i in range(6):
        exec("R%drg = xform_from_transformation(R%d)" % (i, i))
        exec("m%d.Transform(R%drg)" % (i, i))
    #exec("mt.Transform(R5rg)")
    meshes = [m0, m1, m2, m3, m4, m5]
    #print meshes
    
#    before = time.time()
    tff = Transformation.from_frame(tool0_frame)
#    print('Transformation.from_frame',time.time() - before)
#    before = time.time()
##    mt = robot1.tool.get_transformed_model(tff)
#    mt=robot1.tool.model[0]
#    mt = mesh_transformed(mt, tff)
##    mt = robot1.tool.get_transformed_model(R5rg)
#    print('get_transformed_model',time.time() - before)
#    
#    if mt:
#        meshes.append(mesh_draw(mt))
        #meshes.append(map(mesh_draw, mt))
    
    ghtf = xform_from_transformation(tff)
    tool.Transform(ghtf)
    meshes.append(tool)
    
    """
    m0, m1, m2, m3, m4, m5, tool0_frame, tcp_frame = robot1.get_transformed_model(q)
    mt = robot1.get_transformed_tool_model(tcp_frame)
    
    meshes = []
    meshes.append(mesh_draw(m0))
    meshes.append(mesh_draw(m1))
    meshes.append(mesh_draw(m2))
    meshes.append(mesh_draw(m3))
    meshes.append(mesh_draw(m4))
    meshes.append(mesh_draw(m5))
    if mt:
        meshes.append(mesh_draw(mt))
    
    """
    
    tool0_plane = draw_frame(tool0_frame)
    tcp_plane = draw_frame(tcp_frame)
    
    if show_brep:
        
        b0, b1, b2, b3, b4, b5 = brep
        
        b0.Transform(R0rg)
        b1.Transform(R1rg)
        b2.Transform(R2rg)
        b3.Transform(R3rg)
        b4.Transform(R4rg)
        b5.Transform(R5rg)
        
        robot_brep = [b0, b1, b2, b3, b4, b5]
        print robot_brep

#print brep
print joint_values
# ---------- end draw_2 ----------
preview_2 = CustomPreview(Geometry=draw_2.meshes, Shader=ColourSwatch(SwatchColor=RGBA(145, 207, 200, 82)))
robot_brep = Brep(draw_2.robot_brep)
tool0_plane = Plane(draw_2.tool0_plane)
tcp_plane = Plane(draw_2.tcp_plane)
mesh = Mesh(draw_2.meshes)  # disabled
draw_3 = RepresentPlaneAsLines(plane=[tcp_plane, tool0_plane], size=100)  # -> G, C
# ---------- draw_3: Python ----------
import Rhino.Geometry as rg
from System.Drawing import Color

if plane:

    G = []
    G.append(rg.Line(plane.Origin, size * plane.XAxis))
    G.append(rg.Line(plane.Origin, size * plane.YAxis))
    G.append(rg.Line(plane.Origin, size * plane.ZAxis))
    
    C = []
    C.append(Color.FromArgb(255, 0, 0))
    C.append(Color.FromArgb(0, 255, 0))
    C.append(Color.FromArgb(0, 0, 255))
# ---------- end draw_3 ----------
preview_3 = CustomPreview(Geometry=draw_3.G, Shader=draw_3.C)

# ----
number = Slider(0, range=0..10)
panel_10 = Panel("set digital out")
value = BooleanToggle(False)
digital_out = PythonScript(number=number, value=value)  # -> script; inputs number: Int32, value: Boolean
# ---------- digital_out: Python ----------
script = "def prog():\n"
script += "\ttextmsg(\">> program start\")\n"
script += "\tset_digital_out(%i, %s)\n" % (int(number), str(value))
script += "\ttextmsg(\"<< program end\")\n"
script += "end\n"
script += "prog()\n\n"

print script
# ---------- end digital_out ----------
send = Button()
send_2 = Send(script=digital_out, send=send)
panel_11 = Panel(send_2)

send_3 = Button()

idx = Slider(0, range=0..100)
panel_12 = Panel("move joints")
list_5 = ValueList({"send all positions": 0, "send only one position": 1}, selected="send all positions")
joint_configurations = Data(python.list_joints_val)
item = ListItem(List=joint_configurations, Index=idx, Wrap=True)
filter_3 = StreamFilter(Gate=list_5, Stream0=joint_configurations, Stream1=item)
movej = PythonScript(
    joint_configurations=filter_3,
    gripper_ctrl=python.gripper_ctrl,
    velocity=Slider(379, range=0..1000),
    acceleration=Slider(500, range=0..5000),
    pickup=Toggle(True),
    placement=Toggle(True),
    retreat=Toggle(True))  # -> script; inputs joint_configurations: list, gripper_ctrl: list of Int32
# ---------- movej: Python ----------
script_lines = []


for i,configuration in enumerate(joint_configurations):
    #print configuration.joint_values
#    print configuration["values"]
    if pickup:
        if i == gripper_ctrl[0]:
            script_lines.append("sleep(1)")
            script_lines.append("set_digital_out(0, False)")
            script_lines.append("set_digital_out(1, True)")
            script_lines.append("sleep(1)")
            script_lines.append("movej(%s, a=%f, v=%f, r=%f)" % (str(configuration["values"]), acceleration/1000., velocity/1000., 0.0))
        
        elif i < gripper_ctrl[1]:
            script_lines.append("movej(%s, a=%f, v=%f, r=%f)" % (str(configuration["values"]), acceleration/1000., velocity/1000., 0.0))
            
        elif i == gripper_ctrl[1]:
            script_lines.append("movej(%s, a=%f, v=%f, r=%f)" % (str(configuration["values"]), acceleration/1000., velocity/1000., 0.0))
        else: pass
    
    if placement:
        if i < gripper_ctrl[1]:
            pass
        elif i == gripper_ctrl[1]:
            script_lines.append("sleep(1)")
            script_lines.append("set_digital_out(1, False)")
            script_lines.append("set_digital_out(0, True)")
            script_lines.append("sleep(1)")
        
        elif i < gripper_ctrl[2]:
            script_lines.append("movej(%s, a=%f, v=%f, r=%f)" % (str(configuration["values"]), acceleration/1000., velocity/1000., 0.0))
            
        elif i < gripper_ctrl[3]:
            script_lines.append("movej(%s, a=%f, v=%f, r=%f)" % (str(configuration["values"]), acceleration/1000., velocity/1000., 0.01))
            
        elif i < gripper_ctrl[4]:
            script_lines.append("movej(%s, a=%f, v=%f, r=%f)" % (str(configuration["values"]), acceleration/1000., velocity/1000., 0.0))
            
        elif i == gripper_ctrl[4]:
            script_lines.append("movej(%s, a=%f, v=%f, r=%f)" % (str(configuration["values"]), acceleration/1000., velocity/1000., 0.0))
    
    if retreat:
        if i < gripper_ctrl[4]:
            pass
        elif i == gripper_ctrl[4]:
            script_lines.append("sleep(1)")
            script_lines.append("set_digital_out(0, False)")
            script_lines.append("set_digital_out(1, True)")
            script_lines.append("sleep(1)")
    
        elif i < gripper_ctrl[5]:
            script_lines.append("movej(%s, a=%f, v=%f, r=%f)" % (str(configuration["values"]), acceleration/1000., velocity/1000., 0.0))
            
        else:
            script_lines.append("movej(%s, a=%f, v=%f, r=%f)" % (str(configuration["values"]), acceleration/1000., velocity/1000., 0.01))

#print script_lines


script = "def prog():\n"
print script
script += "\ttextmsg(\">> program start\")\n"
script += "".join(["\t%s\n" % line for line in script_lines])
script += "\ttextmsg(\"<< program end\")\n"
script += "end\n"
script += "prog()\n\n"


print script

#script = ""
# ---------- end movej ----------
send_4 = Send(script=movej, send=send_3)
panel_13 = Panel(send_4)

# ---- group: Visualise / robot model brep
py_7 = PythonScript(model=list_3)  # -> n; disabled; same code as py_6
ur5_brep_2 = UR5Brep([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])  # disabled
ur10_brep_3 = UR10Brep([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])  # disabled
ur10_brep_4 = UR10Brep([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])  # disabled
show_brep_2 = BooleanToggle(True)  # disabled
filter_4 = StreamFilter(Gate=py_7, Stream0=ur5_brep_2, Stream1=ur10_brep_3, Stream2=ur10_brep_4)  # disabled

# ---- group: Visualise
list_6 = ValueList({"0 forward, from angles": 0, "1 inverse, from one plane": 1, "2 inverse, from multiple planes": 2, "3 forward, from robot": 3, "4 forward, from robot during runtime": 4}, selected="0 forward, from angles")  # disabled
filter_5 = StreamFilter(Gate=list_6, Stream0=py_4, Stream1=inverse.configuration, Stream2=counter, Stream3=pose_joints_2)  # disabled
draw_4 = PythonScript(robot1=robot_3, configuration=filter_5, mesh=filter_4, brep=filter_4, show_brep=show_brep_2)  # -> meshes, tool0_plane, tcp_plane, robot_brep, list_degree; inputs mesh: list, brep: list, show_brep: Boolean; disabled
# ---------- draw_4: Python ----------
from compas_ghpython import unload_modules
unload_modules("ur_online_control")

from compas_ghpython import draw_frame
from compas_ghpython import mesh_draw
from compas_ghpython.geometry.xforms import xform_from_transformation
from compas.geometry import Frame
from compas.geometry.xforms import Transformation
from compas_fab.robots import Configuration

import Rhino.Geometry as rg
import Rhino
import math

def mesh_update_vertices(mesh, vertices):
    for i in range(len(vertices)):
        mesh.vertex[i].update({'x': vertices[i][0], 'y': vertices[i][1], 'z': vertices[i][2]})

if configuration:
    list_joint_values = configuration.data["values"]
    list_degree = []
    for degree in list_joint_values:
        degree = math.degrees(degree)
        list_degree.append(degree)
    print list_degree
    #q = BaseConfiguration.from_joints(configuration)
    q = configuration
    print q
    #print q.joint_values
    
    #print robot1.get_forward_transformations(q)
    R0, R1, R2, R3, R4, R5 = robot1.get_forward_transformations(q)
    
    tool0_frame2 = robot1.tool0_frame.transformed(R5)
    tcp_frame2 = Frame.from_transformation(Transformation.from_frame(tool0_frame2) * robot1.transformation_tool0_tcp)
    
    #print robot1.transformation_tool0_tcp
    #print robot1.transformation_tcp_tool0
    #print robot1.transformation_tool0_tcp * robot1.transformation_tcp_tool0
    #print tcp_frame2
    tcp_frame2 = Frame.from_transformation(Transformation.from_frame(tool0_frame2) * robot1.transformation_tcp_tool0)
    #print tcp_frame2
    
    tool0_frame, tcp_frame = robot1.get_transformed_tool_frames(R5)
    
    tool0_frame = tool0_frame2
    tcp_frame = tcp_frame2
    
    m0, m1, m2, m3, m4, m5 = mesh
    for i in range(6):
        exec("R%drg = xform_from_transformation(R%d)" % (i, i))
        exec("m%d.Transform(R%drg)" % (i, i))
    meshes = [m0, m1, m2, m3, m4, m5]
    #print meshes
    mt = robot1.tool.get_transformed_model(Transformation.from_frame(tool0_frame))
    
    if mt:
        meshes.extend(map(mesh_draw, mt))
    
    """
    m0, m1, m2, m3, m4, m5, tool0_frame, tcp_frame = robot1.get_transformed_model(q)
    mt = robot1.get_transformed_tool_model(tcp_frame)
    
    meshes = []
    meshes.append(mesh_draw(m0))
    meshes.append(mesh_draw(m1))
    meshes.append(mesh_draw(m2))
    meshes.append(mesh_draw(m3))
    meshes.append(mesh_draw(m4))
    meshes.append(mesh_draw(m5))
    if mt:
        meshes.append(mesh_draw(mt))
    
    """
    
    tool0_plane = draw_frame(tool0_frame)
    tcp_plane = draw_frame(tcp_frame)
    
    if show_brep:
        
        b0, b1, b2, b3, b4, b5 = brep
        
        b0.Transform(R0rg)
        b1.Transform(R1rg)
        b2.Transform(R2rg)
        b3.Transform(R3rg)
        b4.Transform(R4rg)
        b5.Transform(R5rg)
        
        robot_brep = [b0, b1, b2, b3, b4, b5]
        print robot_brep

#print brep
# ---------- end draw_4 ----------
colour_swatch = ColourSwatch(SwatchColor=RGBA(145, 207, 200, 82))  # disabled
mesh_2 = Mesh(draw_4.meshes)  # disabled
preview_4 = CustomPreview(Geometry=mesh_2, Shader=colour_swatch)  # disabled
robot_brep_2 = Brep(draw_4.robot_brep)  # disabled
tool0_plane_2 = Plane(draw_4.tool0_plane)  # disabled
tcp_plane_2 = Plane(draw_4.tcp_plane)  # disabled
draw_5 = RepresentPlaneAsLines(plane=[tcp_plane_2, tool0_plane_2], size=100)  # -> G, C; disabled; same code as draw_3
preview_5 = CustomPreview(Geometry=draw_5.G, Shader=draw_5.C)  # disabled

# ----
stop_2 = Button()
stop_3 = PythonScript(stop=stop_2)
# ---------- stop_3: Python ----------
from scriptcontext import sticky as st
from ur_online_control.ur_direct import stop as stop_robot

ur_ip1 = st["ur_ip1"]

if stop:
    stop_robot(ur_ip1)
# ---------- end stop_3 ----------

panel_14 = Panel(draw_2.list_degree)
panel_15 = Panel(draw_4.list_degree)  # disabled
panel_16 = Panel(movej)
num = Number(subtraction)
line_3 = Line(line_2)
length = Length(Curve=line_3)

# ----
# pick up point
point_3 = Point(<point referenced from the Rhino model>)

unit_x = UnitX(Factor=length)
unit_y = UnitY(Factor=length)
cap_holes = CapHoles(Brep=pipe)
move = Move(Geometry=point_3, Motion=unit_x)  # -> Geometry, Transform
line_4 = Line(StartPoint=point_3, EndPoint=move.Geometry)
pipe_2 = Pipe(Curve=line_4, Radius=num, Caps=0)  # -> simplify(Pipe)
cap_holes_2 = CapHoles(Brep=pipe_2)

# ----
# sub list of elements
# (play with this if you only want to plan
# a sub part of the assembly)
panel_17 = Panel("""0
1
2
3
4
5""")
construct_path = ConstructPath(Indices=graft(panel_17))  # -> simplify(flatten(Branch))

brep = Brep(cap_holes_2)
brep_2 = Brep(cap_holes)
split_tree = SplitTree(Data=brep_2, Masks=flatten(construct_path))  # -> Positive, Negative
series = Series(Start=0, Step=1, Count=Slider(3, range=0..5))  # -> flatten(Series)
split_tree_2 = SplitTree(Data=brep, Masks=flatten(construct_path))  # -> Positive, Negative
list_item_5 = ListItem(List=flatten(split_tree.Positive), Index=series, Wrap=True)

# ----
# element
# in pick position
brep_3 = Brep(split_tree_2.Positive)

# ----
# element
# in place position
brep_4 = Brep(split_tree.Positive)

number_slider_3 = Slider(255, range=0..1000)
brep_5 = Brep(brep_3)
colour_rgb = ColourRGB(Alpha=255, Red=number_slider_3, Green=0, Blue=0)
colour_rgb_2 = ColourRGB(Alpha=255, Red=0, Green=0, Blue=number_slider_3)
custom_preview_2 = CustomPreview(Geometry=brep_5, Material=colour_rgb)
custom_preview_3 = CustomPreview(Geometry=brep_4, Material=colour_rgb_2)

# ----
# dms gripper
mesh_3 = Mesh(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)

# ----
# TCP visualization
point_4 = Point(Point(80.52500153, 0, 0))
panel_18 = Panel(point_4)
scale = Scale(Geometry=mesh_3, Center=Point(0, 0, 0), Factor="1000")  # -> Geometry, Transform
point_5 = Point(point_4)
xz_plane = XZPlane(Origin=Point(0, 0, 0))
point_6 = Point(point_5)
number_slider_4 = Slider(4.2, range=1..10)
plane_origin = PlaneOrigin(Base=xz_plane, Origin=point_6)
deconstruct_plane = DeconstructPlane(Plane=plane_origin)  # -> Origin, XAxis, YAxis, ZAxis
multiplication_2 = Multiplication(A=deconstruct_plane.YAxis, B=number_slider_4)
multiplication_3 = Multiplication(A=deconstruct_plane.XAxis, B=number_slider_4)
multiplication_4 = Multiplication(A=deconstruct_plane.ZAxis, B=number_slider_4)
colour_rgb_3 = ColourRGB(Alpha=255, Red="255", Green=0, Blue=0)
colour_rgb_4 = ColourRGB(Alpha=255, Red=0, Green=0, Blue="255")
colour_rgb_5 = ColourRGB(Alpha=255, Red=0, Green="255", Blue=0)
vector_display_ex = VectorDisplayEx(Point=deconstruct_plane.Origin, Vector=multiplication_3, Colour=colour_rgb_3, Width=2)
vector_display_ex_2 = VectorDisplayEx(Point=deconstruct_plane.Origin, Vector=multiplication_2, Colour=colour_rgb_5, Width=2)
vector_display_ex_3 = VectorDisplayEx(Point=deconstruct_plane.Origin, Vector=multiplication_4, Colour=colour_rgb_4, Width=2)

# ----
# make element central frame
# (for the picked geometry)
cluster = Cluster(brep=brep_5)

# ----
# make element central frame
# (for the placed geometry)
cluster_2 = Cluster(brep=brep_4)

plane = Plane(cluster)
brep_6 = Brep(brep_5)
brep_7 = Brep(brep_4)

# ----
# element pose in pick
plane_2 = Plane(simplify(plane))
brep_8 = Brep(brep_6)

# ----
# element pose in place
plane_3 = Plane(simplify(cluster_2))
brep_9 = Brep(brep_7)

# ----
# EE mesh
mesh_4 = Mesh(scale.Geometry)

brep_10 = Brep(brep_9)  # disabled
brep_11 = Brep(simplify(graft(brep_10)))  # disabled
brep_12 = Brep(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)  # disabled
brep_13 = Brep(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)  # disabled
panel_19 = Panel("    ur5_start_conf = [0,-1.65715,1.71108,-1.62348,-1.55893,2.75828]")  # disabled
group = Group(Objects=brep_11)  # disabled
number_slider_5 = Slider(25, range=0..100)  # disabled
mesh_brep = MeshBrep(
    Brep=brep_12,
    Settings={GridMaxCount=0, GridMinCount=16, JaggedSeams=False, MaxEdgeLength=0, MinEdgeLength=0.0001, MinTolerance=0, Refine=True, RefineAngle=0, RelativeTolerance=0.65, SimplePlanes=True, Tolerance=0})  # disabled
data = Data(group)  # disabled
ungroup = Ungroup(Group=data)  # -> simplify(Objects); disabled
mesh_5 = Mesh(mesh_brep)  # disabled
swatch = ColourSwatch(SwatchColor=RGBA(255, 255, 255, 42))  # disabled
preview_6 = CustomPreview(Geometry=mesh_5, Material=swatch)  # disabled
mesh_brep_2 = MeshBrep(
    Brep=ungroup,
    Settings={GridMaxCount=0, GridMinCount=16, JaggedSeams=False, MaxEdgeLength=0, MinEdgeLength=0.0001, MinTolerance=0, Refine=True, RefineAngle=0, RelativeTolerance=0.65, SimplePlanes=True, Tolerance=0})  # disabled
panel_20 = Panel("C:\Users\yijiangh\Desktop\choreo_instances")  # disabled
panel_21 = Panel("C:\Users\\parascho\Desktop\choreo_instances")  # disabled

# ----
# unit geometries in placed pose
mesh_6 = Mesh(mesh_brep_2)  # disabled

# ----
# world from pick pose
plane_4 = Plane(plane_2)  # disabled

number_slider_6 = Slider(0, range=0..50)

tree_statistics = TreeStatistics(Tree=plane_4)  # -> Paths, Length, Count; disabled
panel_22 = Panel("0")  # disabled
series_2 = Series(Start=panel_22, Step=1, Count=tree_statistics.Count)  # disabled

xy_plane = XYPlane(Origin=Point(0, 0, 0))  # disabled
panel_23 = Panel("dms_ws_tet_bars")  # disabled
boolean_toggle = BooleanToggle(True)  # disabled
generate_pkg = Button()  # disabled
panel_24 = Panel("millimeter")  # disabled
panel_25 = Panel("picknplace")  # disabled
plane_5 = Plane(flatten(plane_4))  # disabled
mesh_7 = Mesh(simplify(graft(mesh_5)))  # disabled
panel_26 = Panel("C:\Users\parascho\Desktop\choreo_instances\result")  # disabled
panel_27 = Panel("choreo_result.json")  # disabled
concatenate = Concatenate(Fragment_A=panel_26, A="\", Fragment_B=panel_27)  # disabled
text = Text(panel)  # disabled
point_7 = Point(point_4)  # disabled
trigger_planner = BooleanToggle(True)  # disabled
per_conf_step = BooleanToggle(False)  # disabled
plan_trans = BooleanToggle(True)  # disabled
sim_traj = BooleanToggle(True)  # disabled
pb_viz = BooleanToggle(True)  # disabled
robot_mdoel = ValueList({"UR3": "ur3", "UR5": "ur5"}, selected="UR3")  # disabled
panel_28 = Panel("0.1")  # disabled

number_slider_7 = Slider(4, range=2..50)
ghpython_script_3 = GhPythonScript(
    o_struct=ghpython_script.o_st,
    b_struct=ghpython_script.b_st,
    nb_rot=number_slider_7,
    nb_trans=Slider(4, range=2..50),
    flip=Toggle(True),
    offset_d1=Slider(20, range=0..100),
    offset_d2=Slider(20, range=0..100))  # -> out, planes, planes_offset, simplify(planes_out), planes_out_offset; inputs nb_rot: Int32, nb_trans: Int32, flip: Boolean
# ---------- ghpython_script_3: Python ----------
from compas_ghpython import unload_modules
import coop_assembly
unload_modules("coop_assembly")
from coop_assembly.assembly_info_generation.fabrication_planes import calculate_gripping_plane, calculate_offset, calculate_offsets_all

import Rhino.Geometry as rg
from ghpythonlib.treehelpers import list_to_tree


#from coop_assembly.assembly_info_generation.fabrication_planes import calculate_gripping_plane, calculate_offset

#seq = [v for v in b_struct.vertex]
seq = [4, 3, 5, 0, 1, 2]
print seq

for v in b_struct.vertex:
    calculate_gripping_plane(b_struct, v, b_struct.vertex[v]["mean_point"], nb_rot=nb_rot, nb_trans=nb_trans, planes_flip=flip)
    calculate_offset(o_struct, b_struct, v, offset_d1, offset_d2, seq)
    calculate_offsets_all(o_struct, b_struct, v, offset_d1, offset_d2, seq)


planes = []
for v in b_struct.vertex:
    gp = b_struct.vertex[v]["gripping_plane"]
    pl = rg.Plane(rg.Point3d(gp[0][0], gp[0][1],gp[0][2]), rg.Vector3d(gp[1][0], gp[1][1],gp[1][2]), rg.Vector3d(gp[2][0], gp[2][1],gp[2][2]))
    planes.append(pl)

planes_all = []
for i,v in enumerate(b_struct.vertex):
    gp_all = b_struct.vertex[v]["gripping_planes_all"]
    planes_all.append([])
    for gp in gp_all:
        pl = rg.Plane(rg.Point3d(gp[0][0], gp[0][1],gp[0][2]), rg.Vector3d(gp[1][0], gp[1][1],gp[1][2]), rg.Vector3d(gp[2][0], gp[2][1],gp[2][2]))
        planes_all[i].append(pl)

planes_offset = []
for v in b_struct.vertex:
    gp = b_struct.vertex[v]["gripping_plane_offset"]
    pl = rg.Plane(rg.Point3d(gp[0][0], gp[0][1],gp[0][2]), rg.Vector3d(gp[1][0], gp[1][1],gp[1][2]), rg.Vector3d(gp[2][0], gp[2][1],gp[2][2]))
    planes_offset.append(pl)

planes_offset_all = []
for i,v in enumerate(b_struct.vertex):
    gp_all = b_struct.vertex[v]["gripping_planes_offset_all"]
    planes_offset_all.append([])
    for gp in gp_all:
        pl = rg.Plane(rg.Point3d(gp[0][0], gp[0][1],gp[0][2]), rg.Vector3d(gp[1][0], gp[1][1],gp[1][2]), rg.Vector3d(gp[2][0], gp[2][1],gp[2][2]))
        planes_offset_all[i].append(pl)

planes_out = list_to_tree(planes_all)
planes_out_offset = list_to_tree(planes_offset_all)
# ---------- end ghpython_script_3 ----------
panel_29 = Panel(ghpython_script_3.out)
plane_6 = Plane(simplify(ghpython_script_3.planes_out))
list_item_6 = ListItem(List=ghpython_script_3.planes_out, Index=0, Wrap=True)

plane_7 = Plane(simplify(ghpython_script_3.planes_out_offset))
pln = Plane(ghpython_script_3.planes)
pln_2 = Plane(ghpython_script_3.planes_offset)

list_item_7 = ListItem(List=pln, Index=number_slider_2, Wrap=True)
custom_preview_4 = CustomPreview(
    Geometry=list_item_7,
    Material={diffuse=RGB(221, 160, 221), emission=RGB(66, 48, 66), shine=0.5, specular=RGB(255, 255, 255), transparency=0})

# ----
# TCP transformation
deconstruct_plane_2 = DeconstructPlane(Plane=plane_6)  # -> Origin, XAxis, YAxis, ZAxis
construct_plane = ConstructPlane(Origin=deconstruct_plane_2.Origin, XAxis=deconstruct_plane_2.YAxis, YAxis=deconstruct_plane_2.XAxis)

move_2 = Move(Geometry=construct_plane, Motion=Vector(0, 0, 10))  # -> Geometry, Transform
split_tree_3 = SplitTree(Data=move_2.Geometry, Masks=flatten(construct_path))  # -> Positive, Negative

# ----
# EE pose in place
plane_8 = Plane(split_tree_3.Positive)

# ----
# symmetric goal frames
panel_30 = Panel("2*pi")
integer = Integer(number_slider_7)
division = Division(A=panel_30, B=integer)
deconstruct_plane_3 = DeconstructPlane(Plane=plane_3)  # -> Origin, XAxis, YAxis, ZAxis
series_3 = Series(Start=0, Step=1, Count=integer)
multiplication_5 = Multiplication(A=division, B=series_3)
rotate_3d = Rotate3D(Geometry=plane_3, Angle=multiplication_5, Center=deconstruct_plane_3.Origin, Axis=deconstruct_plane_3.XAxis)  # -> simplify(Geometry), Transform

plane_9 = Plane(plane_8)
plane_10 = Plane(plane_9)
orient = Orient(Geometry=mesh_4, Source=plane_origin, Target=plane_10)  # -> Geometry, Transform

# ----
# element pose transform
# from pick to place
orient_2 = Orient(Geometry=brep_8, Source=plane_2, Target=rotate_3d.Geometry)  # -> Geometry, simplify(Transform)

plane_11 = Plane(plane_9)

# ----
# in place EE mesh viz
mesh_8 = Mesh(orient.Geometry)

# ----
# from place to pick
inverse_transform = InverseTransform(Transform=orient_2.Transform)

# ----
# rigid correspondance
transform = Transform(Geometry=plane_11, Transform=inverse_transform)
plane_12 = Plane(simplify(transform))

# ----
# flexible correspondance
unit_z = UnitZ(Factor=1)
deconstruct_plane_4 = DeconstructPlane(Plane=plane_12)  # -> Origin, XAxis, YAxis, ZAxis
negative = Negative(Value=unit_z)
construct_plane_2 = ConstructPlane(Origin=deconstruct_plane_4.Origin, XAxis=negative, YAxis=Vector(0, 1, 0))
plane_13 = Plane(construct_plane_2)

# ----
# in place EE mesh viz (flexible correspondance)
# place2pick transf
plane_14 = Plane(plane_13)
orient_3 = Orient(Source=plane_origin, Target=plane_14)  # -> Geometry, Transform
transform_2 = Transform(orient_3.Transform)
mesh_9 = Mesh(mesh_4)
transform_3 = Transform(Geometry=mesh_9, Transform=transform_2)  # -> simplify(Geometry)

mesh_10 = Mesh(transform_3)  # disabled
plane_15 = Plane(plane_13)  # disabled
mesh_11 = Mesh(mesh_8)
plane_16 = Plane(plane_15)  # disabled

# ----
# world_from_pick_grasp_poses
plane_17 = Plane(plane_16)  # disabled

deconstruct_plane_5 = DeconstructPlane(Plane=plane_17)  # -> Origin, XAxis, YAxis, ZAxis; disabled
reverse = Reverse(Vector=deconstruct_plane_5.XAxis)  # disabled

# ----
# picked EE mesh
mesh_12 = Mesh(mesh_10)

# ----
# placed EE mesh
mesh_13 = Mesh(mesh_11)

tree_statistics_2 = TreeStatistics(Tree=mesh_13)  # -> Paths, Length, Count
deconstruct_path = DeconstructPath(Branch=tree_statistics_2.Paths)  # -> simplify(Indices)
multiplication_6 = Multiplication(A=reverse, B=number_slider_5)  # disabled
list_item_8 = ListItem(List=deconstruct_path, Index=0, Wrap=True)
move_3 = Move(Geometry=plane_17, Motion=multiplication_6)  # -> Geometry, Transform; disabled
create_set = CreateSet(List=flatten(list_item_8))  # -> Set, Map
list_item_9 = ListItem(List=create_set.Set, Index=Slider(2, range=0..13), Wrap=False)
concatenate_2 = Concatenate(B="{", Fragment_A=list_item_9, A=";", Fragment_B="*", C="}")
split_tree_4 = SplitTree(Data=mesh_13, Masks=flatten(concatenate_2))  # -> Positive, Negative
split_tree_5 = SplitTree(Data=mesh_12, Masks=flatten(concatenate_2))  # -> Positive, Negative

# ----
# world from approach pose
plane_18 = Plane(move_3.Geometry)  # disabled

# ----
# symmetric
# world from place poses
plane_19 = Plane(rotate_3d.Geometry)  # disabled

list_item_10 = ListItem(List=plane_19, Index=0, Wrap=True)  # disabled

list_item_11 = ListItem(List=split_tree_4.Positive, Index=number_slider_6, Wrap=False)
list_item_12 = ListItem(List=split_tree_5.Positive, Index=number_slider_6, Wrap=False)

plane_20 = Plane(plane_19)  # disabled
ghpython_script_4 = GhPythonScript(
    element_geometries_in_place=mesh_6,
    world_from_place_poses=plane_20,
    world_from_pick_poses=plane_5,
    world_from_pick_grasp_poses=plane_17,
    world_from_approach_poses=plane_18,
    base_frame=xy_plane,
    file_path=panel_21,
    pkg_name=panel_23,
    assembly_type=panel_25,
    unit=panel_24,
    generate=generate_pkg,
    predefined_sequence=series_2,
    static_obstacle_meshes=mesh_7)  # -> out, output_file_dir; inputs virtual_joint_connected_e_ids: tree of Int32, grounded_element_ids: list of Int32, grounded_virtual_joint_ids: list of Int32, element_geometries_in_place: tree of Mesh, world_from_place_poses: tree of Plane, world_from_pick_poses: list of Plane, world_from_pick_grasp_poses: tree of Plane, world_from_approach_poses: tree of Plane, base_frame: Plane, generate: Boolean, predefined_sequence: list, static_obstacle_meshes: tree of Mesh; disabled
# ---------- ghpython_script_4: Python ----------
import sys
import copy
import os
import json
from collections import OrderedDict

import Rhino.Geometry as rg
import ghpythonlib.components as ghcomp
import ghpythonlib.treehelpers as th

from compas.datastructures import Mesh
from compas.geometry import Frame, Point
from compas.geometry import Transformation, transform_points, cross_vectors
from compas_ghpython.utilities import draw_mesh, draw_frame

from compas_ghpython.utilities import unload_modules
unload_modules('compas_fab.assembly.datastructures')

from compas_fab.assembly.datastructures import Assembly, Element, VirtualJoint, UnitGeometry, Grasp
from compas_fab.assembly.datastructures.utils import transform_cmesh, transform_cmesh_to_origin

##########################################
def tree_to_lists(input):
    """converts a depth-2 GH datatree to a list of lists
    """
    all = []
    for path in input.Paths:
        branch_list = []
        for obj in input.Branch(path):
            branch_list.append(obj)
        all.append(branch_list)
    return all

def rPt2cPt(rPt):
    """
    Convert Rhino point to compas point
    :param rPt:
    :return:
    """
    return Point(rPt.X, rPt.Y, rPt.Z)

def rPln2cFrame(rplane):
    """converts a rhino plane to compas frame
    """
    return Frame(rplane.Origin, rplane.XAxis, rplane.YAxis)

def rMesh2cMesh(rg_mesh):
    if type(rg_mesh) == rg.Mesh:
        #single mesh
        compas_mesh_vertices = rg_mesh.Vertices.ToPoint3dArray()
        compas_mesh_faces = rg_mesh.Faces.ToIntArray(True)
        compas_mesh_faces = [compas_mesh_faces[i:i + 3] for i in range(0, len(compas_mesh_faces), 3)]
        return Mesh.from_vertices_and_faces(compas_mesh_vertices, compas_mesh_faces)
    else:
        #array of meshes
        meshes = []
        for m in rg_mesh:
            compas_mesh_vertices = m.Vertices.ToPoint3dArray()
            compas_mesh_faces = m.Faces.ToIntArray(True)
            compas_mesh_faces = [compas_mesh_faces[i:i + 3] for i in range(0, len(compas_mesh_faces), 3)]
            meshes.append( Mesh.from_vertices_and_faces(compas_mesh_vertices, compas_mesh_faces) )
        return meshes


def draw_assembly_object_cmeshes(asm, e_id, stage='place'):
    """
    Parameters:
        stage: flag for 'place', 'pick'
    """
    if stage == 'place':
        return [draw_mesh(*cm.to_vertices_and_faces()) for cm in asm.element_geometry_in_place_pose(e_id)]
    elif 'pick':
        return [draw_mesh(*cm.to_vertices_and_faces()) for cm in asm.element_geometry_in_pick_pose(e_id)]
    else:
        return None

##########################################
# main

# TODO: convert tree of e_ids into virtual joints

if generate:
    asm = Assembly()
    
    # create assembly objects
    e_geos = tree_to_lists(element_geometries_in_place)
    vj_e_ids = tree_to_lists(virtual_joint_connected_e_ids)
    world_from_place_pose_lists = tree_to_lists(world_from_place_poses)
    grasp_pose_lists = tree_to_lists(world_from_pick_grasp_poses)
    approach_pose_lists = tree_to_lists(world_from_approach_poses)
    static_obs_lists = tree_to_lists(static_obstacle_meshes)
    
#    print(e_geos)
    
    for id, rm_list in enumerate(e_geos):
        is_grounded = id in grounded_element_ids
        e = Element(id, is_grounded=is_grounded)
        world_from_place_frames = [rPln2cFrame(gp) for gp in world_from_place_pose_lists[id]]
        world_from_pick_frame = rPln2cFrame(world_from_pick_poses[id])
        print('{}, {}'.format(id, len(grasp_pose_lists[id])))
        
        grasp_frames = [rPln2cFrame(gpose) for gpose in grasp_pose_lists[id]]
        approach_frames = [rPln2cFrame(apppose) for apppose in approach_pose_lists[id]]
        
        grasps = []
        grasp_id_cnt = 0
        for world_from_grasp, world_from_approach in zip(grasp_frames, approach_frames):
            grasps.append(Grasp.from_frames(id, grasp_id_cnt, world_from_pick_frame, world_from_grasp, world_from_approach))
            grasp_id_cnt += 1
        
        cmesh_list = [transform_cmesh_to_origin(rMesh2cMesh(rm), world_from_place_frames[0]) for rm in rm_list]
        unit_geo = UnitGeometry(name='element_'+str(id), mesh=cmesh_list, 
            initial_frame=world_from_pick_frame, goal_frames=world_from_place_frames, grasps=grasps)
        
        asm.add_element(e, unit_geo)
    
    for id, c_e_ids in enumerate(vj_e_ids):
        is_grounded = id in grounded_virtual_joint_ids
        asm.add_virtual_joint(VirtualJoint(id, connected_element_ids=c_e_ids, 
            is_grounded=is_grounded))
    
    so_unit_geos = []
    for so_id, s_list in enumerate(static_obs_lists):
        so_unit_geos.append(UnitGeometry(name='static_obstacle_'+str(so_id), mesh=[rMesh2cMesh(so) for so in s_list]))
        
    asm.static_obstacle_geometries = so_unit_geos

    asm.to_package(file_path, pkg_name, assembly_type, model_type, unit, predefined_sequence)
    

output_file_dir = str(os.path.join(file_path, pkg_name))
# ---------- end ghpython_script_4 ----------
data_dam = DataDam(DataDataA=ghpython_script_4.output_file_dir, BufferDelay=10000000, BufferMode=0)  # disabled
panel_31 = Panel(data_dam)  # disabled
ghpython_script_5 = GhPythonScript(
    pkg_path=data_dam,
    python_path=text,
    run_planner=trigger_planner,
    result_save_path=concatenate,
    TCP_translation=point_7,
    enable_pybullet_viewer=pb_viz,
    plan_transit=plan_trans,
    jt_resolution=panel_28,
    sim_traj=sim_traj,
    per_conf_step=per_conf_step,
    robot_model=robot_mdoel)  # -> out, plan_result; inputs run_planner: Boolean, TCP_translation: Point3d, enable_pybullet_viewer: Boolean, plan_transit: Boolean, sim_traj: Boolean, per_conf_step: Boolean; disabled
# ---------- ghpython_script_5: Python ----------
import sys
import copy
import os
import json

#import Rhino.Geometry as rg
#import ghpythonlib.components as ghcomp
#import ghpythonlib.treehelpers as th
import System
from Grasshopper import DataTree as datatree
from Grasshopper.Kernel.Data import GH_Path as ghpath

from compas.utilities.xfunc import XFunc

assembly_json_path = os.path.join(pkg_path, 'json', pkg_path.split(os.sep)[-1] + '.json')
print(assembly_json_path)
assert os.path.exists(assembly_json_path)

tcp_trans_list = [TCP_translation.X, TCP_translation.Y, TCP_translation.Z]

traj_dict = {}
if run_planner:
    xfunc = XFunc(
            'coop_assembly.choreo_interface.choreo_call.sequenced_picknplace_plan', python=python_path)
    xfunc(assembly_json_path, scale=0.001, result_save_path=result_save_path,
         enable_viewer=enable_pybullet_viewer, 
         plan_transit=plan_transit, transit_res=jt_resolution,
         view_ikfast=False, cart_ts=0.1, trans_ts=0.01, per_conf_step=per_conf_step, robot_model=robot_model)
    print('main_gh_simple: xfnc error: ', xfunc.error)
    traj_dict = xfunc.data

if not run_planner and os.path.exists(result_save_path):
    with open(result_save_path, 'r') as f:
        traj_dict = json.loads(f.read())

# putting traj dict into a tree data
if traj_dict:
    plan_res_tree = datatree[System.Object]()
    for seq_id, unit_pnp in enumerate(traj_dict):
        for i, traj_pt in enumerate(unit_pnp['place2pick']['points']):
                for jt_val in traj_pt['values']:
                    plan_res_tree.Add(jt_val, ghpath(seq_id, 0, i))
        
        for i, traj_pt in enumerate(unit_pnp['pick_approach']['points']):
                for jt_val in traj_pt['values']:
                    plan_res_tree.Add(jt_val, ghpath(seq_id, 1, i))
                    
        for i, traj_pt in enumerate(unit_pnp['pick_retreat']['points']):
                for jt_val in traj_pt['values']:
                    plan_res_tree.Add(jt_val, ghpath(seq_id, 2, i))
                    
        for i, traj_pt in enumerate(unit_pnp['pick2place']['points']):
                for jt_val in traj_pt['values']:
                    plan_res_tree.Add(jt_val, ghpath(seq_id, 3, i))
    
        for i, traj_pt in enumerate(unit_pnp['place_approach']['points']):
                for jt_val in traj_pt['values']:
                    plan_res_tree.Add(jt_val, ghpath(seq_id, 4, i))
                    
        for i, traj_pt in enumerate(unit_pnp['place_retreat']['points']):
                for jt_val in traj_pt['values']:
                    plan_res_tree.Add(jt_val, ghpath(seq_id, 5, i))
        
        if seq_id == len(traj_dict) - 1:
            for i, traj_pt in enumerate(unit_pnp['return2idle']['points']):
                    for jt_val in traj_pt['values']:
                        plan_res_tree.Add(jt_val, ghpath(seq_id + 1, 0, i))
                        
    plan_result = plan_res_tree
# ---------- end ghpython_script_5 ----------
panel_32 = Panel(ghpython_script_5.out)  # disabled
panel_33 = Panel(ghpython_script_5.plan_result)  # disabled

# ==== cluster Send
script = ClusterInput()
send = ClusterInput()
send_2 = PythonScript(script=script, send=send)  # -> out
# ---------- send_2: Python ----------
import socket
from scriptcontext import sticky as st

ur_ip2 = st["ur_ip1"]
ur_port = 30002

if send:
    s = socket.create_connection((ur_ip2, ur_port), timeout=0.5) 
    s.send(script)
    s.close()
# ---------- end send_2 ----------
out = ClusterOutput(send_2)

# ==== cluster Draw
frame = ClusterInput()
size = ClusterInput()
draw = PythonScript(frame=frame, size=size)  # -> G, C
# ---------- draw: Python ----------
import Rhino.Geometry as rg
from System.Drawing import Color

if not size:
    size = 100

if frame:
    
    plane = rg.Plane(rg.Point3d(*list(frame.point)), rg.Vector3d(*list(frame.xaxis)), rg.Vector3d(*list(frame.yaxis)))

    G = []
    G.append(rg.Line(plane.Origin, size * plane.XAxis))
    G.append(rg.Line(plane.Origin, size * plane.YAxis))
    G.append(rg.Line(plane.Origin, size * plane.ZAxis))
    
    C = []
    C.append(Color.FromArgb(255, 0, 0))
    C.append(Color.FromArgb(0, 255, 0))
    C.append(Color.FromArgb(0, 0, 255))
# ---------- end draw ----------
G = ClusterOutput(draw.G)
C = ClusterOutput(draw.C)

# ==== cluster Tools

# ---- group: arch_2019july_tool3A
geo = Geometry([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])
mesh = Mesh(geo)
brep = Brep(geo)
mjoin = MeshJoin(Meshes=mesh)
xaxis_line = Curve(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)
yaxis_line = Curve(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)
tool = PythonScript(meshes=mjoin, breps=brep, xline=xaxis_line, yline=yaxis_line)  # -> tool; inputs meshes: list of Mesh, breps: list of Brep
# ---------- tool: Python ----------
import Rhino.Geometry as rg
from compas.geometry import Frame
from ur_online_control.ur.tool import Tool
from compas.datastructures import Mesh
from compas_rhino.helpers import mesh_from_guid

xaxis = rg.Line(xline.PointAtStart, xline.PointAtEnd)
yaxis = rg.Line(yline.PointAtStart, yline.PointAtEnd)

if xaxis.From.DistanceTo(yaxis.From) < 0.01:
    origin = xaxis.From
    xaxis = xaxis.Direction
    yaxis = yaxis.Direction
elif xaxis.To.DistanceTo(yaxis.To) < 0.01:
    origin = xaxis.To
    xaxis = -xaxis.Direction
    yaxis = -yaxis.Direction
elif xaxis.From.DistanceTo(yaxis.To) < 0.01:
    origin = xaxis.From
    xaxis = xaxis.Direction
    yaxis = -yaxis.Direction
elif xaxis.To.DistanceTo(yaxis.From) < 0.01:
    origin = xaxis.To
    xaxis = -xaxis.Direction
    yaxis = yaxis.Direction

xaxis.Unitize()
yaxis.Unitize()

print origin
print xaxis
print yaxis

tcp_frame = Frame(origin, xaxis, yaxis)

tool = Tool(tcp_frame)
tool.model = [mesh_from_guid(Mesh, mesh) for mesh in meshes]
#tool.model_xyz = tool.model.xyz
tool.breps = breps
# ---------- end tool ----------

# ---- group: arch_2019july_tool3B
geo_2 = Geometry([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])
mesh_2 = Mesh(geo_2)
brep_2 = Brep(geo_2)
mjoin_2 = MeshJoin(Meshes=mesh_2)
xaxis_line_2 = Curve(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)
yaxis_line_2 = Curve(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)
tool_2 = PythonScript(meshes=mjoin_2, breps=brep_2, xline=xaxis_line_2, yline=yaxis_line_2)  # -> tool; inputs meshes: list of Mesh, breps: list of Brep; same code as tool

# ---- group: sand deposition tool
geo_3 = Geometry([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])
mesh_3 = Mesh(geo_3)
brep_3 = Brep(geo_3)
mjoin_3 = MeshJoin(Meshes=mesh_3)
yaxis_line_3 = Curve(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)
xaxis_line_3 = Curve(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)
tool_3 = PythonScript(meshes=mjoin_3, breps=brep_3, xline=xaxis_line_3, yline=yaxis_line_3)  # -> tool; inputs meshes: list of Mesh, breps: list of Brep; same code as tool

# ---- group: earth deposition tool
geo_4 = Geometry([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])
brep_4 = Brep(geo_4)
mesh_4 = Mesh(geo_4)
mjoin_4 = MeshJoin(Meshes=mesh_4)
yaxis_line_4 = Curve(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)
xaxis_line_4 = Curve(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)
tool_4 = PythonScript(meshes=mjoin_4, breps=brep_4, xline=xaxis_line_4, yline=yaxis_line_4)  # -> tool; inputs meshes: list of Mesh, breps: list of Brep; same code as tool

# ---- group: vault_test2_A
geo_5 = Geometry([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])
mesh_5 = Mesh(geo_5)
brep_5 = Brep(geo_5)
mjoin_5 = MeshJoin(Meshes=mesh_5)
xaxis_line_5 = Curve(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)
yaxis_line_5 = Curve(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)
tool_5 = PythonScript(meshes=mjoin_5, breps=brep_5, xline=xaxis_line_5, yline=yaxis_line_5)  # -> tool; inputs meshes: list of Mesh, breps: list of Brep; same code as tool

# ---- group: vault_test2_B
geo_6 = Geometry([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])
mesh_6 = Mesh(geo_6)
brep_6 = Brep(geo_6)
mjoin_6 = MeshJoin(Meshes=mesh_6)
xaxis_line_6 = Curve(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)
yaxis_line_6 = Curve(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)
tool_6 = PythonScript(meshes=mjoin_6, breps=brep_6, xline=xaxis_line_6, yline=yaxis_line_6)  # -> tool; inputs meshes: list of Mesh, breps: list of Brep; same code as tool

# ---- group: clay subtraction tool
geo_7 = Geometry([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])
brep_7 = Brep(geo_7)
mesh_7 = Mesh(geo_7)
mjoin_7 = MeshJoin(Meshes=mesh_7)
xaxis_line_7 = Curve(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)
yaxis_line_7 = Curve(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)
tool_7 = PythonScript(meshes=mjoin_7, breps=brep_7, xline=xaxis_line_7, yline=yaxis_line_7)  # -> tool; inputs meshes: list of Mesh, breps: list of Brep; same code as tool

# ---- group: pack tool
geo_8 = Geometry([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])
mesh_8 = Mesh(geo_8)
brep_8 = Brep(geo_8)
mjoin_8 = MeshJoin(Meshes=mesh_8)
yaxis_line_8 = Curve(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)
xaxis_line_8 = Curve(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)
tool_8 = PythonScript(meshes=mjoin_8, breps=brep_8, xline=xaxis_line_8, yline=yaxis_line_8)  # -> tool; inputs meshes: list of Mesh, breps: list of Brep; same code as tool

# ---- group: vault_test2_Measure
geo_9 = Geometry([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])
brep_9 = Brep(geo_9)
mesh_9 = Mesh(geo_9)
mjoin_9 = MeshJoin(Meshes=mesh_9)
xaxis_line_9 = Curve(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)
yaxis_line_9 = Curve(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)
tool_9 = PythonScript(meshes=mjoin_9, breps=brep_9, xline=xaxis_line_6, yline=yaxis_line_6)  # -> tool; inputs meshes: list of Mesh, breps: list of Brep; same code as tool

# ----
tool_id = ClusterInput()
tool_id_2 = Integer(tool_id)

# ---- group: measurement tool
geo_10 = Geometry([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])
mesh_10 = Mesh(geo_10)
mjoin_10 = MeshJoin(Meshes=mesh_10)

# ----
brep_10 = Brep(geo_10)

# ---- group: measurement tool (continued)
tool_10 = PythonScript(meshes=mjoin_10, brep=brep_10)  # -> tool; inputs meshes: list, brep: list
# ---------- tool_10: Python ----------
from ur_online_control.ur.tools import MeasurementTool
from compas.datastructures import Mesh
from compas_rhino.helpers import mesh_from_guid


tool = MeasurementTool()
tool.model = [mesh_from_guid(Mesh, mesh) for mesh in meshes]
#tool.model_xyz = tool.model.xyz
tool.brep = brep
# ---------- end tool_10 ----------

# ----
filter = StreamFilter(
    Gate=tool_id_2,
    Stream1=tool_10,
    Stream2=tool_3,
    Stream3=tool_4,
    Stream4=tool_7,
    Stream5=tool_8,
    Stream6=tool,
    Stream7=tool_2,
    Stream8=tool_5,
    Stream9=tool_6,
    Stream10=tool_9)
filter_2 = StreamFilter(
    Gate=tool_id_2,
    Stream1=mesh_10,
    Stream2=mesh_3,
    Stream3=mesh_4,
    Stream4=mesh_7,
    Stream5=mesh_8,
    Stream6=mesh,
    Stream7=mesh_2,
    Stream8=mesh_5,
    Stream9=mesh_6,
    Stream10=mesh_9)
py = PythonScript(tool=filter)  # -> tcp_frame, model
# ---------- py: Python ----------
from compas_ghpython import mesh_draw 

if tool:
    tcp_frame = tool.tcp_frame
    model = map(mesh_draw, tool.model)
# ---------- end py ----------
tool_11 = Data(filter)
draw = PythonScript(frame=py.tcp_frame)  # -> G, C
# ---------- draw: Python ----------
import Rhino.Geometry as rg
from System.Drawing import Color

if not size:
    size = 100

if frame:
    plane = rg.Plane(rg.Point3d(*list(frame.point)), rg.Vector3d(*list(frame.xaxis)), rg.Vector3d(*list(frame.yaxis)))

    G = []
    G.append(rg.Line(plane.Origin, size * plane.XAxis))
    G.append(rg.Line(plane.Origin, size * plane.YAxis))
    G.append(rg.Line(plane.Origin, size * plane.ZAxis))
    
    C = []
    C.append(Color.FromArgb(255, 0, 0))
    C.append(Color.FromArgb(0, 255, 0))
    C.append(Color.FromArgb(0, 0, 255))
# ---------- end draw ----------
tool_12 = ClusterOutput(tool_11)
s_8 = ClusterOutput(filter_2)
preview = CustomPreview(Geometry=py.model, Shader=ColourSwatch(SwatchColor=RGBA(141, 170, 178, 150)))
preview_2 = CustomPreview(Geometry=draw.G, Shader=draw.C)

# ==== cluster Cluster
brep = ClusterInput()
brep_2 = Brep(brep)
deconstruct_brep = DeconstructBrep(Brep=brep_2)  # -> Faces, Edges, Vertices
volume = Volume(Geometry=brep_2)  # -> Volume, Centroid
list_item = ListItem(List=deconstruct_brep.Faces, Index=0, Wrap=True)
point = Point(volume.Centroid)
area = Area(Geometry=list_item)  # -> Area, Centroid
point_2 = Point(area.Centroid)
vector_2pt = Vector2Pt(PointA=point, PointB=point_2, Unitize=False)  # -> Vector, Length
plane_normal = PlaneNormal(Origin=point, ZAxis=vector_2pt.Vector)
deconstruct_plane = DeconstructPlane(Plane=plane_normal)  # -> Origin, XAxis, YAxis, ZAxis
construct_plane = ConstructPlane(Origin=deconstruct_plane.Origin, XAxis=deconstruct_plane.ZAxis, YAxis=deconstruct_plane.XAxis)
plane = ClusterOutput(construct_plane)
