# Grasshopper definition robarch_assembly_YJ.gh (Grasshopper 1.0.7)

# ----
# Yijiang's 12 bar feasible design
point = Point([Point(200.0999806, -36.03747471, 48.28341594), Point(353.0353916, -18.67770667, 48.28341594), Point(261.1829916, 100.9620354, 48.28341594), Point(253.6286279, -26.40318888, 117.6169489), Point(253.7142349, 61.57939256, 131.9623201), Point(311.6618785, 43.28816029, 108.9936051)])

# ----
# YJ's teaching design
point_2 = Point([<point referenced from the Rhino model> x7])

# ----
# YJ's simple 3 bar
point_3 = Point([Point(280.2906275, -12.24255157, 136.472037), Point(216.2004131, -60.84433544, 48.28341594), Point(288.0668457, 71.76692778, 48.28341594), Point(366.2004131, -60.84433544, 48.28341594)])

# ----
# Robot Model
value_list = ValueList({"UR5": 0, "UR3 \"Left": 1, "UR3 \"Right": 2}, selected="UR5")

# ----
# POINTS!
point_4 = Point(point_3)

# ----
# Setting Up
# Path Planner
# Result Saving Path
panel = Panel("C:\Users\yijiangh\Desktop\choreo_results")

# ----
# TCP Calibration Point
point_5 = Point(Point(0.09607309103, 2.793967724e-09, 0))

# ----
# Gripper Model
mesh = Mesh(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)

# ----
# --> Set your IP address
# --> Set robot IP address
server_address = ValueList({"192.168.10.1", "192.168.10.2", "192.168.10.3", "192.168.10.20", "127.0.0.1"}, selected="192.168.10.2")
ur_ip1 = ValueList({"192.168.10.10", "192.168.10.11", "192.168.10.12", "127.0.0.1"}, selected="192.168.10.10")
server_port = Integer(30003)
globals = PythonScript(server_address=server_address, server_port=server_port, ur_ip1=ur_ip1)  # inputs server_port: Int32
# ---------- globals: Python ----------
from scriptcontext import sticky as st

st["server_address"] = server_address
st["server_port"] = server_port

st["ur_ip1"] = ur_ip1
print st["ur_ip1"]
# ---------- end globals ----------

# ----
# Select Bar Number
number_slider = Slider(2, range=0..50)
viz_slider = Slider(0, range=0..115)

# ----
# Commands
pickup = BooleanToggle(False)
placement = BooleanToggle(False)
# Visualizing Code
retreat = BooleanToggle(True)

read = Button()

# ----
# Start or Stop Code
send = Button()

# ----
# Check if UR is available
ping = Button()
py = PythonScript(ip=ur_ip1, ping=ping)  # -> out, trigger
# ---------- py: Python ----------
from scriptcontext import sticky as st
from ur_online_control.communication import is_available

#print ip
guid = str(ghenv.Component.InstanceGuid)
txt_key = "txt_" + guid
if txt_key not in st:
    st[txt_key] = ""

if ping:
    
    available = is_available(ip)
    
    if available:
        st[txt_key] = "%s is up!" % ip
        trigger = True
    else:
        st[txt_key] = "%s is down!" % ip
        trigger = False

print st[txt_key]
# ---------- end py ----------
panel_2 = Panel(py.out)

stop = Button()
stop_2 = PythonScript(stop=stop)
# ---------- stop_2: Python ----------
from scriptcontext import sticky as st
from ur_online_control.ur_direct import stop as stop_robot

ur_ip1 = st["ur_ip1"]

if stop:
    stop_robot(ur_ip1)
# ---------- end stop_2 ----------

deconstruct = Deconstruct(Point=point_5)  # -> XComponent, YComponent, ZComponent

bang = Button()
panel_3 = Panel("Unload libraries")
unload = PythonScript(bang=bang)
# ---------- unload: Python ----------
from compas_ghpython import unload_modules

unload_modules("compas")
unload_modules("ur_online_control")
unload_modules("ffw_2018")
# ---------- end unload ----------

panel_4 = Panel("""ur5
ur3
ur3""")

# ----
# Settings
list = ValueList({"gripper": 0, "measurement_tool": 1}, selected="gripper")
list_2 = ValueList({"robot 1": "robot_1", "robot 2": "robot_2", "robot 3": "robot_3", "archTest_robot_2", "robot_1/2", "robot_2/2", "robot_1/2_adjust", "robot_2/2_adjust"}, selected="robot 1")
tools = Tools(tool_id=list)  # -> tool_4, s_0
base = PythonScript(rnum=list_2)  # -> base_frame
# ---------- base: Python ----------
from compas.geometry import Frame
#from compas.geometry import Transformation, Rotation
#from compas_ghpython import xdraw_frame
#import math
#import Rhino.Geometry as rg




# for robots 1 and 2


if rnum == "robot_1":
    origin = [0.0, 0.0, 0.0]
    xaxis = [-0.5, 0.0, 0.0]
    yaxis = [0.0, -0.5, 0.0]

#if rnum == "robot_1":
#    origin = [-468.74, -100.60, 161.23]
#    xaxis = [0.71376, 0.70037, 0.00520]
#    yaxis = [-0.70037, 0.71364, 0.01408]
#    

if rnum == "robot_2":
    origin = [-468.74, -100.60, 161.23]
    xaxis = [0.71376, 0.70037, 0.00520]
    yaxis = [-0.70037, 0.71364, 0.01408]


if rnum == "robot_3":
    origin = [-110.14, 465.76, 167.41]
    xaxis = [0.71228, -0.70189, -0.00042]
    yaxis = [0.70182, 0.71220, 0.01506]

if rnum == "archTest_robot_2":
    origin = [0.0, -863.6, 0.0]
#    origin = [863.6, 0.0, 0.0]
#    xaxis = [-0.5, 0, 0]
#    yaxis = [0, -0.5, 0]
    xaxis = [0.0, 0.5, 0.0]
    yaxis = [-0.5, 0.0, 0.0]
#    

if rnum == "robot_1/2":
    origin = [0.94, -433.95, 21.84]
    xaxis = [-0.01817, -0.99982, 0.00520]
    yaxis = [0.99980, -0.01813, 0.00837]

if rnum == "robot_2/2":
    origin = [-4.67, -430.58, 20.93]
    xaxis = [0.01186, 0.99984, -0.01342]
    yaxis = [-0.99993, 0.01186, -0.00009]

if rnum == "robot_1/2_adjust":
    # 18.4+9.057 = 27.457
    origin = [3.0, -431.8, 26]
    xaxis = [0.0, -1.0, 0.0]
    yaxis = [1.0, 0.0, 0.0]
#    
#===========further away
#if rnum == "robot_1/2_adjust":
#    # 18.4+9.057 = 27.457
#    origin = [1.0, -445, 26]
#    xaxis = [0.0, -1.0, 0.0]
#    yaxis = [1.0, 0.0, 0.0]

if rnum == "robot_2/2_adjust":
    origin = [0.0, -431.8, 27.457]
    xaxis = [0.0, 1.0, 0.0]
    yaxis = [-1.0, 0.0, 0.0]

base_frame = Frame(list(origin), list(xaxis), list(yaxis))
print base_frame
# ---------- end base ----------

list_item = ListItem(List=panel_4, Index=value_list, Wrap=True)

# ---- group: Robot1
# 1. load robot model
# 2. set tool
# 3. set basis
text = Text(list_item)
robot = PythonScript(model=text)  # -> robot1
# ---------- robot: Python ----------
from ur_online_control.ur.ur10 import UR10
from ur_online_control.ur.ur5 import UR5
from ur_online_control.ur.ur3 import UR3
from scriptcontext import sticky as st

if model == "ur5":
    robot1 = UR5()
    print 'yes'
elif model == "ur10":
    robot1 = UR10()
elif model == "ur3":
    robot1 = UR3()
# ---------- end robot ----------
set_params = PythonScript(robot1=robot, tool=tools.tool_4, base_frame=base)  # -> robot1
# ---------- set_params: Python ----------
from ur_online_control.ur.ur10 import UR10
from ur_online_control.ur.ur5 import UR5
from scriptcontext import sticky as st
from ur_online_control.ur.tool import Tool
from compas.geometry import Frame


if tool:
    robot1.set_tool(tool)
else:
    robot1.set_tool(Tool(Frame.worldXY()))  
if base_frame:
    robot1.set_base(base_frame)

st["robot1"] = robot1
# ---------- end set_params ----------

# ----
# Running Code
panel_5 = Panel(text)
text_2 = Text()

# ----
# Shortest Distance
# Method
ghpython_script = GhPythonScript(full_points_list=point_4)  # -> out, tet_node_id; inputs full_points_list: list of Point3d
# ---------- ghpython_script: Python ----------
import System
import Grasshopper.Kernel.Data.GH_Path as ghpath
import Grasshopper.DataTree as datatree

from compas.geometry import distance_point_point

tet_node_id = datatree[System.Object]()
for i, p in enumerate(full_points_list):
    if i > 2:
        nodes       = full_points_list[0:i]
        dists       = [distance_point_point(full_points_list[i], n) for n in nodes]
        nodes_inds  = [j for y,j in sorted(zip(dists,range(0,i)))] 
        nodes_fin = nodes_inds[0:3]
        
        for fin in nodes_fin: tet_node_id.Add(fin, ghpath(i))
# ---------- end ghpython_script ----------
integer = Integer(ghpython_script.tet_node_id)

boolean_toggle = BooleanToggle(True)

# ----
# UR3 left
point_6 = Point(Point(211.4761447, -333.6922373, 70.81129071))

# ----
# UR3 right
point_7 = Point(Point(192.9262157, 310.002335, 72.25714645))

get = Button()
pose = PythonScript(get=get)  # -> pose_cartesian
# ---------- pose: Python ----------
from scriptcontext import sticky as st
from ur_online_control.ur_direct import get_current_pose_cartesian

server_address = st["server_address"]
server_port = 30005
ur_ip1 = st["ur_ip1"]
robot1 = st["robot1"]
tool_angle_axis = list(robot1.tool.tcp_frame.point) + robot1.tool.tcp_frame.axis_angle_vector
print tool_angle_axis

guid = str(ghenv.Component.InstanceGuid)
pose_cartesian_key = "pose_cartesian" + guid


if get:
    st[pose_cartesian_key] = get_current_pose_cartesian(server_address, server_port, ur_ip1, tool_angle_axis)

if pose_cartesian_key not in st:
    pose_cartesian = []
else:
    pose_cartesian = st[pose_cartesian_key]
# ---------- end pose ----------
# Getting Data from Robot
panel_6 = Panel("get pose cartesian")
py_2 = PythonScript(pose_cartesian=pose)  # -> frame_WCS; inputs pose_cartesian: list
# ---------- py_2: Python ----------
import Rhino.Geometry as rg
from scriptcontext import sticky as st
from compas.geometry import Frame
from compas.geometry.xforms import Transformation

robot1 = st["robot1"]

print pose_cartesian
if pose_cartesian:
    #frame_RCS = Frame.from_pose_axis_angle_vector(pose_cartesian)
    frame_RCS = Frame.from_axis_angle_vector(axis_angle_vector=pose_cartesian[3:], point=pose_cartesian[:3])
    frame_WCS = robot1.get_frame_in_WCS(frame_RCS)
    
    print frame_RCS
# ---------- end py_2 ----------
panel_7 = Panel(pose)
draw = Draw(frame=py_2)  # -> G, C
preview = CustomPreview(Geometry=draw.G, Shader=draw.C)

panel_8 = Panel("get pose joint")
get_2 = Button()
pose_2 = PythonScript(get=get_2, get_init=py.trigger)  # -> pose_joints
# ---------- pose_2: Python ----------
from scriptcontext import sticky as st
from ur_online_control.ur_direct import get_current_pose_joints
from compas_fab.robots import Configuration

server_address = st["server_address"]
server_port = 30005
ur_ip1 = st["ur_ip1"]
robot1 = st["robot1"]
tool_angle_axis = list(robot1.tool.tcp_frame.point) + robot1.tool.tcp_frame.axis_angle_vector
print tool_angle_axis

guid = str(ghenv.Component.InstanceGuid)
pose_joints_key = "pose_joints" + guid


if get or get_init:
    st[pose_joints_key] = get_current_pose_joints(server_address, server_port, ur_ip1, tool_angle_axis)
    
if pose_joints_key not in st:
    pose_joints = Configuration.from_revolute_values([0,0,0,0,0,0])
else:
    pose_joints = Configuration.from_revolute_values(st[pose_joints_key])

print pose_joints
# ---------- end pose_2 ----------
panel_9 = Panel(pose_2)

ideal_radius = Slider(3.18, range=0..50)

# ----
# Bar Radius
ideal_radius_2 = Slider(3.81, range=0..50)
shrinked_radius = Slider(2, range=0..10)

ghpython_script_2 = PythonScript(points=point_4, tet_point_ids=integer, r=ideal_radius_2, run=Toggle(True), use_rpc=Toggle(True), python_path=text_2)  # -> out, pts_netw, lns_netw, pts_inv, lns_inv, o_st, b_st; inputs points: list of Point3d, tet_point_ids: tree of Int32, use_rpc: Boolean
# ---------- ghpython_script_2: Python ----------
import System
import Grasshopper.Kernel.Data.GH_Path as ghpath
import Grasshopper.DataTree as datatree
from ghpythonlib.treehelpers import tree_to_list

from compas_ghpython import unload_modules
unload_modules("coop_assembly")

if use_rpc:
    from compas.rpc import Proxy
    geo_gen_execute = Proxy('coop_assembly.geometry_generation.execute', python=python_path, url='http://127.0.0.1')

from compas.geometry import distance_point_point
from compas_ghpython.utilities import draw_network
from compas.datastructures.network import Network
from coop_assembly.geometry_generation.main import main_gh_simple
from coop_assembly.help_functions.drawing import draw_network_inv_gh

dict_nodes = {}
tet_point_lists = tree_to_list(tet_point_ids, lambda x: x)
for i, tet_ids in enumerate(tet_point_lists):
    if tet_ids : dict_nodes[str(i)] = tet_ids
print(dict_nodes)

points = [(p[0], p[1], p[2]) for p in points]

if run:
    print("about to run in ghpython")
    if not use_rpc:
        # xfunc call
        b_st_data, o_st_data = main_gh_simple(points, dict_nodes, r, correct=False)
    else:
        b_st_data, o_st_data = geo_gen_execute.execute_from_points(
            points, dict_nodes, r, correct=False)
    
    o_st = Network.from_data(o_st_data)
    b_st = Network.from_data(b_st_data)
    o_st.struct_bar = b_st
    
    pts_new, lns_netw = draw_network(o_st)
    pts_inv, lns_inv, lns_conn  = draw_network_inv_gh(b_st)
# ---------- end ghpython_script_2 ----------

# ----
# Bar Extension
number_slider_2 = Slider(5, range=0..30)

number = Slider(0, range=0..10)
panel_10 = Panel("set digital out")
value = BooleanToggle(False)
digital_out = PythonScript(number=number, value=value)  # -> script; inputs number: Int32, value: Boolean
# ---------- digital_out: Python ----------
script = "def prog():\n"
script += "\ttextmsg(\">> program start\")\n"
script += "\tset_digital_out(%i, %s)\n" % (int(number), str(value))
script += "\ttextmsg(\"<< program end\")\n"
script += "end\n"
script += "prog()\n\n"

print script
# ---------- end digital_out ----------
send_2 = Button()
send_3 = Send(script=digital_out, send=send_2)
panel_11 = Panel(send_3)

# ----
# Bar Visualization
# and Planning
subtraction = Subtraction(A=ideal_radius_2, B=shrinked_radius)
bar_picker = Slider(0, range=0..20)
extend_curve = ExtendCurve(Curve=ghpython_script_2.lns_inv, Type=0, Start=number_slider_2, End=number_slider_2)
pipe = Pipe(Curve=extend_curve, Radius=ideal_radius_2, Caps=0)  # -> flatten(Pipe)
pipe_2 = Pipe(Curve=extend_curve, Radius=subtraction, Caps=0)  # -> flatten(Pipe)
colour_swatch = ColourSwatch(SwatchColor=RGBA(99, 247, 237, 168))
panel_12 = Panel(ghpython_script_2.out)
colour_swatch_2 = ColourSwatch(SwatchColor=RGBA(255, 0, 0, 168))
brep = Brep(pipe)
list_item_2 = ListItem(List=brep, Index=bar_picker, Wrap=False)
custom_preview = CustomPreview(Geometry=brep, Shader=colour_swatch)
custom_preview_2 = CustomPreview(Geometry=list_item_2, Shader=colour_swatch_2)

# ---- group: Visualise / robot model brep
py_3 = PythonScript(model=text)  # -> n
# ---------- py_3: Python ----------
if model == "ur5":
    n = 0
if model == "ur10":
    n = 1
if model == "ur3":
    n = 2


#n = 2 
print n
# ---------- end py_3 ----------
ur5_brep = UR5Brep([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])
ur10_brep = UR10Brep([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])
ur10_brep_2 = UR10Brep([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])
show_brep = BooleanToggle(False)
filter = StreamFilter(Gate=py_3, Stream0=ur5_brep, Stream1=ur10_brep_2, Stream2=ur10_brep)

# ----
# Plane Planning
customized_sequence = Panel("""3
4
5
8
6
7
9
10
11
12
13
14""")
integer_2 = Integer()
ghpython_script_3 = GhPythonScript(
    o_struct=ghpython_script_2.o_st,
    b_struct=ghpython_script_2.b_st,
    nb_rot=Slider(4, range=2..50),
    nb_trans=Slider(4, range=2..50),
    flip=Toggle(False),
    offset_d1=Slider(20, range=0..100),
    offset_d2=Slider(20, range=0..100),
    customized_seq=integer_2)  # -> out, planes, planes_offset, simplify(planes_out), planes_out_offset, sequeneced_element_ids; inputs nb_rot: Int32, nb_trans: Int32, flip: Boolean, customized_seq: list of Int32
# ---------- ghpython_script_3: Python ----------
from compas_ghpython import unload_modules
import coop_assembly
unload_modules("coop_assembly")
from coop_assembly.assembly_info_generation.fabrication_planes import calculate_gripping_plane, calculate_offset, calculate_offsets_all

import Rhino.Geometry as rg
from ghpythonlib.treehelpers import list_to_tree


#from coop_assembly.assembly_info_generation.fabrication_planes import calculate_gripping_plane, calculate_offset

if customized_seq:
    seq = [0,1,2] + customized_seq
else:
    seq = [v for v in b_struct.vertex]

print seq

for v in b_struct.vertex:
    calculate_gripping_plane(b_struct, v, b_struct.vertex[v]["mean_point"], nb_rot=nb_rot, nb_trans=nb_trans, planes_flip=flip)
    calculate_offset(o_struct, b_struct, v, offset_d1, offset_d2, seq)
    calculate_offsets_all(o_struct, b_struct, v, offset_d1, offset_d2, seq)


planes = []
for v in b_struct.vertex:
    gp = b_struct.vertex[v]["gripping_plane"]
    pl = rg.Plane(rg.Point3d(gp[0][0], gp[0][1],gp[0][2]), rg.Vector3d(gp[1][0], gp[1][1],gp[1][2]), rg.Vector3d(gp[2][0], gp[2][1],gp[2][2]))
    planes.append(pl)

planes_all = []
for i,v in enumerate(b_struct.vertex):
    gp_all = b_struct.vertex[v]["gripping_planes_all"]
    planes_all.append([])
    for gp in gp_all:
        pl = rg.Plane(rg.Point3d(gp[0][0], gp[0][1],gp[0][2]), rg.Vector3d(gp[1][0], gp[1][1],gp[1][2]), rg.Vector3d(gp[2][0], gp[2][1],gp[2][2]))
        planes_all[i].append(pl)

planes_offset = []
for v in b_struct.vertex:
    gp = b_struct.vertex[v]["gripping_plane_offset"]
    pl = rg.Plane(rg.Point3d(gp[0][0], gp[0][1],gp[0][2]), rg.Vector3d(gp[1][0], gp[1][1],gp[1][2]), rg.Vector3d(gp[2][0], gp[2][1],gp[2][2]))
    planes_offset.append(pl)

planes_offset_all = []
for i,v in enumerate(b_struct.vertex):
    gp_all = b_struct.vertex[v]["gripping_planes_offset_all"]
    planes_offset_all.append([])
    for gp in gp_all:
        pl = rg.Plane(rg.Point3d(gp[0][0], gp[0][1],gp[0][2]), rg.Vector3d(gp[1][0], gp[1][1],gp[1][2]), rg.Vector3d(gp[2][0], gp[2][1],gp[2][2]))
        planes_offset_all[i].append(pl)

planes_out = list_to_tree(planes_all)
planes_out_offset = list_to_tree(planes_offset_all)
sequeneced_element_ids = seq
# ---------- end ghpython_script_3 ----------
panel_13 = Panel(ghpython_script_3.out)
plane = Plane(simplify(ghpython_script_3.planes_out))
plane_2 = Plane(simplify(ghpython_script_3.planes_out_offset))
pln = Plane(ghpython_script_3.planes_offset)
pln_2 = Plane(ghpython_script_3.planes)
integer_3 = Integer(ghpython_script_3.sequeneced_element_ids)
cluster = Cluster_3(plane=plane_2)

# ----
# Robotic setup brep
# (to show the scale)
brep_2 = Brep([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])

# ----
# TCP Transformation
cluster_2 = Cluster_3(plane=plane)

# ----
# Skip the first
# three horizontal
# bars
panel_14 = Panel("3")
split_list = SplitList(Index=panel_14)  # -> ListA, ListB
integer_4 = Integer(flatten(integer_3))
panel_15 = Panel(integer_4)

# ----
# Remove some bars
replace_items = ReplaceItems(List=integer_4, Indices=Slider(5, range=0..10), Wrap=False)
clean_tree = CleanTree(RemoveNulls=True, RemoveInvalid=True, RemoveEmpty=False, Tree=replace_items)

# ----
# world from place offset (approach) grasp pose
plane_3 = Plane(cluster)
plane_4 = Plane(plane_3)

number_slider_3 = Slider(5, range=0..7)
integer_5 = Integer(flatten(integer_4))
panel_16 = Panel(integer_5)
list_item_3 = ListItem(List=panel_16, Index=number_slider_3, Wrap=True)
split_list_2 = SplitList(List=panel_16, Index=number_slider_3)  # -> ListA, ListB
list_item_4 = ListItem(List=pipe_2, Index=list_item_3, Wrap=True)
list_item_5 = ListItem(List=pipe_2, Index=split_list_2.ListA, Wrap=True)

# ----
# TCP definition
cluster_3 = Cluster_2(point=point_5, geometry=mesh)  # -> plane, geometry_2

pick_approach_offset_distance = Slider(20, range=0..100)
place_approach_offset_distance = Slider(20, range=0..100)

# ----
# Static Collision Meshes
brep_3 = Brep(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)
brep_4 = Brep(<brep referenced from the Rhino model>)
mesh_brep = MeshBrep(
    Brep=[brep_4, brep_3],
    Settings={GridMaxCount=0, GridMinCount=16, JaggedSeams=False, MaxEdgeLength=0, MinEdgeLength=0.0001, MinTolerance=0, Refine=True, RefineAngle=0, RelativeTolerance=0.65, SimplePlanes=True, Tolerance=0})
mesh_2 = Mesh(mesh_brep)
mesh_3 = Mesh(simplify(graft(mesh_2)))

custom_preview_3 = CustomPreview(Geometry=list_item_4, Shader=colour_swatch_2)
custom_preview_4 = CustomPreview(Geometry=list_item_5, Shader=colour_swatch)
ghpython_script_4 = GhPythonScript()  # -> out, a
# ---------- ghpython_script_4: Python ----------
__author__ = "harry"
__version__ = "2019.09.22"

import rhinoscriptsyntax as rs

a = [0,-1.65715,1.71108,-1.62348,0,0]
# ---------- end ghpython_script_4 ----------
degrees = Degrees(Radians=ghpython_script_4.a)
panel_17 = Panel(degrees)

# ----
# Choose Robot
ur5_pickup_conf = Panel("""88.44
-120.92
-90.25
-57.92
90.91
-137.77""")
ur3_left_pickup_conf = Panel("""-69.52
-56.92
86.93
-119.46
272.69
292.22""")
ur3_right_pickup_conf = Panel("""35.09
-63.41
97.99
-125.52
-88.54
212.99""")
stream_filter = StreamFilter(Gate=value_list, Stream0=ur5_pickup_conf, Stream1=ur3_left_pickup_conf, Stream2=ur3_right_pickup_conf)
unit_x = UnitX(Factor=1)
stream_filter_2 = StreamFilter(Gate=value_list, Stream0=point_6, Stream1=point_6, Stream2=point_7)
panel_18 = Panel(stream_filter)

radians = Radians(Degrees=stream_filter)

ghpython_script_5 = GhPythonScript(robot_model=list_item, TCP_translation=point_5, joint_values=radians, python_path=text_2, use_rpc=boolean_toggle)  # -> out, TCP_plane; inputs TCP_translation: Point3d, joint_values: list
# ---------- ghpython_script_5: Python ----------
import os
import json

import Rhino.Geometry as rg
from ghpythonlib.treehelpers import tree_to_list

tcp_trans_list = [TCP_translation.X, TCP_translation.Y, TCP_translation.Z]


if use_rpc:
    from compas.rpc import Proxy
    cp_proxy = Proxy('coop_assembly.choreo_interface.choreo_call', python=python_path, url='http://127.0.0.1')
    tcp_frame = cp_proxy.get_TCP_pose_from_joint_values(joint_values, robot_model=robot_model, tcp_tf_list=tcp_trans_list)
else:
    from compas.utilities.xfunc import XFunc
    xfunc = XFunc(
            'coop_assembly.choreo_interface.choreo_call.get_TCP_pose_from_joint_values', python=python_path)
    xfunc(joint_values, robot_model=robot_model, tcp_tf_list=tcp_trans_list)
    print('main_gh_simple: xfnc error: ', xfunc.error)
    tcp_frame = xfunc.data

TCP_plane = rg.Plane(1e3 * rg.Point3d(*tcp_frame['point']), 
                     rg.Vector3d(*tcp_frame['xaxis']),
                     rg.Vector3d(*tcp_frame['yaxis']))
# ---------- end ghpython_script_5 ----------
point_8 = Point(ghpython_script_5.TCP_plane)
panel_19 = Panel(ghpython_script_5.out)

# ----
# Choose from different options, which robot configuration to visualise
# Visualisation
pose_joints = Data(pose_2)
robot_2 = Data(set_params)
mesh_join = MeshJoin(Meshes=tools.s_0)

# ----
# rack start pt
# rack direction pt
point_9 = Point(stream_filter_2)

move = Move(Geometry=point_9, Motion=unit_x)  # -> Geometry, Transform

point_10 = Point(move.Geometry)

# ----
# Geometry
cluster_4 = Cluster_6(curve=extend_curve, number=subtraction, geometry=point_9, point_b=point_10, data=cluster_2)  # -> plane_8, goal_frames, mesh, plane_6, plane_7

# ----
# Relationships
# unit geometries in placed pose
mesh_4 = Mesh(cluster_4.mesh)

# ----
# symmetric world from place element poses
plane_5 = Plane(cluster_4.goal_frames)
plane_6 = Plane(simplify(plane_5))

# ----
# world from pick element pose
plane_7 = Plane(simplify(cluster_4.plane_8))
plane_8 = Plane(flatten(plane_7))

# ----
# world_from_pick_grasp_poses
plane_9 = Plane(cluster_4.plane_6)
plane_10 = Plane(plane_9)

# ----
# world from place grasp pose
plane_11 = Plane(cluster_4.plane_7)
plane_12 = Plane(plane_11)

# ----
# Grasp Pose Candidates Visualization
bar_id = Slider(0, range=0..13)
cluster_5 = Cluster(plane=plane_11, plane_2=plane_9, plane_3=cluster_3.plane, mesh=cluster_3.geometry_2, index=bar_id)  # -> mesh_10, mesh_9, result
split_tree = SplitTree(Data=cluster_5.mesh_10, Masks=flatten(cluster_5.result))  # -> Positive, Negative
split_tree_2 = SplitTree(Data=cluster_5.mesh_9, Masks=flatten(cluster_5.result))  # -> Positive, Negative
number_slider_4 = Slider(7, range=0..50)

# ----
# Path Planning Packaging
generate_pkg = Button()
cluster_6 = Cluster_8(geometry=plane_10, B=pick_approach_offset_distance)
cluster_7 = Cluster_8(geometry=plane_12, B=place_approach_offset_distance)
plane_13 = Plane(cluster_6)
ghpython_script_6 = GhPythonScript(
    element_geometries_in_place=mesh_4,
    world_from_place_poses=plane_6,
    world_from_pick_poses=flatten(plane_8),
    world_from_pick_grasp_poses=plane_10,
    world_from_pick_approach_poses=plane_13,
    world_from_pick_retreat_poses=plane_13,
    world_from_place_grasp_poses=plane_12,
    world_from_place_approach_poses=plane_4,
    world_from_place_retreat_poses=cluster_7,
    file_path=panel,
    pkg_name="dms_ws_tet_bars",
    generate=Toggle(False),
    static_obstacle_meshes=mesh_3)  # -> out, output_file_dir; inputs element_geometries_in_place: tree of Mesh, world_from_place_poses: tree of Plane, world_from_pick_poses: list of Plane, world_from_pick_grasp_poses: tree of Plane, world_from_pick_approach_poses: tree of Plane, world_from_pick_retreat_poses: tree of Plane, world_from_place_grasp_poses: tree of Plane, world_from_place_approach_poses: tree of Plane, world_from_place_retreat_poses: tree of Plane, generate: Boolean, static_obstacle_meshes: tree of Mesh
# ---------- ghpython_script_6: Python ----------
import sys
import copy
import os
import json
from collections import OrderedDict

import Rhino.Geometry as rg
import ghpythonlib.components as ghcomp
import ghpythonlib.treehelpers as th

from compas.datastructures import Mesh
from compas.geometry import Frame, Point
from compas.geometry import Transformation, transform_points, cross_vectors
from compas_ghpython.utilities import draw_mesh, draw_frame

from compas_ghpython.utilities import unload_modules
unload_modules('compas_fab.assembly.datastructures')

from compas_fab.assembly.datastructures import Assembly, Element, VirtualJoint, UnitGeometry, Grasp
from compas_fab.assembly.datastructures.utils import transform_cmesh, transform_cmesh_to_origin

##########################################
def tree_to_lists(input):
    """converts a depth-2 GH datatree to a list of lists
    """
    all = []
    for path in input.Paths:
        branch_list = []
        for obj in input.Branch(path):
            branch_list.append(obj)
        all.append(branch_list)
    return all

def rPt2cPt(rPt):
    """
    Convert Rhino point to compas point
    :param rPt:
    :return:
    """
    return Point(rPt.X, rPt.Y, rPt.Z)

def rPln2cFrame(rplane):
    """converts a rhino plane to compas frame
    """
    return Frame(rplane.Origin, rplane.XAxis, rplane.YAxis)

def rMesh2cMesh(rg_mesh):
    if type(rg_mesh) == rg.Mesh:
        #single mesh
        compas_mesh_vertices = rg_mesh.Vertices.ToPoint3dArray()
        compas_mesh_faces = rg_mesh.Faces.ToIntArray(True)
        compas_mesh_faces = [compas_mesh_faces[i:i + 3] for i in range(0, len(compas_mesh_faces), 3)]
        return Mesh.from_vertices_and_faces(compas_mesh_vertices, compas_mesh_faces)
    else:
        #array of meshes
        meshes = []
        for m in rg_mesh:
            compas_mesh_vertices = m.Vertices.ToPoint3dArray()
            compas_mesh_faces = m.Faces.ToIntArray(True)
            compas_mesh_faces = [compas_mesh_faces[i:i + 3] for i in range(0, len(compas_mesh_faces), 3)]
            meshes.append( Mesh.from_vertices_and_faces(compas_mesh_vertices, compas_mesh_faces) )
        return meshes


def draw_assembly_object_cmeshes(asm, e_id, stage='place'):
    """
    Parameters:
        stage: flag for 'place', 'pick'
    """
    if stage == 'place':
        return [draw_mesh(*cm.to_vertices_and_faces()) for cm in asm.element_geometry_in_place_pose(e_id)]
    elif 'pick':
        return [draw_mesh(*cm.to_vertices_and_faces()) for cm in asm.element_geometry_in_pick_pose(e_id)]
    else:
        return None

##########################################
# main

# TODO: convert tree of e_ids into virtual joints

if generate:
    asm = Assembly()
    
    # create assembly objects
    e_geos = tree_to_lists(element_geometries_in_place)
    world_from_place_pose_lists = tree_to_lists(world_from_place_poses)
    
    pick_grasp_pose_lists = tree_to_lists(world_from_pick_grasp_poses)
    pick_approach_pose_lists = tree_to_lists(world_from_pick_approach_poses)
    pick_retreat_pose_lists = tree_to_lists(world_from_pick_retreat_poses)
    
    place_grasp_pose_lists = tree_to_lists(world_from_place_grasp_poses)
    place_approach_pose_lists = tree_to_lists(world_from_place_approach_poses)
    place_retreat_pose_lists = tree_to_lists(world_from_place_retreat_poses)
    
    static_obs_lists = tree_to_lists(static_obstacle_meshes)
    
#    print(e_geos)
    
    for id, rm_list in enumerate(e_geos):
#        is_grounded = id in grounded_element_ids
        is_grounded = False
        e = Element(id, is_grounded=is_grounded)
        world_from_place_frames = [rPln2cFrame(gp) for gp in world_from_place_pose_lists[id]]
        world_from_pick_frame = rPln2cFrame(world_from_pick_poses[id])
        print('{}, {}'.format(id, len(pick_grasp_pose_lists[id])))
        
        pick_grasp_frames = [rPln2cFrame(g_pose) for g_pose in pick_grasp_pose_lists[id]]
        pick_approach_frames = [rPln2cFrame(app_pose) for app_pose in pick_approach_pose_lists[id]]
        pick_retreat_frames = [rPln2cFrame(retreat_pose) for retreat_pose in pick_retreat_pose_lists[id]]
        
        place_grasp_frames = [rPln2cFrame(g_pose) for g_pose in place_grasp_pose_lists[id]]
        place_approach_frames = [rPln2cFrame(app_pose) for app_pose in place_approach_pose_lists[id]]
        place_retreat_frames = [rPln2cFrame(retreat_pose) for retreat_pose in place_retreat_pose_lists[id]]
        assert len(pick_grasp_frames) == len(pick_approach_frames)
        assert len(pick_grasp_frames) == len(place_grasp_frames)
        assert len(pick_approach_frames) == len(place_approach_frames)
        
        pick_grasps = []
        place_grasps = []
        for g_id in range(len(pick_grasp_frames)):
            pick_grasps.append(Grasp.from_frames(id, g_id, \
                          world_from_pick_frame, pick_grasp_frames[g_id], 
                          pick_approach_frames[g_id], pick_retreat_frames[g_id]))
            place_grasps.append(Grasp.from_frames(id, g_id, \
                          world_from_place_frames[g_id], place_grasp_frames[g_id], 
                          place_approach_frames[g_id], place_retreat_frames[g_id]))
        
        cmesh_list = [transform_cmesh_to_origin(rMesh2cMesh(rm), world_from_place_frames[0]) for rm in rm_list]
        unit_geo = UnitGeometry(name='element_'+str(id), mesh=cmesh_list, 
            initial_frame=world_from_pick_frame, goal_frames=world_from_place_frames, pick_grasps=pick_grasps, place_grasps=place_grasps)
        
        asm.add_element(e, unit_geo)
    
#    for id, c_e_ids in enumerate(vj_e_ids):
#        is_grounded = id in grounded_virtual_joint_ids
#        asm.add_virtual_joint(VirtualJoint(id, connected_element_ids=c_e_ids, 
#            is_grounded=is_grounded))
    
    so_unit_geos = []
    for so_id, s_list in enumerate(static_obs_lists):
        so_unit_geos.append(UnitGeometry(name='static_obstacle_'+str(so_id), mesh=[rMesh2cMesh(so) for so in s_list]))
        
    asm.static_obstacle_geometries = so_unit_geos

    asm.to_package(file_path, pkg_name, 'picknplace', 'spatial_bars', 'millimeter')
    

output_file_dir = str(os.path.join(file_path, pkg_name))
# ---------- end ghpython_script_6 ----------
panel_20 = Panel(ghpython_script_6.out)

# ----
# Find Your Error
show_viz = BooleanToggle(False)
run_check = BooleanToggle(False)
integer_6 = Integer(integer_5)
list_length = ListLength(List=integer_6)
number_slider_5 = Slider(5, range=0..20)
series = Series(Start=0, Step=1, Count=list_length)
panel_21 = Panel(series)
text_3 = Text(ghpython_script_6.output_file_dir)
ghpython_script_7 = GhPythonScript(
    pkg_path=text_3,
    seq_id=panel_21,
    python_path=text_2,
    enable_pybullet_viewer=show_viz,
    robot_model=list_item,
    run=run_check,
    num_cart_steps="10",
    customized_seq=integer_5,
    TCP_translation=point_5)  # -> out, feasibility; inputs seq_id: Int32, enable_pybullet_viewer: Boolean, run: Boolean, num_cart_steps: Int32, customized_seq: list of Int32, TCP_translation: Point3d
# ---------- ghpython_script_7: Python ----------
import os
import json
from collections import OrderedDict

import Rhino.Geometry as rg
from ghpythonlib.treehelpers import tree_to_list

from compas.utilities.xfunc import XFunc

assembly_json_path = os.path.join(pkg_path, 'json', pkg_path.split(os.sep)[-1] + '.json')
print('result file path: ', assembly_json_path)
assert os.path.exists(assembly_json_path)

tcp_trans_list = [TCP_translation.X, TCP_translation.Y, TCP_translation.Z]

if run:
    xfunc = XFunc(
            'coop_assembly.choreo_interface.choreo_call.single_place_check', python=python_path)
    xfunc(seq_id, assembly_json_path, 
         num_cart_steps=num_cart_steps,
         tcp_tf_list=tcp_trans_list,
         customized_sequence=customized_seq,
         scale=0.001,
         enable_viewer=enable_pybullet_viewer,
         view_ikfast=enable_pybullet_viewer, robot_model=robot_model, diagnosis=False)
    print('main_gh_simple: xfnc error: ', xfunc.error)
    feasibility = xfunc.data
# ---------- end ghpython_script_7 ----------
panel_22 = Panel(ghpython_script_7.out)
panel_23 = Panel(ghpython_script_7.feasibility)

list_item_6 = ListItem(List=split_tree.Positive, Index=number_slider_4, Wrap=False)
list_item_7 = ListItem(List=split_tree_2.Positive, Index=number_slider_4, Wrap=False)

panel_24 = Panel(ghpython_script_6.output_file_dir)
ghpython_script_8 = GhPythonScript(pkg_path=ghpython_script_6.output_file_dir)  # -> out, a
# ---------- ghpython_script_8: Python ----------
__author__ = "harry"
__version__ = "2019.09.22"

import rhinoscriptsyntax as rs

import os
import json

assembly_json_path = os.path.join(pkg_path, 'json', pkg_path.split(os.sep)[-1] + '.json')
print('result file path: ', assembly_json_path)
assert os.path.exists(assembly_json_path)

with open(assembly_json_path, 'r') as file:
    data = json.load(file)
    print(data.keys())
# ---------- end ghpython_script_8 ----------

# ----
# Path Planner
viz_traj_curve = BooleanToggle(False)
trigger_planner = BooleanToggle(False)
visualize_saved_traj = Button()
text_4 = Text(text_2)
cluster_8 = Cluster_7(fragment_a=panel)
pb_viz = BooleanToggle(True)
plan_trans = BooleanToggle(True)
sim_traj = BooleanToggle(True)
per_conf_step = BooleanToggle(False)
point_11 = Point(point_5)
number_slider_6 = Slider(1, range=0..20)
number_slider_7 = Slider(0, range=0..20)
radians_2 = Panel("0.1")
sec_step = Panel("0.07")
sec_step_2 = Panel("0.07")
panel_25 = Panel(integer_5)
ghpython_script_9 = GhPythonScript(
    pkg_path=ghpython_script_6.output_file_dir,
    python_path=text_4,
    run_planner=trigger_planner,
    viz_saved_traj=visualize_saved_traj,
    result_save_path=cluster_8,
    TCP_translation=point_11,
    enable_pybullet_viewer=pb_viz,
    plan_transit=plan_trans,
    jt_resolution=radians_2,
    sim_traj=sim_traj,
    per_conf_step=per_conf_step,
    robot_model=list_item,
    trans_ts=sec_step,
    cart_ts=sec_step_2,
    customized_seq=panel_25)  # -> out, plan_result; inputs run_planner: Boolean, viz_saved_traj: Boolean, TCP_translation: Point3d, enable_pybullet_viewer: Boolean, plan_transit: Boolean, sim_traj: Boolean, per_conf_step: Boolean, customized_seq: list of Int32, from_seq_id: Int32, to_seq_id: Int32
# ---------- ghpython_script_9: Python ----------
import sys
import copy
import os
import json

#import Rhino.Geometry as rg
#import ghpythonlib.components as ghcomp
#import ghpythonlib.treehelpers as th
import System
from Grasshopper import DataTree as datatree
from Grasshopper.Kernel.Data import GH_Path as ghpath

from compas.utilities.xfunc import XFunc

assembly_json_path = os.path.join(pkg_path, 'json', pkg_path.split(os.sep)[-1] + '.json')
print('result file path: ', assembly_json_path)
assert os.path.exists(assembly_json_path)

tcp_trans_list = [TCP_translation.X, TCP_translation.Y, TCP_translation.Z]

from_seq_id = from_seq_id or 0
to_seq_id = to_seq_id or len(customized_seq)-1

assert 0 <= from_seq_id and from_seq_id < len(customized_seq)
assert from_seq_id <= to_seq_id and to_seq_id < len(customized_seq), 'seq_id not within range'
print('considered as collision objects: {}'.format(customized_seq[0 : from_seq_id]))
print('plan element ids: {}'.format(customized_seq[from_seq_id : to_seq_id+1]))

traj_dict = {}
if run_planner:
    xfunc = XFunc(
            'coop_assembly.choreo_interface.choreo_call.sequenced_picknplace_plan', python=python_path)
    xfunc(assembly_json_path, scale=0.001, result_save_path=result_save_path,
         enable_viewer=enable_pybullet_viewer,
         tcp_tf_list=tcp_trans_list,
         from_seq_id=from_seq_id, to_seq_id=to_seq_id,
         customized_sequence=customized_seq,
         plan_transit=plan_transit, transit_res=jt_resolution,
         view_ikfast=False, cart_ts=cart_ts, trans_ts=trans_ts, per_conf_step=per_conf_step, robot_model=robot_model)
    print('main_gh_simple: xfnc error: ', xfunc.error)
    traj_dict = xfunc.data

if viz_saved_traj:
    viz_xfunc = XFunc(
        'coop_assembly.choreo_interface.choreo_call.viz_saved_traj', python=python_path)
    viz_xfunc(result_save_path, assembly_json_path, 
        customized_seq,
        from_seq_id, to_seq_id,
        cart_ts=cart_ts, trans_ts=trans_ts,
        scale=0.001,  robot_model=robot_model, per_conf_step=per_conf_step)

if not run_planner and os.path.exists(result_save_path):
    with open(result_save_path, 'r') as f:
        traj_dict = json.loads(f.read())

# putting traj dict into a tree data
if traj_dict:
    plan_res_tree = datatree[System.Object]()
    for seq_id, unit_pnp in enumerate(traj_dict):
        for i, traj_pt in enumerate(unit_pnp['place2pick']['points']):
                for jt_val in traj_pt['values']:
                    plan_res_tree.Add(jt_val, ghpath(seq_id, 0, i))
        
        for i, traj_pt in enumerate(unit_pnp['pick_approach']['points']):
                for jt_val in traj_pt['values']:
                    plan_res_tree.Add(jt_val, ghpath(seq_id, 1, i))
                    
        for i, traj_pt in enumerate(unit_pnp['pick_retreat']['points']):
                for jt_val in traj_pt['values']:
                    plan_res_tree.Add(jt_val, ghpath(seq_id, 2, i))
                    
        for i, traj_pt in enumerate(unit_pnp['pick2place']['points']):
                for jt_val in traj_pt['values']:
                    plan_res_tree.Add(jt_val, ghpath(seq_id, 3, i))
    
        for i, traj_pt in enumerate(unit_pnp['place_approach']['points']):
                for jt_val in traj_pt['values']:
                    plan_res_tree.Add(jt_val, ghpath(seq_id, 4, i))
                    
        for i, traj_pt in enumerate(unit_pnp['place_retreat']['points']):
                for jt_val in traj_pt['values']:
                    plan_res_tree.Add(jt_val, ghpath(seq_id, 5, i))
        
        if seq_id == len(traj_dict) - 1:
            for i, traj_pt in enumerate(unit_pnp['return2idle']['points']):
                    for jt_val in traj_pt['values']:
                        plan_res_tree.Add(jt_val, ghpath(seq_id + 1, 0, i))
                        
    plan_result = plan_res_tree
# ---------- end ghpython_script_9 ----------
panel_26 = Panel(ghpython_script_9.out)

text_5 = Text(cluster_8)
python = GhPythonScript(path=text_5, read=viz_traj_curve, bar_nb=number_slider)  # -> out, list_joints_val, simplify(jt_val_tree), gripper_ctrl; inputs bar_nb: Int32
# ---------- python: Python ----------
import json

with open(path) as json_file:
    data = json.load(json_file)
    print len(data)

list_joints_val = []

for bar_nb in range(len(data)):
    joint_traj_dict = data[bar_nb]
    
    len_place2pick = len(joint_traj_dict["place2pick"]["points"])
    len_pick_approach = len(joint_traj_dict["pick_approach"]["points"])
    len_pick_retreat = len(joint_traj_dict["pick_retreat"]["points"])
    len_pick2place = len(joint_traj_dict["pick2place"]["points"])
    len_place_approach = len(joint_traj_dict["place_approach"]["points"])
    len_place_retreat = len(joint_traj_dict["place_retreat"]["points"])
    
    pts_place2pick = joint_traj_dict["place2pick"]["points"]
    for p in pts_place2pick:
        vals = p["values"]
        list_joints_val.append(p)
    
    pts_pick_approach = joint_traj_dict["pick_approach"]["points"]
    for p in pts_pick_approach:
        vals = p["values"]
        list_joints_val.append(p)
    
    pts_pick_retreat = joint_traj_dict["pick_retreat"]["points"]
    for p in pts_pick_retreat:
        vals = p["values"]
        list_joints_val.append(p)
        
    pts_pick2place = joint_traj_dict["pick2place"]["points"]
    for p in pts_pick2place:
        vals = p["values"]
        list_joints_val.append(p)
        
    pts_place_approach = joint_traj_dict["place_approach"]["points"]
    for p in pts_place_approach:
        vals = p["values"]
        list_joints_val.append(p)
        
    pts_place_retreat = joint_traj_dict["place_retreat"]["points"]
    for p in pts_place_retreat:
        vals = p["values"]
        list_joints_val.append(p)
    
    if 'return2idle' in joint_traj_dict:
        pts_return2idle = joint_traj_dict["return2idle"]["points"]
        for p in pts_return2idle:
            vals = p["values"]
            list_joints_val.append(p)

#print(len_pick_approach+len_pick_retreat+len_pick2place+len_place_approach+len_place_retreat+len_place2pick)
#print len(list_joints_val)
#print list_joints_val[0]["values"]

nb0 = 0
nb1 = len_place2pick
nb2 = len_place2pick + len_pick_approach
nb3 = len_place2pick + len_pick_approach + len_pick_retreat
nb4 = len_place2pick + len_pick_approach + len_pick_retreat + len_pick2place
nb5 = len_place2pick + len_pick_approach + len_pick_retreat + len_pick2place + len_place_approach

gripper_ctrl = [nb0, nb1, nb2, nb3, nb4, nb5]

from ghpythonlib.treehelpers import list_to_tree
#print(list_joints_val)
list_joints_val_p = [val['values'] for val in list_joints_val]
jt_val_tree = list_to_tree(list_joints_val_p)
# ---------- end python ----------
panel_27 = Panel(text_5)
number_2 = Number(python.jt_val_tree)

# ----
# Direct UR control
# Loading .json
# File
python_2 = GhPythonScript(path=text_5, read=viz_traj_curve, bar_nb=number_slider)  # -> out, list_joints_val, simplify(jt_val_tree), gripper_ctrl; inputs bar_nb: Int32
# ---------- python_2: Python ----------
import json

with open(path) as json_file:
    data = json.load(json_file)
    print len(data)

joint_traj_dict = data[bar_nb]

len_place2pick = len(joint_traj_dict["place2pick"]["points"])
len_pick_approach = len(joint_traj_dict["pick_approach"]["points"])
len_pick_retreat = len(joint_traj_dict["pick_retreat"]["points"])
len_pick2place = len(joint_traj_dict["pick2place"]["points"])
len_place_approach = len(joint_traj_dict["place_approach"]["points"])
len_place_retreat = len(joint_traj_dict["place_retreat"]["points"])

list_joints_val = []

pts_place2pick = joint_traj_dict["place2pick"]["points"]
for p in pts_place2pick:
    vals = p["values"]
    list_joints_val.append(p)

pts_pick_approach = joint_traj_dict["pick_approach"]["points"]
for p in pts_pick_approach:
    vals = p["values"]
    list_joints_val.append(p)

pts_pick_retreat = joint_traj_dict["pick_retreat"]["points"]
for p in pts_pick_retreat:
    vals = p["values"]
    list_joints_val.append(p)
    
pts_pick2place = joint_traj_dict["pick2place"]["points"]
for p in pts_pick2place:
    vals = p["values"]
    list_joints_val.append(p)
    
pts_place_approach = joint_traj_dict["place_approach"]["points"]
for p in pts_place_approach:
    vals = p["values"]
    list_joints_val.append(p)
    
pts_place_retreat = joint_traj_dict["place_retreat"]["points"]
for p in pts_place_retreat:
    vals = p["values"]
    list_joints_val.append(p)
    
    
#print(len_pick_approach+len_pick_retreat+len_pick2place+len_place_approach+len_place_retreat+len_place2pick)
#print len(list_joints_val)
print list_joints_val[0]["values"]

nb0 = 0
nb1 = len_place2pick
nb2 = len_place2pick + len_pick_approach
nb3 = len_place2pick + len_pick_approach + len_pick_retreat
nb4 = len_place2pick + len_pick_approach + len_pick_retreat + len_pick2place
nb5 = len_place2pick + len_pick_approach + len_pick_retreat + len_pick2place + len_place_approach

gripper_ctrl = [nb0, nb1, nb2, nb3, nb4, nb5]

from ghpythonlib.treehelpers import list_to_tree
#print(list_joints_val)
list_joints_val_p = [val['values'] for val in list_joints_val]
jt_val_tree = list_to_tree(list_joints_val_p)
# ---------- end python_2 ----------

ghpython_script_10 = GhPythonScript(robot_model=list_item, TCP_translation=point_5, joint_values=number_2, python_path=text_2, use_rpc=boolean_toggle)  # -> out, TCP_plane; inputs TCP_translation: Point3d, joint_values: list; same code as ghpython_script_5

ghpython_script_11 = GhPythonScript(list_joints=python_2.list_joints_val)  # -> out, items; inputs list_joints: list
# ---------- ghpython_script_11: Python ----------
    
items = []
for j in list_joints:
    items.append(j['values'])

#print(items)
# ---------- end ghpython_script_11 ----------
list_item_8 = ListItem(List=ghpython_script_11.items, Index=viz_slider, Wrap=False)

point_12 = Point(flatten(ghpython_script_10.TCP_plane))
polyline = PolyLine(Vertices=point_12, Closed=False)
shift_list = ShiftList(List=point_12, Shift=1, Wrap=True)
shift_list_2 = ShiftList(List=point_12, Shift="-1", Wrap=True)

# ----
# Sending Data to Robot
list_3 = ValueList({"send all positions": 0, "send only one position": 1}, selected="send all positions")
panel_28 = Panel("move joints")
joint_configurations = Data(python_2.list_joints_val)
idx = Slider(0, range=0..100)
item = ListItem(List=joint_configurations, Index=idx, Wrap=True)
filter_2 = StreamFilter(Gate=list_3, Stream0=joint_configurations, Stream1=item)
movej = PythonScript(
    joint_configurations=filter_2,
    gripper_ctrl=python_2.gripper_ctrl,
    velocity=Slider(379, range=0..1000),
    acceleration=Slider(500, range=0..5000),
    pickup=pickup,
    placement=placement,
    retreat=retreat)  # -> script; inputs joint_configurations: list, gripper_ctrl: list of Int32
# ---------- movej: Python ----------
script_lines = []

for i,configuration in enumerate(joint_configurations):
    #print configuration.joint_values
#    print configuration["values"]
    if pickup:
        if i < gripper_ctrl[1]:
            # place2pick
            script_lines.append("movej(%s, a=%f, v=%f, r=%f)" % (str(configuration["values"]), acceleration/1000., velocity/1000., 0.005))
        elif i == gripper_ctrl[1]:
            # open gripper
            script_lines.append("sleep(1)")
            script_lines.append("set_digital_out(0, False)")
            script_lines.append("set_digital_out(1, True)")
            script_lines.append("sleep(1)")
            script_lines.append("movej(%s, a=%f, v=%f, r=%f)" % (str(configuration["values"]), acceleration/1000., velocity/1000., 0.0))
        elif i < gripper_ctrl[2]:
            script_lines.append("movej(%s, a=%f, v=%f, r=%f)" % (str(configuration["values"]), acceleration/1000., velocity/1000., 0.0))
        elif i == gripper_ctrl[2]:
            # close gripper
            script_lines.append("sleep(1)")
            script_lines.append("set_digital_out(1, False)")
            script_lines.append("set_digital_out(0, True)")
            script_lines.append("sleep(1)")
        else: pass
    
    if placement:
        if i <= gripper_ctrl[2]:
            pass
        elif i < gripper_ctrl[3]:
            # pick retreat
            script_lines.append("movej(%s, a=%f, v=%f, r=%f)" % (str(configuration["values"]), acceleration/1000., velocity/1000., 0.0))
        elif i < gripper_ctrl[4]:
            # pick2place
            script_lines.append("movej(%s, a=%f, v=%f, r=%f)" % (str(configuration["values"]), acceleration/1000., velocity/1000., 0.005))
        elif i < gripper_ctrl[5]:
            # place approach
            script_lines.append("movej(%s, a=%f, v=%f, r=%f)" % (str(configuration["values"]), acceleration/1000., velocity/1000., 0.0))
            
        else:
            pass
            
    if retreat:
        if i < gripper_ctrl[5]:
            pass
        elif i == gripper_ctrl[5]:
            # open gripper
            script_lines.append("sleep(1)")
            script_lines.append("set_digital_out(0, False)")
            script_lines.append("set_digital_out(1, True)")
            script_lines.append("sleep(1)")
            script_lines.append("movej(%s, a=%f, v=%f, r=%f)" % (str(configuration["values"]), acceleration/1000., velocity/1000., 0.0))
        elif i > gripper_ctrl[5]:
            script_lines.append("movej(%s, a=%f, v=%f, r=%f)" % (str(configuration["values"]), acceleration/1000., velocity/1000., 0.0))
        else:
            pass

#print script_lines


script = "def prog():\n"
print script
script += "\ttextmsg(\">> program start\")\n"
script += "".join(["\t%s\n" % line for line in script_lines])
script += "\ttextmsg(\"<< program end\")\n"
script += "end\n"
script += "prog()\n\n"


print script

#script = ""
# ---------- end movej ----------
send_4 = Send(script=movej, send=send)
panel_29 = Panel(send_4)

vector_2pt = Vector2Pt(PointA=shift_list_2, PointB=shift_list, Unitize=False)  # -> Vector, Length
vector_display = VectorDisplay(Anchor=shift_list_2, Vector=vector_2pt.Vector)
stream_filter_3 = StreamFilter(Gate=viz_traj_curve, Stream1=polyline)
custom_preview_5 = CustomPreview(Geometry=stream_filter_3, Shader=ColourSwatch(SwatchColor=RGBA(255, 0, 255, 168)))

# ---- group: Visualise
draw_2 = PythonScript(robot1=robot_2, joint_values=list_item_8, mesh=filter, brep=filter, show_brep=show_brep, tool=mesh_join)  # -> meshes, tool0_plane, tcp_plane, robot_brep, list_degree; inputs mesh: list, brep: list, show_brep: Boolean, tool: Mesh
# ---------- draw_2: Python ----------
from compas_ghpython import unload_modules
unload_modules("ur_online_control")

from compas_ghpython import draw_frame
from compas_ghpython import mesh_draw
from compas_ghpython.geometry.xforms import xform_from_transformation
from compas.geometry import Frame
from compas.geometry.xforms import Transformation
from compas_fab.robots import Configuration

from compas.datastructures import mesh_transformed

import Rhino.Geometry as rg
import Rhino
import math

import time

def mesh_update_vertices(mesh, vertices):
    for i in range(len(vertices)):
        mesh.vertex[i].update({'x': vertices[i][0], 'y': vertices[i][1], 'z': vertices[i][2]})

if joint_values:
    
    configuration = Configuration.from_revolute_values([d for d in joint_values])
    list_joint_values = configuration.data["values"]
    list_degree = []
    for degree in list_joint_values:
        degree = math.degrees(degree)
        list_degree.append(degree)
    print list_degree
    #q = BaseConfiguration.from_joints(configuration)
    q = configuration
    print q
    #print q.joint_values
    
    #print robot1.get_forward_transformations(q)
    R0, R1, R2, R3, R4, R5 = robot1.get_forward_transformations(q)
    
    tool0_frame2 = robot1.tool0_frame.transformed(R5)
    #tcp_frame2 = Frame.from_transformation(Transformation.from_frame(tool0_frame2) * robot1.transformation_tool0_tcp)
    
    #print robot1.transformation_tool0_tcp
    #print robot1.transformation_tcp_tool0
    #print robot1.transformation_tool0_tcp * robot1.transformation_tcp_tool0
    #print tcp_frame2
    tcp_frame2 = Frame.from_transformation(Transformation.from_frame(tool0_frame2) * robot1.transformation_tcp_tool0)
    #print tcp_frame2
    
    #tool0_frame, tcp_frame = robot1.get_transformed_tool_frames(R5)
    
    tool0_frame = tool0_frame2
    tcp_frame = tcp_frame2
    
    m0, m1, m2, m3, m4, m5 = mesh
    for i in range(6):
        exec("R%drg = xform_from_transformation(R%d)" % (i, i))
        exec("m%d.Transform(R%drg)" % (i, i))
    #exec("mt.Transform(R5rg)")
    meshes = [m0, m1, m2, m3, m4, m5]
    #print meshes
    
#    before = time.time()
    tff = Transformation.from_frame(tool0_frame)
#    print('Transformation.from_frame',time.time() - before)
#    before = time.time()
##    mt = robot1.tool.get_transformed_model(tff)
#    mt=robot1.tool.model[0]
#    mt = mesh_transformed(mt, tff)
##    mt = robot1.tool.get_transformed_model(R5rg)
#    print('get_transformed_model',time.time() - before)
#    
#    if mt:
#        meshes.append(mesh_draw(mt))
        #meshes.append(map(mesh_draw, mt))
    
    if tff and tool:
        ghtf = xform_from_transformation(tff)
        tool.Transform(ghtf)
        meshes.append(tool)
    
    """
    m0, m1, m2, m3, m4, m5, tool0_frame, tcp_frame = robot1.get_transformed_model(q)
    mt = robot1.get_transformed_tool_model(tcp_frame)
    
    meshes = []
    meshes.append(mesh_draw(m0))
    meshes.append(mesh_draw(m1))
    meshes.append(mesh_draw(m2))
    meshes.append(mesh_draw(m3))
    meshes.append(mesh_draw(m4))
    meshes.append(mesh_draw(m5))
    if mt:
        meshes.append(mesh_draw(mt))
    
    """
    
    tool0_plane = draw_frame(tool0_frame)
    tcp_plane = draw_frame(tcp_frame)
    
    if show_brep:
        
        b0, b1, b2, b3, b4, b5 = brep
        
        b0.Transform(R0rg)
        b1.Transform(R1rg)
        b2.Transform(R2rg)
        b3.Transform(R3rg)
        b4.Transform(R4rg)
        b5.Transform(R5rg)
        
        robot_brep = [b0, b1, b2, b3, b4, b5]
        print robot_brep

#print brep
print joint_values
# ---------- end draw_2 ----------
preview_2 = CustomPreview(Geometry=draw_2.meshes, Shader=ColourSwatch(SwatchColor=RGBA(145, 207, 200, 82)))
robot_brep = Brep(draw_2.robot_brep)
tool0_plane = Plane(draw_2.tool0_plane)
tcp_plane = Plane(draw_2.tcp_plane)
mesh_5 = Mesh(draw_2.meshes)
draw_3 = RepresentPlaneAsLines(plane=[tcp_plane, tool0_plane], size=100)  # -> G, C
# ---------- draw_3: Python ----------
import Rhino.Geometry as rg
from System.Drawing import Color

if plane:

    G = []
    G.append(rg.Line(plane.Origin, size * plane.XAxis))
    G.append(rg.Line(plane.Origin, size * plane.YAxis))
    G.append(rg.Line(plane.Origin, size * plane.ZAxis))
    
    C = []
    C.append(Color.FromArgb(255, 0, 0))
    C.append(Color.FromArgb(0, 255, 0))
    C.append(Color.FromArgb(0, 0, 255))
# ---------- end draw_3 ----------
preview_3 = CustomPreview(Geometry=draw_3.G, Shader=draw_3.C)

# ==== cluster Send
script = ClusterInput()
send = ClusterInput()
send_2 = PythonScript(script=script, send=send)  # -> out
# ---------- send_2: Python ----------
import socket
from scriptcontext import sticky as st

ur_ip2 = st["ur_ip1"]
ur_port = 30002

if send:
    s = socket.create_connection((ur_ip2, ur_port), timeout=0.5) 
    s.send(script)
    s.close()
# ---------- end send_2 ----------
out = ClusterOutput(send_2)

# ==== cluster Draw
frame = ClusterInput()
size = ClusterInput()
draw = PythonScript(frame=frame, size=size)  # -> G, C
# ---------- draw: Python ----------
import Rhino.Geometry as rg
from System.Drawing import Color

if not size:
    size = 100

if frame:
    
    plane = rg.Plane(rg.Point3d(*list(frame.point)), rg.Vector3d(*list(frame.xaxis)), rg.Vector3d(*list(frame.yaxis)))

    G = []
    G.append(rg.Line(plane.Origin, size * plane.XAxis))
    G.append(rg.Line(plane.Origin, size * plane.YAxis))
    G.append(rg.Line(plane.Origin, size * plane.ZAxis))
    
    C = []
    C.append(Color.FromArgb(255, 0, 0))
    C.append(Color.FromArgb(0, 255, 0))
    C.append(Color.FromArgb(0, 0, 255))
# ---------- end draw ----------
G = ClusterOutput(draw.G)
C = ClusterOutput(draw.C)

# ==== cluster Tools

# ---- group: vault_test2_B
geo = Geometry([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])
mesh = Mesh(geo)
brep = Brep(geo)
mjoin = MeshJoin(Meshes=mesh)
xaxis_line = Curve(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)
yaxis_line = Curve(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)
tool = PythonScript(meshes=mjoin, breps=brep, xline=xaxis_line, yline=yaxis_line)  # -> tool; inputs meshes: list of Mesh, breps: list of Brep
# ---------- tool: Python ----------
import Rhino.Geometry as rg
from compas.geometry import Frame
from ur_online_control.ur.tool import Tool
from compas.datastructures import Mesh
from compas_rhino.helpers import mesh_from_guid

xaxis = rg.Line(xline.PointAtStart, xline.PointAtEnd)
yaxis = rg.Line(yline.PointAtStart, yline.PointAtEnd)

if xaxis.From.DistanceTo(yaxis.From) < 0.01:
    origin = xaxis.From
    xaxis = xaxis.Direction
    yaxis = yaxis.Direction
elif xaxis.To.DistanceTo(yaxis.To) < 0.01:
    origin = xaxis.To
    xaxis = -xaxis.Direction
    yaxis = -yaxis.Direction
elif xaxis.From.DistanceTo(yaxis.To) < 0.01:
    origin = xaxis.From
    xaxis = xaxis.Direction
    yaxis = -yaxis.Direction
elif xaxis.To.DistanceTo(yaxis.From) < 0.01:
    origin = xaxis.To
    xaxis = -xaxis.Direction
    yaxis = yaxis.Direction

xaxis.Unitize()
yaxis.Unitize()

print origin
print xaxis
print yaxis

tcp_frame = Frame(origin, xaxis, yaxis)

tool = Tool(tcp_frame)
tool.model = [mesh_from_guid(Mesh, mesh) for mesh in meshes]
#tool.model_xyz = tool.model.xyz
tool.breps = breps
# ---------- end tool ----------

# ---- group: vault_test2_Measure
geo_2 = Geometry([<brep referenced from the Rhino model> x3, <curve referenced from the Rhino model>, <brep referenced from the Rhino model> x2, <curve referenced from the Rhino model>, <brep referenced from the Rhino model>, <curve referenced from the Rhino model>, <brep referenced from the Rhino model> x9])
brep_2 = Brep(geo_2)
mesh_2 = Mesh(geo_2)
mjoin_2 = MeshJoin(Meshes=mesh_2)
xaxis_line_2 = Curve(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)
yaxis_line_2 = Curve(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)
tool_2 = PythonScript(meshes=mjoin_2, breps=brep_2, xline=xaxis_line, yline=yaxis_line)  # -> tool; inputs meshes: list of Mesh, breps: list of Brep; same code as tool

# ----
tool_id = ClusterInput()
tool_id_2 = Integer(tool_id)
filter = StreamFilter(Gate=tool_id_2, Stream0=tool, Stream1=tool_2)
filter_2 = StreamFilter(Gate=tool_id_2, Stream0=tool, Stream1=tool_2)
py = PythonScript(tool=filter)  # -> tcp_frame, model
# ---------- py: Python ----------
from compas_ghpython import mesh_draw 

if tool:
    tcp_frame = tool.tcp_frame
    model = map(mesh_draw, tool.model)
# ---------- end py ----------
tool_3 = Data(filter)
draw = PythonScript(frame=py.tcp_frame)  # -> G, C
# ---------- draw: Python ----------
import Rhino.Geometry as rg
from System.Drawing import Color

if not size:
    size = 100

if frame:
    plane = rg.Plane(rg.Point3d(*list(frame.point)), rg.Vector3d(*list(frame.xaxis)), rg.Vector3d(*list(frame.yaxis)))

    G = []
    G.append(rg.Line(plane.Origin, size * plane.XAxis))
    G.append(rg.Line(plane.Origin, size * plane.YAxis))
    G.append(rg.Line(plane.Origin, size * plane.ZAxis))
    
    C = []
    C.append(Color.FromArgb(255, 0, 0))
    C.append(Color.FromArgb(0, 255, 0))
    C.append(Color.FromArgb(0, 0, 255))
# ---------- end draw ----------
tool_4 = ClusterOutput(tool_3)
s_0 = ClusterOutput(filter_2)
preview = CustomPreview(Geometry=py.model, Shader=ColourSwatch(SwatchColor=RGBA(141, 170, 178, 150)))
preview_2 = CustomPreview(Geometry=draw.G, Shader=draw.C)

# ==== cluster Cluster
mesh = ClusterInput()
plane = ClusterInput()
plane_2 = ClusterInput()
plane_3 = ClusterInput()
index = ClusterInput()

# ----
# placed element pose
plane_4 = Plane(plane)

# ----
# EE mesh
mesh_2 = Mesh(mesh)

# ----
# TCP def pose
plane_5 = Plane(plane_3)

# ----
# picked element pose
plane_6 = Plane(plane_2)

orient = Orient(Geometry=mesh_2, Source=plane_5, Target=plane_4)  # -> Geometry, Transform

# ----
# in place EE mesh viz
mesh_3 = Mesh(orient.Geometry)

# ----
# in place EE mesh viz (flexible correspondance)
# place2pick transf
orient_2 = Orient(Source=plane_5, Target=plane_6)  # -> Geometry, Transform
mesh_4 = Mesh(mesh_2)
transform = Transform(orient_2.Transform)
transform_2 = Transform(Geometry=mesh_4, Transform=transform)  # -> simplify(Geometry)

mesh_5 = Mesh(transform_2)
mesh_6 = Mesh(mesh_3)

# ----
# picked EE mesh
mesh_7 = Mesh(mesh_5)

# ----
# placed EE mesh
mesh_8 = Mesh(mesh_6)

tree_statistics = TreeStatistics(Tree=mesh_8)  # -> Paths, Length, Count
deconstruct_path = DeconstructPath(Branch=tree_statistics.Paths)  # -> simplify(Indices)
mesh_9 = ClusterOutput(mesh_7)
mesh_10 = ClusterOutput(mesh_8)
list_item = ListItem(List=deconstruct_path, Index=0, Wrap=True)
create_set = CreateSet(List=flatten(list_item))  # -> Set, Map
list_item_2 = ListItem(List=create_set.Set, Index=index, Wrap=False)
concatenate = Concatenate(B="{", Fragment_A=list_item_2, A=";", Fragment_B="*", C="}")
result = ClusterOutput(concatenate)

# ==== cluster Cluster_2
geometry = ClusterInput()
point = ClusterInput()
xz_plane = XZPlane(Origin=Point(0, 0, 0))
scale = Scale(Geometry=geometry, Center=Point(0, 0, 0), Factor="1000")  # -> Geometry, Transform
point_2 = Point(point)
multiplication = Multiplication(A=point_2, B="1000")
plane_origin = PlaneOrigin(Base=xz_plane, Origin=multiplication)
geometry_2 = ClusterOutput(scale.Geometry)
plane = ClusterOutput(plane_origin)

# ==== cluster Cluster_3
plane = ClusterInput()

# ---- group: gripping plane generation
plane_2 = Plane(simplify(plane))

# ----
deconstruct_plane = DeconstructPlane(Plane=plane_2)  # -> Origin, XAxis, YAxis, ZAxis
negative = Negative(Value=deconstruct_plane.ZAxis)
construct_plane = ConstructPlane(Origin=deconstruct_plane.Origin, XAxis=deconstruct_plane.YAxis, YAxis=negative)
plane_3 = ClusterOutput(construct_plane)

# ==== cluster Cluster_6
geometry = ClusterInput()

# ----
# generated bars' central lines
curve = ClusterInput()

number = ClusterInput()
point_b = ClusterInput()

# ----
# EE pose in place
data = ClusterInput()

vector_2pt = Vector2Pt(PointA=geometry, PointB=point_b, Unitize=True)  # -> Vector, Length
length = Length(Curve=curve)

# ----
# shrinked bar radius
number_2 = Number(number)

multiplication = Multiplication(A=length, B=vector_2pt.Vector)
move = Move(Geometry=geometry, Motion=multiplication)  # -> Geometry, Transform
line = Line(StartPoint=geometry, EndPoint=move.Geometry)
pipe = Pipe(Curve=line, Radius=number_2, Caps=0)  # -> simplify(Pipe)
pipe_2 = Pipe(Curve=curve, Radius=number_2, Caps=0)  # -> simplify(Pipe)
tree_statistics = TreeStatistics(Tree=pipe_2)  # -> Paths, Length, Count

# ----
# desired branch paths
data_path = DataPath(tree_statistics.Paths)

split_tree = SplitTree(Data=data, Masks=flatten(data_path))  # -> Positive, Negative
cap_holes = CapHoles(Brep=pipe)
cap_holes_2 = CapHoles(Brep=pipe_2)

# ----
# EE pose in place
plane = Plane(split_tree.Positive)

brep = Brep(cap_holes_2)
brep_2 = Brep(cap_holes)
split_tree_2 = SplitTree(Data=brep, Masks=flatten(data_path))  # -> Positive, Negative
split_tree_3 = SplitTree(Data=brep_2, Masks=flatten(data_path))  # -> Positive, Negative

# ----
# element
# in pick position
brep_3 = Brep(split_tree_3.Positive)

# ----
# element
# in place position
brep_4 = Brep(split_tree_2.Positive)

# ----
# make element central frame
# (for the placed geometry)
cluster = Cluster_4(brep=brep_4)

cluster_2 = Cluster_4(brep=brep_3)
brep_5 = Brep(brep_3)
vector = Vector(vector_2pt.Vector)
volume = Volume(Geometry=brep_5)  # -> Volume, Centroid
rotate = Rotate(Geometry=vector, Angle=1.570796327, Plane=PlaneXY(0, 0, 0))  # -> Geometry, Transform
plane_2 = Plane(simplify(cluster))
construct_plane = ConstructPlane(Origin=volume.Centroid, XAxis=vector, YAxis=rotate.Geometry)
brep_6 = Brep(brep_4)
orient = Orient(Geometry=data, Source=plane_2, Target=construct_plane)  # -> Geometry, Transform

unit_z = UnitZ(Factor=1)
deconstruct_plane = DeconstructPlane(Plane=orient.Geometry)  # -> Origin, XAxis, YAxis, ZAxis
vector_2 = Vector(vector_2pt.Vector)
negative = Negative(Value=unit_z)
cross_product = CrossProduct(VectorA=negative, VectorB=vector_2, Unitize=False)  # -> Vector, Length
construct_plane_2 = ConstructPlane(Origin=deconstruct_plane.Origin, XAxis=negative, YAxis=cross_product.Vector)
plane_3 = Plane(construct_plane_2)

# ----
# EE pose in place
plane_4 = Plane(plane)

brep_7 = Brep(brep_6)
orient_2 = Orient(Geometry=brep_7, Source=plane_4, Target=plane_3)  # -> Geometry, simplify(Transform)
inverse_transform = InverseTransform(Transform=orient_2.Transform)

# ----
# geometry poses in place
transform = Transform(Geometry=cluster_2, Transform=inverse_transform)

# ----
# geometry pose in pick
plane_5 = Plane(cluster_2)

# ----
# brep_to_mesh (tree)
cluster_3 = Cluster_5(brep=brep_7)

# ----
# bar brep in place
mesh = ClusterOutput(cluster_3)

# ----
# EE pose in pick
plane_6 = ClusterOutput(plane_3)

# ----
# EE pose in place
plane_7 = ClusterOutput(plane_4)

# ----
# goal_frames
goal_frames = ClusterOutput(transform)

# ----
# initial frames
plane_8 = ClusterOutput(plane_5)

# ==== cluster Cluster_7
fragment_a = ClusterInput()
concatenate = Concatenate(Fragment_A=fragment_a, B="\", C="result", A="\", Fragment_B="choreo_result.json")
result = ClusterOutput(concatenate)

# ==== cluster Cluster_8
geometry = ClusterInput()
B = ClusterInput()
deconstruct_plane = DeconstructPlane(Plane=geometry)  # -> Origin, XAxis, YAxis, ZAxis
# approach pick grasp pose generation
reverse = Reverse(Vector=deconstruct_plane.XAxis)
multiplication = Multiplication(A=reverse, B=B)
move = Move(Geometry=geometry, Motion=multiplication)  # -> Geometry, Transform
geometry_2 = ClusterOutput(move.Geometry)

# ==== cluster Cluster_4
brep = ClusterInput()
brep_2 = Brep(brep)
deconstruct_brep = DeconstructBrep(Brep=brep_2)  # -> Faces, Edges, Vertices
volume = Volume(Geometry=brep_2)  # -> Volume, Centroid
list_item = ListItem(List=deconstruct_brep.Faces, Index=0, Wrap=True)
point = Point(volume.Centroid)
area = Area(Geometry=list_item)  # -> Area, Centroid
point_2 = Point(area.Centroid)
vector_2pt = Vector2Pt(PointA=point, PointB=point_2, Unitize=False)  # -> Vector, Length
plane_normal = PlaneNormal(Origin=point, ZAxis=vector_2pt.Vector)
deconstruct_plane = DeconstructPlane(Plane=plane_normal)  # -> Origin, XAxis, YAxis, ZAxis
construct_plane = ConstructPlane(Origin=deconstruct_plane.Origin, XAxis=deconstruct_plane.ZAxis, YAxis=deconstruct_plane.XAxis)
plane = ClusterOutput(construct_plane)

# ==== cluster Cluster_5
brep = ClusterInput()
brep_2 = Brep(simplify(graft(brep)))
group = Group(Objects=brep_2)
ungroup = Ungroup(Group=group)  # -> simplify(Objects)
mesh_brep = MeshBrep(
    Brep=ungroup,
    Settings={GridMaxCount=0, GridMinCount=16, JaggedSeams=False, MaxEdgeLength=0, MinEdgeLength=0.0001, MinTolerance=0, Refine=True, RefineAngle=0, RelativeTolerance=0.65, SimplePlanes=True, Tolerance=0})
mesh = ClusterOutput(mesh_brep)
