# Grasshopper definition robarch_assembly_design_exploration.gh (Grasshopper 1.0.7)
# plug-ins: Kangaroo2 Components, TetgenGH

# ----
# Tet Gen
number_slider = Slider(52, range=10..100)
construct_point = ConstructPoint(XCoordinate=number_slider, YCoordinate=number_slider, ZCoordinate=number_slider)
xy_plane = XYPlane(Origin=Point(0, 0, 0))
move = Move(Geometry=xy_plane, Motion=construct_point)  # -> Geometry, Transform
box_2pt = Box2Pt(PointA=xy_plane, PointB=move.Geometry, Plane=PlaneXY(0, 0, 0))
brep = Brep(box_2pt)
volume = Volume(Geometry=brep)  # -> Volume, Centroid
mesh_brep = MeshBrep(
    Brep=brep,
    Settings={GridMaxCount=0, GridMinCount=16, JaggedSeams=False, MaxEdgeLength=0, MinEdgeLength=0.0001, MinTolerance=0, Refine=True, RefineAngle=0, RelativeTolerance=0.65, SimplePlanes=True, Tolerance=0})
refine = Refine(Mesh=mesh_brep, Level=Slider(0, range=0..5))
triangulate = Triangulate(Mesh=refine)  # -> Mesh, Count
mesh = Mesh(triangulate.Mesh)
deconstruct_mesh = DeconstructMesh(Mesh=mesh)  # -> Vertices, simplify(graft(Faces)), Colours, Normals
mesh_edges = MeshEdges(Mesh=mesh)  # -> NakedEdges, InteriorEdges, NonManifoldEdges
output_type = ValueList({"List of tetra meshes": 0, "closed boundary mesh": 1, "Tree of tetra indices": 2, "Tree of edge indices": 3}, selected="Tree of tetra indices")
tetrahedralize = Tetrahedralize(Mesh=mesh, Flags=output_type, MinRatio=Slider(2, range=0.1..2))  # -> Mesh, Indices, Points
mesh_2 = Mesh(tetrahedralize.Mesh)
panel = Panel(mesh_2)
panel_2 = Panel(tetrahedralize.Indices)
point = Point(tetrahedralize.Points)
volume_2 = Volume(Geometry=mesh_2)  # -> Volume, Centroid
point_2 = Point(volume.Centroid)
point_3 = Point(volume_2.Centroid)
vector_2pt = Vector2Pt(PointA=point_2, PointB=point_3, Unitize=False)  # -> Vector, Length
mesh_3 = Mesh(mesh_2)
amplitude = Amplitude(Vector=vector_2pt.Vector, Amplitude=Slider(9.6, range=0..100))

# ---- group: tet gen
point_4 = Point([<point referenced from the Rhino model> x3])
point_5 = Point(<point referenced from the Rhino model>)
point_6 = Point([<point referenced from the Rhino model> x3])
point_7 = Point(<point referenced from the Rhino model>)
merge = Merge(Data1=point_4, Data2=point_5)
merge_2 = Merge(Data1=point_6, Data2=point_7)

point_8 = Point([<point referenced from the Rhino model> x3])
point_9 = Point([<point referenced from the Rhino model> x3])
point_10 = Point(<point referenced from the Rhino model>)
point_11 = Point([<point referenced from the Rhino model> x3])
point_12 = Point(<point referenced from the Rhino model>)
point_13 = Point(<point referenced from the Rhino model>)
point_14 = Point(<point referenced from the Rhino model>)
point_15 = Point([<point referenced from the Rhino model> x3])
merge_3 = Merge(Data1=point_9, Data2=point_10)
merge_4 = Merge(Data1=point_11, Data2=point_12)
merge_5 = Merge(Data1=point_8, Data2=point_13)
merge_6 = Merge(Data1=point_15, Data2=point_14)
entwine = Entwine(
    Branch0X=merge_6,
    Branch1X=merge_5,
    Branch2X=merge,
    Branch3X=merge_2,
    Branch4X=merge_4,
    Branch5X=merge_3,
    FlattenInputs=False)  # -> simplify(Result)

# ----
point_16 = Point(<point referenced from the Rhino model>)
point_17 = Point(<point referenced from the Rhino model>)
point_18 = Point([<point referenced from the Rhino model> x3])
point_19 = Point([<point referenced from the Rhino model> x3])
point_20 = Point(<point referenced from the Rhino model>)
point_21 = Point(<point referenced from the Rhino model>)
point_22 = Point(<point referenced from the Rhino model>)
point_23 = Point([<point referenced from the Rhino model> x3])
point_24 = Point([<point referenced from the Rhino model> x3])
point_25 = Point([<point referenced from the Rhino model> x3])
merge_7 = Merge(Data1=point_18, Data2=point_16)
merge_8 = Merge(Data1=point_24, Data2=point_22)
merge_9 = Merge(Data1=point_19, Data2=point_17)
merge_10 = Merge(Data1=point_23, Data2=point_20)
merge_11 = Merge(Data1=point_25, Data2=point_21)
entwine_2 = Entwine(Branch0X=merge_9, Branch1X=merge_7, Branch2X=merge_10, Branch3X=merge_8, Branch4X=merge_11, FlattenInputs=False)  # -> simplify(Result)

cluster = Cluster_3(list=merge_11)  # -> pipe_3, pipe_4

# ---- group: new base triangle
custom_preview = CustomPreview(Geometry=cluster.pipe_3, Shader=ColourSwatch(SwatchColor=RGBA(242, 255, 0, 168)))

# ---- group: new vertex
custom_preview_2 = CustomPreview(Geometry=cluster.pipe_4, Shader=ColourSwatch(SwatchColor=RGBA(255, 0, 204, 168)))

# ----
point_26 = Point(entwine_2)
point_27 = Point([Point(52, 0, 0), Point(52, 52, 0), Point(52, 52, 52), Point(0, 52, 52), Point(0, 52, 0), Point(0, 0, 0), Point(52, 0, 52), Point(0, 0, 52)])
two_cubes = Point([Point(52, 0, 0), Point(52, 52, 0), Point(52, 52, 52), Point(0, 52, 52), Point(0, 52, 0), Point(0, 0, 0), Point(52, 0, 52), Point(0, 0, 52), Point(104, 0, 0), Point(104, 52, 0), Point(104, 52, 52), Point(104, 0, 52)])

# ----
# YJ's simple 3 bar
point_28 = Point([Point(280.2906275, -12.24255157, 136.472037), Point(216.2004131, -60.84433544, 48.28341594), Point(288.0668457, 71.76692778, 48.28341594), Point(366.2004131, -60.84433544, 48.28341594)])

# ----
# Yijiang's 12 bar feasible design
point_29 = Point([Point(200.0999806, -36.03747471, 48.28341594), Point(353.0353916, -18.67770667, 48.28341594), Point(261.1829916, 100.9620354, 48.28341594), Point(253.6286279, -26.40318888, 117.6169489), Point(253.7142349, 61.57939256, 131.9623201), Point(311.6618785, 43.28816029, 108.9936051)])

ordering_heuristic = ValueList({"dijkstra", "list_order", "point2triangle_distance", "tet_surface_area", "tet_volume"}, selected="list_order")
search_method = ValueList({"point2point", "point2triangle"}, selected="point2point")
# Not every triple pair has a built triangle!
clean_tree = CleanTree(RemoveNulls=True, RemoveInvalid=True, RemoveEmpty=True, Tree=point_26)
point_30 = Point(two_cubes)
point_31 = Point([Point(52, 0, 0), Point(0, 52, 0), Point(0, 0, 0)])

move_2 = Move(Geometry=mesh_3, Motion=amplitude)  # -> Geometry, Transform
mesh_edges_2 = MeshEdges(Mesh=move_2.Geometry)  # -> NakedEdges, InteriorEdges, NonManifoldEdges

# ----
# Shortest Distance
# Method
ghpython_script = GhPythonScript(
    points=two_cubes,
    base_tri_pts=point_31,
    ordering_heuristic=ordering_heuristic,
    search_method=search_method,
    penalty_cost=Slider(2.2, range=1..10))  # -> out, tet_node_ids; inputs points: list of Point3d, base_tri_pts: list of Point3d
# ---------- ghpython_script: Python ----------
from itertools import combinations

import System
import Grasshopper.Kernel.Data.GH_Path as ghpath
import Grasshopper.DataTree as datatree
from ghpythonlib.treehelpers import list_to_tree, tree_to_list

from compas.geometry import distance_point_point, is_coplanar
from compas_ghpython import unload_modules
unload_modules("coop_assembly")

from coop_assembly.help_functions import find_point_id, tet_surface_area, \
    tet_volume, distance_point_triangle
from coop_assembly.geometry_generation.tet_sequencing import \
    compute_distance_from_grounded_node
from coop_assembly.geometry_generation.tet_sequencing import \
    get_pt2tri_search_heuristic_fn, \
    point2point_shortest_distance_tet_sequencing, \
    point2triangle_tet_sequencing

start_tri_ids = [find_point_id(base_pt, points) for base_pt in base_tri_pts]
assert len(start_tri_ids) == 3, 'start triangle should only have three points!'
print('base triangle ids: {}'.format(start_tri_ids))

all_pt_ids = list(range(len(points)))

if search_method == 'point2point':
    cost_from_node = {}
    if ordering_heuristic == 'dijkstra':
        elements = list(combinations(all_pt_ids, 2))
        cost_from_node = compute_distance_from_grounded_node(elements, points, start_tri_ids)
    elif ordering_heuristic == 'list_order':
        for pt_id in all_pt_ids:
            if pt_id in start_tri_ids:
                cost_from_node[pt_id] = 0
            else:
                # just shift by 1 to distinguish index 0 from the grounded ones
                cost_from_node[pt_id] = pt_id
    else:
        raise NotImplementedError('ordering heuristic not implemented!')
    
    print('cost_from_node: {}'.format(cost_from_node))
    
    tet_node_ids = point2point_shortest_distance_tet_sequencing(points, cost_from_node)
elif search_method == 'point2triangle':
    heuristic_fn = None
    penalty_cost = penalty_cost or 2.0
    heuristic_fn = get_pt2tri_search_heuristic_fn(points, penalty_cost, ordering_heuristic)
    tet_node_ids = point2triangle_tet_sequencing(
        points, start_tri_ids, heuristic_fn=heuristic_fn, verbose=True)
else:
    raise NotImplementedError('search method not implemented!')

tet_node_ids = list_to_tree([tet_ids+[pt_id] for tet_ids, pt_id in tet_node_ids])
# ---------- end ghpython_script ----------

tet_id = Slider(3, range=0..10)

check_collision = BooleanToggle(True)
correct = BooleanToggle(True)

# ----
# Hand-picked tet sequence
ghpython_script_2 = GhPythonScript(selected_pts=clean_tree, pts=point_30)  # -> out, tet_ids; inputs selected_pts: tree of Point3d, pts: list of Point3d
# ---------- ghpython_script_2: Python ----------
import rhinoscriptsyntax as rs
import Rhino.Geometry.Plane as Plane
import Rhino.Geometry.Point3d as Point3d
import Rhino.Geometry.Vector3d as Vector3d
import Rhino.Geometry.Quaternion as Quat
import Grasshopper.DataTree as DataTree # Add, AddRange(list, GHPath(i, j))
import Grasshopper.Kernel.Data.GH_Path as GHPath
import System

from ghpythonlib.treehelpers import list_to_tree, tree_to_list

#import json
#from compas.geometry import Frame
#from compas_ghpython import draw_pipes, draw_frame
from collections import defaultdict
from itertools import combinations

TOL = 1e-4
def find_id(query_pt, pts):
    ids = []
    for id, pt in enumerate(pts):
        if query_pt.DistanceTo(pt) < TOL:
            ids.append(id)
    assert len(ids) == 1, 'duplicated pts!'
    return ids[0]

tet_ids = []

if selected_pts and pts:
    selected_pts = tree_to_list(selected_pts)
    old_tet_ids = [set([find_id(old_pt, pts) for old_pt in selected_pts[0][0:3]])]
    
    for tet_pts in selected_pts:
        old_pts = tet_pts[0:3]
        new_pt = tet_pts[3]
        old_ids = [find_id(old_pt, pts) for old_pt in old_pts]
        new_id = find_id(new_pt, pts)
        assert set(old_ids) in old_tet_ids, 'triangle not found in previous nodes!'
        tet_ids.append(old_ids + [new_id])
        
        for old_pair in combinations(old_ids, 2):
            new_tri = list(old_pair) + [new_id]
#            assert set(new_tri) not in old_tet_ids, 'newly added triangle found in previous ones!'
            if set(new_tri) not in old_tet_ids:
                old_tet_ids.append(set(new_tri))

tet_ids = list_to_tree(tet_ids)
# ---------- end ghpython_script_2 ----------

panel_3 = Panel(ghpython_script.out)
panel_4 = Panel(ghpython_script.tet_node_ids)

# ---- group: to coop_assembly
integer = Integer(ghpython_script.tet_node_ids)

# ---- group: abstract data structure visualization
integer_2 = Integer(ghpython_script.tet_node_ids)

# ----
# Bar Radius
ideal_radius = Slider(3.17, range=0.01..10)

# ----
# Bar Visualization
# and Planning
# 1/4 inch OD rod, 3.175 mm radius
restart_proxy = BooleanToggle(False)
panel_5 = Panel("pythonw")
ghpython_script_3 = PythonScript(
    points=two_cubes,
    tet_point_ids=integer,
    radius=ideal_radius,
    run=Toggle(True),
    use_rpc=Toggle(False),
    restart_proxy=restart_proxy,
    python_path="python",
    correct=correct,
    check_collision=check_collision)  # -> out, pts_netw, lns_netw, pts_inv, lns_inv, o_st, b_st; inputs points: list of Point3d, tet_point_ids: tree of Int32, base_tri_pts: list of Point3d, use_rpc: Boolean, check_collision: Boolean
# ---------- ghpython_script_3: Python ----------
import warnings
import System
import Grasshopper.Kernel.Data.GH_Path as ghpath
import Grasshopper.DataTree as datatree
from ghpythonlib.treehelpers import tree_to_list

from compas_ghpython import unload_modules
unload_modules("coop_assembly")

if use_rpc:
    from compas.rpc import Proxy
    geo_gen_execute = Proxy('coop_assembly.geometry_generation.execute', python=python_path, url='http://127.0.0.1')
    if restart_proxy:
        geo_gen_execute.stop_server()
        geo_gen_execute.start_server()
else:
    from coop_assembly.geometry_generation.execute import xfunc_execute_from_points

from compas.geometry import distance_point_point
from compas_ghpython.utilities import draw_network
from compas.datastructures.network import Network
from coop_assembly.help_functions.drawing import draw_network_inv_gh

tet_point_ids = tree_to_list(tet_point_ids, lambda x: x)
tet_ids = [[tuple(t_ids[0:3]), t_ids[3]] for t_ids in tet_point_ids]
print('tet_ids: {}'.format(tet_ids))

run = run and not (len(tet_point_ids)==0 or tet_point_ids is None or len(points)==0 or points is None)

points = [(p[0], p[1], p[2]) for p in points]

if run:
    if not use_rpc:
        # xfunc call
        b_st_data, o_st_data = xfunc_execute_from_points(points, tet_ids, radius, \
            correct=correct, check_collision=check_collision)
    else:
        # rpc proxy call
        b_st_data, o_st_data = geo_gen_execute.execute_from_points(points, \
            tet_ids, radius, correct=correct, check_collision=check_collision)
    
    o_st = Network.from_data(o_st_data)
    b_st = Network.from_data(b_st_data)
    o_st.struct_bar = b_st
    
    pts_new, lns_netw = draw_network(o_st)
    pts_inv, lns_inv, lns_conn  = draw_network_inv_gh(b_st)
# ---------- end ghpython_script_3 ----------
curve = Curve(ghpython_script_3.lns_inv)
bar_picker = Slider(0, range=0..20)
pipe = Pipe(Curve=curve, Radius=ideal_radius, Caps=0)  # -> flatten(Pipe)
panel_6 = Panel(ghpython_script_3.out)
brep_2 = Brep(pipe)
list_item = ListItem(List=brep_2, Index=bar_picker, Wrap=False)
custom_preview_3 = CustomPreview(Geometry=brep_2, Shader=ColourSwatch(SwatchColor=RGBA(99, 247, 237, 168)))
custom_preview_4 = CustomPreview(Geometry=list_item, Shader=ColourSwatch(SwatchColor=RGBA(255, 0, 0, 168)))

# ----
# Robotic setup brep
# (to show the scale)
brep_3 = Brep([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])

# ----
# Plane Planning
customized_sequence = Panel("""3
4
5
8
6
7
9
10
11
12
13
14""")
integer_3 = Integer()
ghpython_script_4 = GhPythonScript(
    o_struct=ghpython_script_3.o_st,
    b_struct=ghpython_script_3.b_st,
    nb_rot=Slider(4, range=2..50),
    nb_trans=Slider(4, range=2..50),
    flip=Toggle(False),
    offset_d1=Slider(20, range=0..100),
    offset_d2=Slider(20, range=0..100),
    customized_seq=integer_3)  # -> out, planes, planes_offset, simplify(planes_out), planes_out_offset, sequeneced_element_ids; inputs nb_rot: Int32, nb_trans: Int32, flip: Boolean, customized_seq: list of Int32
# ---------- ghpython_script_4: Python ----------
from compas_ghpython import unload_modules
import coop_assembly
unload_modules("coop_assembly")
from coop_assembly.assembly_info_generation.fabrication_planes import calculate_gripping_plane, calculate_offset, calculate_offsets_all

import Rhino.Geometry as rg
from ghpythonlib.treehelpers import list_to_tree


#from coop_assembly.assembly_info_generation.fabrication_planes import calculate_gripping_plane, calculate_offset

run = o_struct and b_struct

if run:
    if customized_seq:
        seq = [0,1,2] + customized_seq
    else:
        seq = [v for v in b_struct.vertex]
    
    print seq
    
    for v in b_struct.vertex:
        calculate_gripping_plane(b_struct, v, b_struct.vertex[v]["mean_point"], nb_rot=nb_rot, nb_trans=nb_trans, planes_flip=flip)
        calculate_offset(o_struct, b_struct, v, offset_d1, offset_d2, seq)
        calculate_offsets_all(o_struct, b_struct, v, offset_d1, offset_d2, seq)
    
    
    planes = []
    for v in b_struct.vertex:
        gp = b_struct.vertex[v]["gripping_plane"]
        pl = rg.Plane(rg.Point3d(gp[0][0], gp[0][1],gp[0][2]), rg.Vector3d(gp[1][0], gp[1][1],gp[1][2]), rg.Vector3d(gp[2][0], gp[2][1],gp[2][2]))
        planes.append(pl)
    
    planes_all = []
    for i,v in enumerate(b_struct.vertex):
        gp_all = b_struct.vertex[v]["gripping_planes_all"]
        planes_all.append([])
        for gp in gp_all:
            pl = rg.Plane(rg.Point3d(gp[0][0], gp[0][1],gp[0][2]), rg.Vector3d(gp[1][0], gp[1][1],gp[1][2]), rg.Vector3d(gp[2][0], gp[2][1],gp[2][2]))
            planes_all[i].append(pl)
    
    planes_offset = []
    for v in b_struct.vertex:
        gp = b_struct.vertex[v]["gripping_plane_offset"]
        pl = rg.Plane(rg.Point3d(gp[0][0], gp[0][1],gp[0][2]), rg.Vector3d(gp[1][0], gp[1][1],gp[1][2]), rg.Vector3d(gp[2][0], gp[2][1],gp[2][2]))
        planes_offset.append(pl)
    
    planes_offset_all = []
    for i,v in enumerate(b_struct.vertex):
        gp_all = b_struct.vertex[v]["gripping_planes_offset_all"]
        planes_offset_all.append([])
        for gp in gp_all:
            pl = rg.Plane(rg.Point3d(gp[0][0], gp[0][1],gp[0][2]), rg.Vector3d(gp[1][0], gp[1][1],gp[1][2]), rg.Vector3d(gp[2][0], gp[2][1],gp[2][2]))
            planes_offset_all[i].append(pl)
    
    planes_out = list_to_tree(planes_all)
    planes_out_offset = list_to_tree(planes_offset_all)
    sequeneced_element_ids = seq
# ---------- end ghpython_script_4 ----------
panel_7 = Panel(ghpython_script_4.out)
plane = Plane(simplify(ghpython_script_4.planes_out))
plane_2 = Plane(simplify(ghpython_script_4.planes_out_offset))
pln = Plane(ghpython_script_4.planes)
pln_2 = Plane(ghpython_script_4.planes_offset)
integer_4 = Integer(ghpython_script_4.sequeneced_element_ids)
cluster_2 = Cluster_2(plane=plane_2)

integer_5 = Integer(integer_2)
panel_8 = Panel(integer_5)
integer_6 = Integer(integer_5)
tree_statistics = TreeStatistics(Tree=integer_6)  # -> Paths, Length, Count
unit_x = UnitX(Factor=Slider(208, range=-400..400))
split_list = SplitList(List=tree_statistics.Paths, Index=tet_id)  # -> ListA, ListB
list_item_2 = ListItem(List=tree_statistics.Paths, Index=tet_id, Wrap=False)
list_item_3 = ListItem(List=integer_6, Index=0, Wrap=True)  # -> Item1, Item
move_3 = Move(Geometry=brep_2, Motion=unit_x)  # -> Geometry, Transform
addition = Addition(A=tet_id, B="1")
split_tree = SplitTree(Data=integer_6, Masks=flatten(split_list.ListA))  # -> Positive, Negative
tree_branch = TreeBranch(Tree=integer_6, Path=list_item_2, MaintainPaths=True)
point_32 = Point(point_30)
number_slider_2 = Slider(2, range=0..2)
see_offseted_bar = BooleanToggle(False)
multiplication = Multiplication(A=addition, B="3")
panel_9 = Panel("""0
1
2""")
original_bars = Brep(move_3.Geometry)
plane_3 = Plane(pln)
plane_4 = Plane(pln_2)
list_item_4 = ListItem(List=point_32, Index=tree_branch, Wrap=False)
list_item_5 = ListItem(List=point_32, Index=split_tree.Positive, Wrap=False)

# ---- group: offseted bars
orient = Orient(Geometry=original_bars, Source=plane_3, Target=plane_4)  # -> Geometry, Transform

# ----
# TCP Transformation
cluster_3 = Cluster_2(plane=plane)

cluster_4 = Cluster(list=list_item_4)  # -> polyline_2, item_3, line_2
cluster_5 = Cluster(list=list_item_5)  # -> polyline_2, item_3, line_2
addition_2 = Addition(A=multiplication, B=panel_9)
integer_7 = Integer(flatten(list_item_3.Item1))
split_list_2 = SplitList(List=original_bars, Index=addition_2)  # -> ListA, ListB
list_item_6 = ListItem(List=orient.Geometry, Index=addition_2, Wrap=False)
list_length = ListLength(List=integer_7)
list_item_7 = ListItem(List=original_bars, Index=addition_2, Wrap=False)
curve_2 = Curve(cluster_4.line_2)
curve_3 = Curve([cluster_5.line_2, cluster_5.polyline_2])
series = Series(Start=0, Step=1, Count=list_length)
brep_4 = Brep(split_list_2.ListA)
pipe_2 = Pipe(Curve=cluster_4.polyline_2, Radius=1, Caps=0)
pipe_3 = Pipe(Curve=curve_2, Radius=1, Caps=0)
list_item_8 = ListItem(List=point_32, Index=integer_7, Wrap=True)
pipe_4 = Pipe(Curve=curve_3, Radius=0.5, Caps=0)
stream_filter = StreamFilter(Gate=see_offseted_bar, Stream1=list_item_6)

# ---- group: target bar
custom_preview_5 = CustomPreview(Geometry=list_item_7, Shader=ColourSwatch(SwatchColor=RGBA(42, 255, 0, 168)))

# ---- group: existing tets
custom_preview_6 = CustomPreview(Geometry=pipe_4, Shader=ColourSwatch(SwatchColor=RGBA(107, 107, 107, 168)))

# ---- group: new base triangle
custom_preview_7 = CustomPreview(Geometry=pipe_2, Shader=ColourSwatch(SwatchColor=RGBA(99, 247, 237, 168)))

# ---- group: new vertex
custom_preview_8 = CustomPreview(Geometry=pipe_3, Shader=ColourSwatch(SwatchColor=RGBA(124, 255, 0, 168)))

# ---- group: previously assembled bars
custom_preview_9 = CustomPreview(Geometry=brep_4, Shader=ColourSwatch(SwatchColor=RGBA(77, 87, 86, 168)))

# ---- group: offsetted bar
custom_preview_10 = CustomPreview(Geometry=stream_filter, Shader=ColourSwatch(SwatchColor=RGBA(60, 0, 255, 168)))

# ----
text_tag_3d = TextTag3D(
    Location=list_item_8,
    Text=series,
    Size=Slider(10, range=1..10),
    Colour=ColourSwatch(SwatchColor=RGBA(0, 0, 0, 168)),
    Justification=7)

# ==== cluster Cluster
list = ClusterInput()
list_item = ListItem(List=list, Index=0, Wrap=True)  # -> Item, Item1, Item2, Item3
merge = Merge(Data1=list_item.Item, Data2=list_item.Item1, Data3=list_item.Item2)
item_3 = ClusterOutput(list_item.Item3)
line = Line(StartPoint=merge, EndPoint=list_item.Item3)
polyline = PolyLine(Vertices=merge, Closed=True)
line_2 = ClusterOutput(line)
polyline_2 = ClusterOutput(polyline)

# ==== cluster Cluster_2
plane = ClusterInput()

# ---- group: gripping plane generation
plane_2 = Plane(simplify(plane))

# ----
deconstruct_plane = DeconstructPlane(Plane=plane_2)  # -> Origin, XAxis, YAxis, ZAxis
negative = Negative(Value=deconstruct_plane.ZAxis)
construct_plane = ConstructPlane(Origin=deconstruct_plane.Origin, XAxis=deconstruct_plane.YAxis, YAxis=negative)
plane_3 = ClusterOutput(construct_plane)

# ==== cluster Cluster_3
list = ClusterInput()
cluster = Cluster(list=list)  # -> polyline_2, item_3, line_2
curve = Curve(cluster.line_2)
pipe = Pipe(Curve=cluster.polyline_2, Radius=1, Caps=0)
pipe_2 = Pipe(Curve=curve, Radius=1, Caps=0)
pipe_3 = ClusterOutput(pipe)
pipe_4 = ClusterOutput(pipe_2)
