# Grasshopper definition 190906_DesignAndAssembly_stefana.gh (Grasshopper 1.0.7)

# ----
# 1.
# --> Set your IP address
# --> Set robot IP address
server_address = ValueList({"192.168.10.1", "192.168.10.2", "192.168.10.3", "192.168.10.20", "127.0.0.1"}, selected="192.168.10.20")
# Settings
ur_ip1 = ValueList({"192.168.10.10", "192.168.10.11", "192.168.10.12", "127.0.0.1"}, selected="192.168.10.10")
server_port = Integer(30003)
globals = PythonScript(server_address=server_address, server_port=server_port, ur_ip1=ur_ip1)  # inputs server_port: Int32
# ---------- globals: Python ----------
from scriptcontext import sticky as st

st["server_address"] = server_address
st["server_port"] = server_port

st["ur_ip1"] = ur_ip1
print st["ur_ip1"]
# ---------- end globals ----------

# ----
# Check if UR is available
ping = Button()
py = PythonScript(ip=ur_ip1, ping=ping)  # -> out, trigger
# ---------- py: Python ----------
from scriptcontext import sticky as st
from ur_online_control.communication import is_available

#print ip
guid = str(ghenv.Component.InstanceGuid)
txt_key = "txt_" + guid
if txt_key not in st:
    st[txt_key] = ""

if ping:
    
    available = is_available(ip)
    
    if available:
        st[txt_key] = "%s is up!" % ip
        trigger = True
    else:
        st[txt_key] = "%s is down!" % ip
        trigger = False

print st[txt_key]
# ---------- end py ----------
panel = Panel(py.out)

# ----
# 1.
# --> Set your IP address
# --> Set robot IP address
server_address_2 = ValueList({"192.168.10.1", "192.168.10.2", "192.168.10.3", "127.0.0.1"}, selected="192.168.10.1")
# Settings
ur_ip2 = ValueList({"192.168.10.10", "192.168.10.11", "192.168.10.12", "127.0.0.1"}, selected="192.168.10.11")
server_port_2 = Integer(30003)
globals_2 = PythonScript(server_address=server_address_2, server_port=server_port_2, ur_ip2=ur_ip2)  # inputs server_port: Int32
# ---------- globals_2: Python ----------
from scriptcontext import sticky as st

st["server_address"] = server_address
st["server_port"] = server_port

st["ur_ip2"] = ur_ip2
print st["ur_ip2"]
# ---------- end globals_2 ----------

python = GhPythonScript()  # -> out, joint_traj_dict
# ---------- python: Python ----------
import json

with open('choreo_result.json') as json_file:
    data = json.load(json_file)
    print data

joint_traj_dict = data
# ---------- end python ----------

bang = Button()
panel_2 = Panel("Unload libraries")
unload = PythonScript(bang=bang)
# ---------- unload: Python ----------
from compas_ghpython import unload_modules

unload_modules("compas")
unload_modules("ur_online_control")
unload_modules("ffw_2018")
# ---------- end unload ----------

pt = Point(<point referenced from the Rhino model>)
crv = Curve(<curve referenced from the Rhino model>)

# ----
# Check if UR is available
ping_2 = Button()
py_2 = PythonScript(ip=ur_ip2, ping=ping_2)  # -> out, trigger
# ---------- py_2: Python ----------
from scriptcontext import sticky as st
from ur_online_control.communication import is_available


guid = str(ghenv.Component.InstanceGuid)
txt_key = "txt_" + guid
if txt_key not in st:
    st[txt_key] = ""

if ping:
    
    available = is_available(ip)
    
    if available:
        st[txt_key] = "%s is up!" % ip
        trigger = True
    else:
        st[txt_key] = "%s is down!" % ip
        trigger = False

print st[txt_key]
# ---------- end py_2 ----------
panel_3 = Panel(py_2.out)

crv_2 = Curve(<curve referenced from the Rhino model>)
number_slider = Slider(7.5, range=0..50)

point = Point([<point referenced from the Rhino model> x4])
list_item = ListItem(List=point, Index=Slider(0, range=0..11), Wrap=True)
ghpython_script = PythonScript(points=point, r=number_slider, run=Toggle(True), use_rpc=Toggle(True), restart_rpc_server=Toggle(False))  # -> out, pts_netw, lns_netw, pts_inv, lns_inv, o_st, b_st; inputs points: list of Point3d, use_rpc: Boolean, restart_rpc_server: Boolean
# ---------- ghpython_script: Python ----------
from compas_ghpython import unload_modules
unload_modules("coop_assembly")

if use_rpc:
    from compas.rpc import Proxy
    geo_gen_execute = Proxy('coop_assembly.geometry_generation.execute')
    if restart_rpc_server:
        geo_gen_execute.stop_server()
        geo_gen_execute.start_server()

from compas.geometry import distance_point_point
from compas_ghpython.utilities import draw_network
from compas.datastructures.network import Network
from coop_assembly.geometry_generation.main import main_gh_simple
from coop_assembly.help_functions.drawing import draw_network_inv_gh

dict_nodes = {}

for i, p in enumerate(points):
    if i > 2:
        nodes       = points[0:i]
        dists       = [distance_point_point(points[i], n) for n in nodes]
        nodes_inds  = [j for y,j in sorted(zip(dists,range(0,i)))] 
        nodes_fin = nodes_inds[0:3]
        
        dict_nodes[str(i)]= nodes_fin

points = [(p[0], p[1], p[2]) for p in points]

supports_bars = [(0,1), (1,2), (2,0)]
supports_nodes = [0, 1, 2, 4]
load_bars = [(4,5)]

load = (0,0,-2000)

if run:
    print("about to run in ghpython")
    if not use_rpc:
        # xfunc call
        b_st_data, o_st_data = main_gh_simple(points, dict_nodes, r, \
            supports_nodes, supports_bars, load_bars, load, correct=False)
    else:
        b_st_data, o_st_data = geo_gen_execute.execute_from_points(
            points, dict_nodes, r, support_nodes=supports_nodes,
            support_bars=supports_bars, load_bars=load_bars, load=load, correct=False)
    
    o_st = Network.from_data(o_st_data)
    b_st = Network.from_data(b_st_data)
    
    pts_new, lns_netw = draw_network(o_st)
    pts_inv, lns_inv, lns_conn  = draw_network_inv_gh(b_st)
# ---------- end ghpython_script ----------

pl = ConstructPlane(Origin=pt, XAxis=crv_2, YAxis=crv)
python_2 = GhPythonScript(joint_traj_dict=python.joint_traj_dict)  # -> out, list_joints_val, gripper_ctrl
# ---------- python_2: Python ----------
#print joint_traj_dict

len_pick_approach = len(joint_traj_dict["pick_approach"]["points"])
len_pick_retreat = len(joint_traj_dict["pick_retreat"]["points"])
len_pick2place = len(joint_traj_dict["pick2place"]["points"])
len_place_approach = len(joint_traj_dict["place_approach"]["points"])
len_place_retreat = len(joint_traj_dict["place_retreat"]["points"])
len_place2pick = len(joint_traj_dict["place2pick"]["points"])

list_joints_val = []

pts_pick_approach = joint_traj_dict["pick_approach"]["points"]
for p in pts_pick_approach:
    vals = p["values"]
    list_joints_val.append(vals)

pts_pick_retreat = joint_traj_dict["pick_retreat"]["points"]
for p in pts_pick_retreat:
    vals = p["values"]
    list_joints_val.append(vals)
    
pts_pick2place = joint_traj_dict["pick2place"]["points"]
for p in pts_pick2place:
    vals = p["values"]
    list_joints_val.append(vals)
    
pts_place_approach = joint_traj_dict["place_approach"]["points"]
for p in pts_place_approach:
    vals = p["values"]
    list_joints_val.append(vals)
    
pts_place_retreat = joint_traj_dict["place_retreat"]["points"]
for p in pts_place_retreat:
    vals = p["values"]
    list_joints_val.append(vals)
    
pts_place2pick = joint_traj_dict["place2pick"]["points"]
for p in pts_place2pick:
    vals = p["values"]
    list_joints_val.append(vals)
    
print(len_pick_approach+len_pick_retreat+len_pick2place+len_place_approach+len_place_retreat+len_place2pick)
print len(list_joints_val)

nb0 = 0
nb1 = len_pick_approach
nb2 = len_pick_approach + len_pick_retreat + len_pick2place + len_place_approach 

gripper_ctrl = [nb0, nb1, nb2]
# ---------- end python_2 ----------
list = ValueList({"no_tool": 0, "measurement_tool": 1, "sand_deposition_tool": 2, "earth_deposition_tool": 3, "clay_subtraction_tool": 4, "pack_tool": 5, "arch_2019july_tool3A": 6, "arch_2019july_tool3B": 7, "vault_test2_A": 8, "vault_test2_B": 9, "vault_test2_Measure": 10}, selected="vault_test2_A")
list_2 = ValueList({"robot 1": "robot_1", "robot 2": "robot_2", "robot 3": "robot_3", "archTest_robot_2", "robot_1/2", "robot_2/2", "robot_1/2_adjust", "robot_2/2_adjust"}, selected="robot_1/2_adjust")
python_3 = GhPythonScript()  # -> out, joint_vals
# ---------- python_3: Python ----------
joint_vals = [[0,0,0,0,0,0], [10,10,10,10,10,10]]
# ---------- end python_3 ----------
pt_2 = Point(<point referenced from the Rhino model>)
crv_3 = Curve(<curve referenced from the Rhino model>)
crv_4 = Curve(<curve referenced from the Rhino model>)
pln = Plane(pl)

bang_2 = Button()
unload_2 = PythonScript(bang=bang_2)  # same code as unload

pl_2 = ConstructPlane(Origin=pt_2, XAxis=crv_4, YAxis=crv_3)
base = PythonScript(rnum=list_2)  # -> base_frame
# ---------- base: Python ----------
from compas.geometry import Frame
#from compas.geometry import Transformation, Rotation
#from compas_ghpython import xdraw_frame
#import math
#import Rhino.Geometry as rg




# for robots 1 and 2


if rnum == "robot_1":
    origin = [0.0, 0.0, 0.0]
    xaxis = [0.5, 0.0, 0.0]
    yaxis = [0.0, 0.5, 0.0]

#if rnum == "robot_1":
#    origin = [-468.74, -100.60, 161.23]
#    xaxis = [0.71376, 0.70037, 0.00520]
#    yaxis = [-0.70037, 0.71364, 0.01408]
#    

if rnum == "robot_2":
    origin = [-468.74, -100.60, 161.23]
    xaxis = [0.71376, 0.70037, 0.00520]
    yaxis = [-0.70037, 0.71364, 0.01408]


if rnum == "robot_3":
    origin = [-110.14, 465.76, 167.41]
    xaxis = [0.71228, -0.70189, -0.00042]
    yaxis = [0.70182, 0.71220, 0.01506]

if rnum == "archTest_robot_2":
    origin = [0.0, -863.6, 0.0]
#    origin = [863.6, 0.0, 0.0]
#    xaxis = [-0.5, 0, 0]
#    yaxis = [0, -0.5, 0]
    xaxis = [0.0, 0.5, 0.0]
    yaxis = [-0.5, 0.0, 0.0]
#    

if rnum == "robot_1/2":
    origin = [0.94, -433.95, 21.84]
    xaxis = [-0.01817, -0.99982, 0.00520]
    yaxis = [0.99980, -0.01813, 0.00837]

if rnum == "robot_2/2":
    origin = [-4.67, -430.58, 20.93]
    xaxis = [0.01186, 0.99984, -0.01342]
    yaxis = [-0.99993, 0.01186, -0.00009]

#if rnum == "robot_1/2_adjust":
#    # 18.4+9.057 = 27.457
#    origin = [0.0, -431.8, 27.457]
#    xaxis = [0.0, -1.0, 0.0]
#    yaxis = [1.0, 0.0, 0.0]

#============hand tune==============
if rnum == "robot_1/2_adjust":
    # 18.4+9.057 = 27.457
    origin = [0.0, -431.8, 27.457]
    xaxis = [0.0, -0.990342, -0.138648]
    yaxis = [1.0, 0.00, 0.0]


#
##----------------Robot1 FineTune Test1-----------------------
#if rnum == "robot_1/2_adjust":
#
#    origin = [2.918599, -431.57083, 24.13319]
#    xaxis = [-0.005003, -0.999956, 0.007914]
#    yaxis = [0.999987, -0.005003, 0.0]
##    
##----------------Robot1 FineTune Test_further-----------------------
#if rnum == "robot_1/2_adjust":
#
#    origin = [2, -431.57083, 24.13319]
#    xaxis = [-0.005003, -0.999956, 0.0]
#    yaxis = [0.999987, -0.005003, 0.0]

#if rnum == "robot_1/2_adjust":
#    # 18.4+9.057 = 27.457
#    #origin = [0.0, -431.8, 27.457]
#    origin = [(0.0+3.29), (-431.8+0.305), (27.457+3.16)]
#    xaxis = [0.004308, -0.999955, -0.008393]
#    yaxis = [0.995332, 0.005097, -0.096381]

#if rnum == "robot_1/2_adjust":
#    # 18.4+9.057 = 27.457
#    #origin = [0.0, -431.8, 27.457]
#    origin = [(0.0+3.29), (-431.8+0.305), (27.457+3.16)]
#    xaxis = [0.004308, -0.999955, -0.008393]
#    yaxis = [0.995332, 0.005097, 0.0]

#if rnum == "robot_1/2_adjust":
#    # 18.4+9.057 = 27.457
#    #origin = [0.0, -431.8, 27.457]
#    origin = [(0.0+3.29), (-431.8+0.305), (27.457+3.16)]
#    xaxis = [0.0-0.007668, -1.0-0.008534, 0.0-0.004074]
    yaxis = [1.0+0.008967, 0.0-0.001773, 0.0-0.010964]

if rnum == "robot_2/2_adjust":
    origin = [0.0, -431.8, 27.457]
    xaxis = [0.0, 1.0, 0.0]
    yaxis = [-1.0, 0.0, 0.0]

base_frame = Frame(list(origin), list(xaxis), list(yaxis))
print base_frame
# ---------- end base ----------
# Here, you can set the basis for your robot
base_2 = PythonScript(rnum=list_2)  # -> base_frame
# ---------- base_2: Python ----------
from compas.geometry import Frame
#from compas.geometry import Transformation, Rotation
#from compas_ghpython import xdraw_frame
#import math
#import Rhino.Geometry as rg




# for robots 1 and 2


if rnum == "robot_1":
    origin = [0.0, 0.0, 0.0]
    xaxis = [0.5, 0.0, 0.0]
    yaxis = [0.0, 0.5, 0.0]

#if rnum == "robot_1":
#    origin = [-468.74, -100.60, 161.23]
#    xaxis = [0.71376, 0.70037, 0.00520]
#    yaxis = [-0.70037, 0.71364, 0.01408]
#    

if rnum == "robot_2":
    origin = [-468.74, -100.60, 161.23]
    xaxis = [0.71376, 0.70037, 0.00520]
    yaxis = [-0.70037, 0.71364, 0.01408]


if rnum == "robot_3":
    origin = [-110.14, 465.76, 167.41]
    xaxis = [0.71228, -0.70189, -0.00042]
    yaxis = [0.70182, 0.71220, 0.01506]

if rnum == "archTest_robot_2":
    origin = [0.0, -863.6, 0.0]
#    origin = [863.6, 0.0, 0.0]
#    xaxis = [-0.5, 0, 0]
#    yaxis = [0, -0.5, 0]
    xaxis = [0.0, 0.5, 0.0]
    yaxis = [-0.5, 0.0, 0.0]
#    

if rnum == "robot_1/2":
    origin = [0.94, -433.95, 21.84]
    xaxis = [-0.01817, -0.99982, 0.00520]
    yaxis = [0.99980, -0.01813, 0.00837]

if rnum == "robot_2/2":
    origin = [-4.67, -430.58, 20.93]
    xaxis = [0.01186, 0.99984, -0.01342]
    yaxis = [-0.99993, 0.01186, -0.00009]

if rnum == "robot_1/2_adjust":
    # 18.4+9.057 = 27.457
    origin = [3.0, -431.8, 26]
    xaxis = [0.0, -1.0, 0.0]
    yaxis = [1.0, 0.0, 0.0]
#    
#===========further away
#if rnum == "robot_1/2_adjust":
#    # 18.4+9.057 = 27.457
#    origin = [1.0, -445, 26]
#    xaxis = [0.0, -1.0, 0.0]
#    yaxis = [1.0, 0.0, 0.0]

if rnum == "robot_2/2_adjust":
    origin = [0.0, -431.8, 27.457]
    xaxis = [0.0, 1.0, 0.0]
    yaxis = [-1.0, 0.0, 0.0]

base_frame = Frame(list(origin), list(xaxis), list(yaxis))
print base_frame
# ---------- end base_2 ----------
panel_5 = Panel(ghpython_script.out)
tools = Tools(tool_id=list)

# ---- group: Robot1
# 1. load robot model
# 2. set tool
# 3. set basis
list_3 = ValueList({"UR3", "UR5", "UR10"}, selected="UR3")
robot = PythonScript(model=list_3)  # -> robot1
# ---------- robot: Python ----------
from ur_online_control.ur.ur10 import UR10
from ur_online_control.ur.ur5 import UR5
from ur_online_control.ur.ur3 import UR3
from scriptcontext import sticky as st

if model == "UR5":
    robot1 = UR5()
elif model == "UR10":
    robot1 = UR10()
elif model == "UR3":
    robot1 = UR3()
# ---------- end robot ----------
set_params = PythonScript(robot1=robot, tool=tools, base_frame=base_2)  # -> robot1
# ---------- set_params: Python ----------
from ur_online_control.ur.ur10 import UR10
from ur_online_control.ur.ur5 import UR5
from scriptcontext import sticky as st
from ur_online_control.ur.tool import Tool
from compas.geometry import Frame


if tool:
    robot1.set_tool(tool)
else:
    robot1.set_tool(Tool(Frame.worldXY()))  
if base_frame:
    robot1.set_base(base_frame)

st["robot1"] = robot1
# ---------- end set_params ----------

# ----
python_4 = GhPythonScript()  # -> out, joint_vals
# ---------- python_4: Python ----------
import math
joint_vals = [[0,-90,90,0,0,0], [10,-90,90,10,10,10]]
for i,joints in enumerate(joint_vals):
    for j,n in enumerate(joints):
        j_n = math.radians(n)
        joint_vals[i][j] = j_n
        
        
print joint_vals
print math.radians(-90)
# ---------- end python_4 ----------
# 4.
pln_2 = Plane(pl_2)

# ---- group: Robot2
# 2.
# 1. load robot model
# 2. set tool
# 3. set basis
list_4 = ValueList({"no_tool": 0, "measurement_tool": 1, "sand_deposition_tool": 2, "earth_deposition_tool": 3, "clay_subtraction_tool": 4, "pack_tool": 5, "arch_2019july_tool3A": 6, "arch_2019july_tool3B": 7, "vault_test2_A": 8, "vault_test2_B": 9, "vault_test2_Measure": 10}, selected="vault_test2_B")
list_5 = ValueList({"robot 1": "robot_1", "robot 2": "robot_2", "robot 3": "robot_3", "archTest_robot_2", "robot_1/2", "robot_2/2", "robot_1/2_adjust", "robot_2/2_adjust"}, selected="robot_2/2_adjust")
list_6 = ValueList({"UR3", "UR5", "UR10"}, selected="UR3")
tools_2 = Tools(tool_id=list_4)
base_3 = PythonScript(rnum=list_5)  # -> base_frame
# ---------- base_3: Python ----------
from compas.geometry import Frame
#from compas.geometry import Transformation, Rotation
#from compas_ghpython import xdraw_frame
#import math
#import Rhino.Geometry as rg




# for robots 1 and 2


if rnum == "robot_1":
    origin = [0.0, 0.0, 0.0]
    xaxis = [0.5, 0.0, 0.0]
    yaxis = [0.0, 0.5, 0.0]

#if rnum == "robot_1":
#    origin = [-468.74, -100.60, 161.23]
#    xaxis = [0.71376, 0.70037, 0.00520]
#    yaxis = [-0.70037, 0.71364, 0.01408]
#    

if rnum == "robot_2":
    origin = [-468.74, -100.60, 161.23]
    xaxis = [0.71376, 0.70037, 0.00520]
    yaxis = [-0.70037, 0.71364, 0.01408]


if rnum == "robot_3":
    origin = [-110.14, 465.76, 167.41]
    xaxis = [0.71228, -0.70189, -0.00042]
    yaxis = [0.70182, 0.71220, 0.01506]

if rnum == "archTest_robot_2":
    origin = [0.0, -863.6, 0.0]
#    origin = [863.6, 0.0, 0.0]
#    xaxis = [-0.5, 0, 0]
#    yaxis = [0, -0.5, 0]
    xaxis = [0.0, 0.5, 0.0]
    yaxis = [-0.5, 0.0, 0.0]
#    

if rnum == "robot_1/2":
    origin = [0.94, -433.95, 21.84]
    xaxis = [-0.01817, -0.99982, 0.00520]
    yaxis = [0.99980, -0.01813, 0.00837]

if rnum == "robot_2/2":
    origin = [-4.67, -430.58, 20.93]
    xaxis = [0.01186, 0.99984, -0.01342]
    yaxis = [-0.99993, 0.01186, -0.00009]

if rnum == "robot_1/2_adjust":
    # 18.4+9.057 = 27.457
    origin = [0.0, -431.8, 27.457]
    xaxis = [0.0, -1.0, 0.0]
    yaxis = [1.0, 0.0, 0.0]

if rnum == "robot_2/2_adjust":
    origin =[3, -432.3, 21]
    xaxis = [0.0, 1.0, 0.0]
    yaxis = [-1.0, 0.0, 0.0]

base_frame = Frame(list(origin), list(xaxis), list(yaxis))
print base_frame
# ---------- end base_3 ----------
robot_2 = PythonScript(model=list_6)  # -> robot2
# ---------- robot_2: Python ----------
from ur_online_control.ur.ur10 import UR10
from ur_online_control.ur.ur5 import UR5
from ur_online_control.ur.ur3 import UR3
from scriptcontext import sticky as st


if model == "UR5":
    robot2 = UR5()
elif model == "UR10":
    robot2 = UR10()
elif model == "UR3":
    robot2 = UR3()
# ---------- end robot_2 ----------
set_params_2 = PythonScript(robot2=robot_2, tool=tools_2, base_frame=base_3)  # -> robot2
# ---------- set_params_2: Python ----------
from ur_online_control.ur.ur10 import UR10
from ur_online_control.ur.ur5 import UR5
from scriptcontext import sticky as st
from ur_online_control.ur.tool import Tool
from compas.geometry import Frame


if tool:
    robot2.set_tool(tool)
else:
    robot2.set_tool(Tool(Frame.worldXY()))  
if base_frame:
    robot2.set_base(base_frame)

st["robot2"] = robot2
# ---------- end set_params_2 ----------

# ----
number_slider_2 = Slider(3, range=0..50)

# ---- group: gripping plane generation
ghpython_script_2 = GhPythonScript(b_struct=ghpython_script.b_st, nb_rot=Slider(8, range=2..50), nb_trans=Slider(9, range=2..50), flip=Toggle(True))  # -> out, planes, planes_out; inputs nb_rot: Int32, nb_trans: Int32, flip: Boolean
# ---------- ghpython_script_2: Python ----------
import Rhino.Geometry as rg
from ghpythonlib.treehelpers import list_to_tree

from coop_assembly.assembly_info_generation.fabrication_planes import calculate_gripping_plane

for v in b_struct.vertex:
    calculate_gripping_plane(b_struct, v, b_struct.vertex[v]["mean_point"], nb_rot=nb_rot, nb_trans=nb_trans, planes_flip=flip)

planes = []
for v in b_struct.vertex:
    gp = b_struct.vertex[v]["gripping_plane"]
    pl = rg.Plane(rg.Point3d(gp[0][0], gp[0][1],gp[0][2]), rg.Vector3d(gp[1][0], gp[1][1],gp[1][2]), rg.Vector3d(gp[2][0], gp[2][1],gp[2][2]))
    planes.append(pl)

planes_all = []
for i,v in enumerate(b_struct.vertex):
    gp_all = b_struct.vertex[v]["gripping_planes_all"]
    planes_all.append([])
    for gp in gp_all:
        pl = rg.Plane(rg.Point3d(gp[0][0], gp[0][1],gp[0][2]), rg.Vector3d(gp[1][0], gp[1][1],gp[1][2]), rg.Vector3d(gp[2][0], gp[2][1],gp[2][2]))
        planes_all[i].append(pl)

planes_out = list_to_tree(planes_all)
# ---------- end ghpython_script_2 ----------
plane = Plane(ghpython_script_2.planes_out)
list_item_2 = ListItem(List=ghpython_script_2.planes, Index=number_slider_2, Wrap=True)
list_item_3 = ListItem(List=ghpython_script_2.planes_out, Index=0, Wrap=True)
custom_preview = CustomPreview(
    Geometry=list_item_2,
    Material={diffuse=RGB(221, 160, 221), emission=RGB(66, 48, 66), shine=0.5, specular=RGB(255, 255, 255), transparency=0})

# ----
pipe = Pipe(Curve=ghpython_script.lns_inv, Radius=number_slider, Caps=0)
line = Line(ghpython_script.lns_inv)
line_2 = Line(ghpython_script.lns_netw)

# ---- group: for touble shooting
# 4.
# Fabrication process example #1 (MoveL)
# The planes, speed-values, acceleration-values, and wait-time-values that are sent to the robot
acceleration = Slider(60, range=0..100)
plane_generation = GhPythonScript(
    frames_WCS=pln,
    joint_vals=python_3.joint_vals,
    speed=Slider(100, range=0..100),
    acceleration=acceleration,
    wait_time=Slider(2, range=0..10))  # -> out, frames_WCS, joint_vals, speed_values, acceleration_values, wait_time_values; inputs frames_WCS: list, joint_vals: list
# ---------- plane_generation: Python ----------
import Rhino.Geometry as rg
import ghpythonlib.components as ghcomp
from compas.geometry import Frame
from compas.geometry import Transformation
import math


#plane_WCS = rg.Plane.WorldXY
#plane_WCS.Rotate(math.radians(180), plane_WCS.XAxis, plane_WCS.Origin)
#
#div_pts, tangents, parmas = ghcomp.DivideCurve(crv, div_num, False)
#planes_WCS = [rg.Plane(pt, plane_WCS.XAxis, plane_WCS.YAxis) for pt in div_pts]

print frames_WCS
speed_values = []
acceleration_values = []
wait_time_values = []

for i, p in enumerate(joint_vals):
    speed_values.append(speed)
    acceleration_values.append(acceleration)
    wait_time_values.append(wait_time)

for i,p in enumerate(frames_WCS):
    speed_values.append(speed)
    acceleration_values.append(acceleration)
    wait_time_values.append(wait_time)
# ---------- end plane_generation ----------
command_gen = PythonScript(
    frames_WCS=plane_generation.frames_WCS,
    joint_vals=plane_generation.joint_vals,
    speed_values=plane_generation.speed_values,
    acceleration_values=plane_generation.acceleration_values,
    wait_time_values=plane_generation.wait_time_values,
    pick_up=Toggle(False),
    place=Toggle(True))  # -> out, commands; inputs frames_WCS: list, joint_vals: list, safety_planes_WCS: list of Plane, speed_values: list, acceleration_values: list, wait_time_values: list
# ---------- command_gen: Python ----------
import os
import Rhino.Geometry as rg
from scriptcontext import sticky as st
from ur_online_control.communication.msg_identifiers import *
from ur_online_control.utilities.lists import flatten_list
from compas.geometry import Frame, Transformation
import json

robot1 = st["robot1"]
tool = robot1.tool
tool_pose = list(tool.tcp_frame.point) + tool.tcp_frame.axis_angle_vector

#format planes into commands

commands = []
if pick_up:
    commands.append("pick_up")
    for i, joints in enumerate(joint_vals):
        speed = speed_values[i]
        acceleration = acceleration_values[i]
        wait_time_value = wait_time_values[i]
        cmd = joints + [acceleration, speed, wait_time_value]
        commands.append(cmd)
elif place:
    commands.append("place")
    
for i, frame_WCS in enumerate(frames_WCS):
    tcp_WCS = Frame(frame_WCS[0], frame_WCS[1], frame_WCS[2])
    pose = robot1.get_pose_angle_axis_in_RCS(tcp_WCS) #tcp_RCS = robot1.get_frame_in_RCS(tcp_WCS) #pose = list(tcp_RCS.point) + tcp_RCS.axis_angle_vector
#    print pose
    speed = speed_values[len(joint_vals)+i]
    acceleration = acceleration_values[len(joint_vals)+i]
    wait_time_value = wait_time_values[len(joint_vals)+i]
    cmd = pose + [acceleration, speed, wait_time_value]
    commands.append(cmd)

print commands
# ---------- end command_gen ----------

# ----
panel_6 = Panel(ghpython_script_2.out)
custom_preview_2 = CustomPreview(Geometry=pipe, Shader=ColourSwatch(SwatchColor=RGBA(61, 200, 255, 168)))
point_2 = Point(ghpython_script.pts_netw)

# ---- group: for touble shooting
# Fabrication process example #1 (MoveL)
# The planes, speed-values, acceleration-values, and wait-time-values that are sent to the robot
acceleration_2 = Slider(50, range=0..100)
plane_generation_2 = GhPythonScript(
    frames_WCS=pln_2,
    joint_vals=python_2.list_joints_val,
    speed=Slider(80, range=0..100),
    acceleration=acceleration_2,
    wait_time=Slider(2, range=0..10))  # -> out, frames_WCS, joint_vals, speed_values, acceleration_values, wait_time_values; inputs frames_WCS: list, joint_vals: list
# ---------- plane_generation_2: Python ----------
import Rhino.Geometry as rg
import ghpythonlib.components as ghcomp
from compas.geometry import Frame
from compas.geometry import Transformation
#from compas_ghpython import draw_frame
import math


#plane_WCS = rg.Plane.WorldXY
#plane_WCS.Rotate(math.radians(180), plane_WCS.XAxis, plane_WCS.Origin)
#
#div_pts, tangents, parmas = ghcomp.DivideCurve(crv, div_num, False)
#planes_WCS = [rg.Plane(pt, plane_WCS.XAxis, plane_WCS.YAxis) for pt in div_pts]

print frames_WCS
speed_values = []
acceleration_values = []
wait_time_values = []

for i, p in enumerate(joint_vals):
    speed_values.append(speed)
    acceleration_values.append(acceleration)
    wait_time_values.append(wait_time)

for i,p in enumerate(frames_WCS):
    speed_values.append(speed)
    acceleration_values.append(acceleration)
    wait_time_values.append(wait_time)
# ---------- end plane_generation_2 ----------
command_gen_2 = PythonScript(
    frames_WCS=plane_generation_2.frames_WCS,
    joint_vals=plane_generation_2.joint_vals,
    speed_values=plane_generation_2.speed_values,
    acceleration_values=plane_generation_2.acceleration_values,
    wait_time_values=plane_generation_2.wait_time_values,
    pick_up=Toggle(False),
    place=Toggle(True))  # -> out, commands; inputs frames_WCS: list, joint_vals: list, safety_planes_WCS: list of Plane, speed_values: list, acceleration_values: list, wait_time_values: list
# ---------- command_gen_2: Python ----------
import os
import Rhino.Geometry as rg
from scriptcontext import sticky as st
from ur_online_control.communication.msg_identifiers import *
from ur_online_control.utilities.lists import flatten_list
from compas.geometry import Frame, Transformation
#from compas_ghpython import xdraw_frame
import json

robot1 = st["robot1"]
tool = robot1.tool
tool_pose = list(tool.tcp_frame.point) + tool.tcp_frame.axis_angle_vector

#format planes into commands

commands = [[]]
if pick_up:
    commands[0].append(0)
    for i, frame_WCS in enumerate(frames_WCS):
        tcp_WCS = Frame(frame_WCS[0], frame_WCS[1], frame_WCS[2])
        pose = robot1.get_pose_angle_axis_in_RCS(tcp_WCS) #tcp_RCS = robot1.get_frame_in_RCS(tcp_WCS) #pose = list(tcp_RCS.point) + tcp_RCS.axis_angle_vector
    #    print pose
        speed = speed_values[len(joint_vals)+i]
        acceleration = acceleration_values[len(joint_vals)+i]
        wait_time_value = wait_time_values[len(joint_vals)+i]
        cmd = pose + [acceleration, speed, wait_time_value]
        commands[0] = commands[0] + cmd
elif place:
    commands[0].append(1)
    for i, joints in enumerate(joint_vals):
        speed = speed_values[i]
        acceleration = acceleration_values[i]
        wait_time_value = wait_time_values[i]
        cmd = joints + [acceleration, speed, wait_time_value]
        commands[0] = commands[0] + cmd
    


print commands
# ---------- end command_gen_2 ----------

# ----
list_item_4 = ListItem(List=line, Index=number_slider_2, Wrap=True)

# ----
# 3.
# UR online control
# If the connection is lost, please restart the connection here.
# Press here to send the commands
# to the robot
start = Button()

list_item_5 = ListItem(List=point_2, Index=Slider(3, range=0..20), Wrap=True)
# Checklist before sending a program to the robot:
# 
# 1. correct IP address and ping tested
# 2. correct tool
# 3. correct main file
# 4. correct example chosen
# 
# if your visualisation is showing something unexpected, check if you have chosen the right option fro the dropdown menu.
panel_7 = Panel("main_robot.py")

panel_8 = Panel("Start communication server")
py_3 = PythonScript()  # -> path
# ---------- py_3: Python ----------
import sys
import os
from scriptcontext import sticky as st

ghComp = ghenv.Component
ghDoc = ghComp.OnPingDocument()

# the full path of the gh file
path = ghDoc.FilePath
# the directory of the gh file
path = os.path.dirname(path)
st["path"] = path

json_path = os.path.abspath(os.path.join(path, "..", "tmp"))
#path = os.path.abspath(os.path.join(path, "..", "Test01_Arch"))


st["json_path"] = json_path 

print path
print json_path
# ---------- end py_3 ----------
panel_9 = Panel(py_3)
server = PythonScript(path=panel_9, file=panel_7, start=start)
# ---------- server: Python ----------
import os
import threading
from scriptcontext import sticky as st

server_address = st["server_address"]
server_port = st["server_port"]
ur_ip1 = st["ur_ip1"]

print file
 
main = os.path.join(path, file.strip())
print main

main = r"C:\Users\parascho\Documents\git_repos\coop_assembly\examples\workshop_dms\main_robot.py"

if os.path.isfile(main):
        
    def myfunc():
#        syscall = "C:\Users\Student\Anaconda3\envs\environpy27\python %s %s %s %s" % (main, server_address, server_port, ur_ip1)
        syscall = r"C:\Users\parascho\AppData\Local\Continuum\anaconda3\envs\env_python2\python %s %s %s %s" % (main, server_address, server_port, ur_ip1)
        os.system(syscall)
    
    if start:
        t = threading.Thread(target=myfunc)
        t.start()
else:
    
    raise Exception("File does not exist")
# ---------- end server ----------

# ----
# 3.
# UR online control
# If the connection is lost, please restart the connection here.
# Press here to send the commands
# to the robot
start_2 = Button()

py_4 = PythonScript()  # -> path; same code as py_3
panel_11 = Panel(py_4)
server_2 = PythonScript(path=panel_11, file="main_robot.py", start=start_2)
# ---------- server_2: Python ----------
import os
import threading
from scriptcontext import sticky as st

server_address = st["server_address"]
server_port = st["server_port"]
ur_ip2 = st["ur_ip2"]

print file
 
main = os.path.join(path, file.strip())


if os.path.isfile(main):
        
    def myfunc():
        syscall = "C:\Users\Student\Anaconda3\envs\environpy27\python %s %s %s %s" % (main, server_address, server_port, ur_ip2)
        os.system(syscall)
    
    if start:
        t = threading.Thread(target=myfunc)
        t.start()
else:
    
    raise Exception("File does not exist")
# ---------- end server_2 ----------

ur = PythonScript(send=start)  # -> out
# ---------- ur: Python ----------
from scriptcontext import sticky as st
from ur_online_control.ur_driver import URDriver

server_address = st["server_address"]
server_port = st["server_port"]
ur_ip1 = st["ur_ip1"]
robot1 = st["robot1"]

tool_angle_axis = list(robot1.tool.tcp_frame.point) + robot1.tool.tcp_frame.axis_angle_vector
#robot.tool.tcp_frame.pose_axis_angle_vector
print tool_angle_axis

ur_driver = URDriver(server_address, server_port, tool_angle_axis, ur_ip1, "UR")
print ur_driver

if send:
    ur_driver.send()
# ---------- end ur ----------
panel_12 = Panel("Get UR connected")

connect = Button()

disconnect = Button()
panel_13 = Panel("Get Grasshopper connected")
client = PythonScript(connect=connect, disconnect=disconnect)  # -> connected, client; inputs disconnect: Boolean
# ---------- client: Python ----------
import time
from scriptcontext import sticky as st
from Rhino.RhinoApp import WriteLine
from ur_online_control.ghpython import GHClient, gh_component_timer
import time

server_address = st["server_address"]
server_port = st["server_port"]

guid = str(ghenv.Component.InstanceGuid)

client_key = "client_" + guid
run_key = "run_" + guid

if connect:
    if client_key not in st:
        st[client_key] = GHClient(server_address, server_port)
        client = st[client_key]
        client.connect_to_server()
        client.start()
        
    else:
        if st[client_key].running:
            WriteLine("Client is already connected.")
            
        else:
            st[client_key] = GHClient(server_address, server_port)
            client = st[client_key]
            client.connect_to_server()
            client.start()
"""
else:
    if client_key in st:
        # we need a timer to ask if we have something on the rcv queue
        client = st[client_key]
        #if client.running:
        #    #client.run_inner_while()
        #    gh_component_timer(ghenv, True, 1000)
"""

if disconnect:
    #print "disconnecting"
    if client_key in st:
        client = st[client_key]
        if client.running:
            client.close()

if client_key in st:
    connected =  st[client_key].running
    client = st[client_key]
    print st[client_key].rcv_queue.qsize()
    print st[client_key].snd_queue.qsize()
else:
    connected = False
# ---------- end client ----------
panel_14 = Panel(client.connected)

# ---- group: for touble shooting
# Press here to send the commands
# to the robot
continue_fabrication = BooleanToggle(False)
send = Button()
send_2 = PythonScript(client=client.client, send=send, continue_fabrication=continue_fabrication, commands=command_gen_2.commands)  # -> out, commands; inputs continue_fabrication: Int32, commands: list
# ---------- send_2: Python ----------
import os
import Rhino.Geometry as rg
from scriptcontext import sticky as st
from ur_online_control.communication.msg_identifiers import *
from ur_online_control.utilities.lists import flatten_list
from compas.geometry import Frame, Transformation
#from compas_ghpython import xdraw_frame
import json

robot1 = st["robot1"]
tool = robot1.tool
tool_pose = list(tool.tcp_frame.point) + tool.tcp_frame.axis_angle_vector

if "commands_to_execute" not in st:
    st["commands_to_execute"] = 0

print(commands)
commands_flattened = flatten_list(commands)
#safety_commands_flattened = flatten_list(safety_commands)

#print safety_commands_flattened

len_command = len(commands[0])
len_commands = int(len(commands_flattened)/len_command)
print "length of commands: ", len_commands
print "length of command: ", len_command

if send and client:
    # 1. send continue fabrication
    #client.send(MSG_INT, int(continue_fabrication))
    
    # 2. send tool tcp
    client.send(MSG_FLOAT_LIST, tool_pose) # set tool tcp
    
    # 3. send command length
    client.send(MSG_INT, len_command)
    
    # 4. send commands
    client.send(MSG_FLOAT_LIST, commands_flattened)
    
    # 5. send safety commands
#    client.send(MSG_FLOAT_LIST, safety_commands_flattened)
    
    st["commands_to_execute"] = len_commands
    st["current_number"] = 0
# ---------- end send_2 ----------

# ----
# This component updates on receive
bang_3 = Button()
receive = PythonScript(client=client.client, bang=bang_3)  # -> qsize, client
# ---------- receive: Python ----------
from ur_online_control.communication.msg_identifiers import *
from ur_online_control.utilities.lists import flatten_list
from Rhino.RhinoApp import WriteLine

if client:
    if not client.ghenv:
        client.ghenv = ghenv
    qsize = client.rcv_queue.qsize()


print client
# ---------- end receive ----------
panel_15 = Panel(receive.qsize)

# ----
# This is sent after every pose reached
time = Slider(0, range=0..3)
send_3 = PythonScript(client=receive.client, wait_time=time, pause=Toggle(False), continue_loop=Button())  # -> msg, commands_to_execute, pose_joints, bang; inputs pause: Boolean, continue_loop: Boolean
# ---------- send_3: Python ----------
from ur_online_control.communication.msg_identifiers import *
from ur_online_control.utilities.lists import flatten_list
import os
import json
from compas_fab.robots import Configuration

from scriptcontext import sticky as st

guid = str(ghenv.Component.InstanceGuid)
msg_key = "msg_" + guid

path = st["json_path"]
current_number_file = os.path.join(path, "current_number.txt")

if msg_key not in st:
    st[msg_key] = []

if client:
    qsize = client.rcv_queue.qsize()
    if qsize:
        st["commands_to_execute"] -= 1
        st["current_number"] += 1
        # save data into json file
        with open(current_number_file, 'w') as f:
            json.dump({"current_number": st["current_number"]}, f)
        msg = client.rcv_queue.get()
        st[msg_key] = msg
        client.send(MSG_FLOAT_LIST, [wait_time])
        client.send(MSG_INT, int(pause))

if continue_loop:
    client.send(MSG_INT, int(1))
        

msg = st[msg_key]
bang = True
commands_to_execute = st["commands_to_execute"]

if len(msg) == 6:
    pose_joints = Configuration.from_revolute_values(msg)
else:
    pose_joints = Configuration.from_revolute_values([0,0,0,0,0,0])
# ---------- end send_3 ----------
panel_16 = Panel(send_3.msg)
commands_to_execute = Panel(send_3.commands_to_execute)

# ---- group: for touble shooting
python_5 = PythonScript(frames_WCS=plane_generation.frames_WCS)  # -> out, planes_WCS; inputs frames_WCS: list
# ---------- python_5: Python ----------
import Rhino.Geometry as rg

planes_WCS = []
for frame in frames_WCS:
    origin = rg.Point3d(frame[0][0], frame[0][1], frame[0][2])
    x_vec = rg.Vector3d(frame[1][0], frame[1][1], frame[1][2])
    y_vec = rg.Vector3d(frame[2][0], frame[2][1], frame[2][2])
    planes_WCS.append(rg.Plane(origin, x_vec, y_vec))
# ---------- end python_5 ----------
speed = Slider(20, range=0..300)
python_6 = PythonScript(frames_WCS=plane_generation.frames_WCS, dfillet=Slider(20, range=0..100), speed=speed)  # -> commands; inputs frames_WCS: list, speed: Int32
# ---------- python_6: Python ----------
import Rhino.Geometry as rg
from compas.geometry import Frame
from compas.geometry import Transformation
from compas.geometry import length_vector
from scriptcontext import sticky as st

robot1 = st["robot1"]
buffer = 0.7

# TODO this must be optimized! matrix multiplication!
commands = []
for i, frame_WCS in enumerate(frames_WCS):
    tcp_WCS = Frame(frame_WCS[0], frame_WCS[1], frame_WCS[2])
    if i == 0 or i == len(frames_WCS) - 1:
        radius = 0.
        
    else:
        # calculate blend radius
        prev, current, next = frames_WCS[i-1][0], frames_WCS[i][0], frames_WCS[i+1][0]
        #result = map(lambda x: x + x, numbers)
        radius = min(length_vector(map(lambda x, y: x - y, prev, current))/2 * buffer, length_vector(map(lambda x, y: x - y, next, current))/2, dfillet)
        print radius
        #radius = min((prev - current).Length/2 * buffer, (next - current).Length/2 * buffer, dfillet)
    
    tcp_RCS = robot1.get_frame_in_RCS(tcp_WCS)
    
    cmd = list(tcp_RCS.point) + tcp_RCS.axis_angle_vector + [speed, radius]
    #cmd = list(tcp_RCS.point) + tcp_RCS.axis_angle_vector + [time, radius]
    commands.append(cmd)
    
    
    
print (commands)
# ---------- end python_6 ----------
pln_3 = Plane(python_5.planes_WCS)
polyline = PolyLine(Vertices=pln_3, Closed=False)
point_3 = Point(pln_3)
curve = Curve(polyline)
preview = CustomPreview(Geometry=pln_3, Shader=ColourSwatch(SwatchColor=RGB(194, 195, 191)))
preview_2 = CustomPreview(Geometry=[curve, point_3], Shader=ColourSwatch(SwatchColor=RGB(255, 94, 94)))

python_7 = PythonScript(frames_WCS=plane_generation_2.frames_WCS)  # -> out, planes_WCS; inputs frames_WCS: list; same code as python_5
speed_2 = Slider(20, range=0..300)
python_8 = PythonScript(frames_WCS=plane_generation_2.frames_WCS, dfillet=Slider(20, range=0..100), speed=speed_2)  # -> commands; inputs frames_WCS: list, speed: Int32
# ---------- python_8: Python ----------
import Rhino.Geometry as rg
from compas.geometry import Frame
from compas.geometry import Transformation
from compas.geometry import length_vector
#from compas_ghpython import xdraw_frame
from scriptcontext import sticky as st

robot1 = st["robot1"]
buffer = 0.7

# TODO this must be optimized! matrix multiplication!
commands = []
for i, frame_WCS in enumerate(frames_WCS):
    tcp_WCS = Frame(frame_WCS[0], frame_WCS[1], frame_WCS[2])
    if i == 0 or i == len(frames_WCS) - 1:
        radius = 0.
        
    else:
        # calculate blend radius
        prev, current, next = frames_WCS[i-1][0], frames_WCS[i][0], frames_WCS[i+1][0]
        #result = map(lambda x: x + x, numbers)
        radius = min(length_vector(map(lambda x, y: x - y, prev, current))/2 * buffer, length_vector(map(lambda x, y: x - y, next, current))/2, dfillet)
        print radius
        #radius = min((prev - current).Length/2 * buffer, (next - current).Length/2 * buffer, dfillet)
    
    tcp_RCS = robot1.get_frame_in_RCS(tcp_WCS)
    
    cmd = list(tcp_RCS.point) + tcp_RCS.axis_angle_vector + [speed, radius]
    #cmd = list(tcp_RCS.point) + tcp_RCS.axis_angle_vector + [time, radius]
    commands.append(cmd)
    
    
    
print (commands)
# ---------- end python_8 ----------
pln_4 = Plane(python_7.planes_WCS)
polyline_2 = PolyLine(Vertices=pln_4, Closed=False)
point_4 = Point(pln_4)
curve_2 = Curve(polyline_2)
preview_3 = CustomPreview(Geometry=pln_4, Shader=ColourSwatch(SwatchColor=RGB(194, 195, 191)))
preview_4 = CustomPreview(Geometry=[curve_2, point_4], Shader=ColourSwatch(SwatchColor=RGB(255, 94, 94)))

# ----
ur_2 = PythonScript(send=start_2)  # -> out
# ---------- ur_2: Python ----------
from scriptcontext import sticky as st
from ur_online_control.ur_driver import URDriver

server_address = st["server_address"]
server_port = st["server_port"]
ur_ip2 = st["ur_ip2"]
robot2 = st["robot2"]

tool_angle_axis = list(robot2.tool.tcp_frame.point) + robot2.tool.tcp_frame.axis_angle_vector
#robot2.tool.tcp_frame.pose_axis_angle_vector
print tool_angle_axis

ur_driver = URDriver(server_address, server_port, tool_angle_axis, ur_ip2, "UR")
print ur_driver

if send:
    ur_driver.send()
# ---------- end ur_2 ----------

disconnect_2 = Button()
connect_2 = Button()
client_2 = PythonScript(connect=connect_2, disconnect=disconnect_2)  # -> connected, client; inputs disconnect: Boolean; same code as client
panel_19 = Panel(client_2.connected)

# ---- group: for touble shooting
# Press here to send the commands
# to the robot
continue_fabrication_2 = BooleanToggle(False)
send_4 = Button()
send_5 = PythonScript(client=client_2.client, send=send_4, continue_fabrication=continue_fabrication_2, commands=command_gen.commands)  # -> out, commands; inputs continue_fabrication: Int32, commands: list
# ---------- send_5: Python ----------
import os
import Rhino.Geometry as rg
from scriptcontext import sticky as st
from ur_online_control.communication.msg_identifiers import *
from ur_online_control.utilities.lists import flatten_list
from compas.geometry import Frame, Transformation
import json

robot1 = st["robot1"]
tool = robot1.tool
tool_pose = list(tool.tcp_frame.point) + tool.tcp_frame.axis_angle_vector

if "commands_to_execute" not in st:
    st["commands_to_execute"] = 0

commands_flattened = flatten_list(commands)
#safety_commands_flattened = flatten_list(safety_commands)

#print safety_commands_flattened

len_command = len(commands[0])
len_commands = int(len(commands_flattened)/len_command)
print "length of commands: ", len_commands
print "length of command: ", len_command

if send and client:
    # 1. send continue fabrication
    #client.send(MSG_INT, int(continue_fabrication))
    
    # 2. send tool tcp
    client.send(MSG_FLOAT_LIST, tool_pose) # set tool tcp
    
    # 3. send command length
    client.send(MSG_INT, len_command)
    
    # 4. send commands
    client.send(MSG_FLOAT_LIST, commands_flattened)
    
    # 5. send safety commands
#    client.send(MSG_FLOAT_LIST, safety_commands_flattened)
    
    st["commands_to_execute"] = len_commands
    st["current_number"] = 0
# ---------- end send_5 ----------

# ----
# This component updates on receive
bang_4 = Button()
receive_2 = PythonScript(client=client_2.client, bang=bang_4)  # -> qsize, client; same code as receive
panel_20 = Panel(receive_2.qsize)

# ----
# This is sent after every pose reached
time_2 = Slider(0, range=0..3)
send_6 = PythonScript(client=receive_2.client, wait_time=time_2, pause=Toggle(False), continue_loop=Button())  # -> msg, commands_to_execute, pose_joints, bang; inputs pause: Boolean, continue_loop: Boolean; same code as send_3
panel_21 = Panel(send_6.msg)
commands_to_execute_2 = Panel(send_6.commands_to_execute)

pt_3 = Point(<point referenced from the Rhino model>)
crv_5 = Curve(<curve referenced from the Rhino model>)
crv_6 = Curve(<curve referenced from the Rhino model>)
pt_4 = Point(<point referenced from the Rhino model>)
crv_7 = Curve(<curve referenced from the Rhino model>)
crv_8 = Curve(<curve referenced from the Rhino model>)
pl_3 = ConstructPlane(Origin=pt_3, XAxis=crv_5, YAxis=crv_6)
pl_4 = ConstructPlane(Origin=pt_4, XAxis=crv_8, YAxis=crv_7)

get = Button()
pose = PythonScript(get=get)  # -> pose_cartesian
# ---------- pose: Python ----------
from scriptcontext import sticky as st
from ur_online_control.ur_direct import get_current_pose_cartesian

server_address = st["server_address"]
server_port = 30005
ur_ip1 = st["ur_ip1"]
robot1 = st["robot1"]
tool_angle_axis = list(robot1.tool.tcp_frame.point) + robot1.tool.tcp_frame.axis_angle_vector
print tool_angle_axis

guid = str(ghenv.Component.InstanceGuid)
pose_cartesian_key = "pose_cartesian" + guid


if get:
    st[pose_cartesian_key] = get_current_pose_cartesian(server_address, server_port, ur_ip1, tool_angle_axis)

if pose_cartesian_key not in st:
    pose_cartesian = []
else:
    pose_cartesian = st[pose_cartesian_key]
# ---------- end pose ----------
panel_22 = Panel("get pose cartesian")
py_5 = PythonScript(pose_cartesian=pose)  # -> frame_WCS; inputs pose_cartesian: list
# ---------- py_5: Python ----------
import Rhino.Geometry as rg
from scriptcontext import sticky as st
from compas.geometry import Frame
from compas.geometry.xforms import Transformation

robot1 = st["robot1"]

print pose_cartesian
if pose_cartesian:
    #frame_RCS = Frame.from_pose_axis_angle_vector(pose_cartesian)
    frame_RCS = Frame.from_axis_angle_vector(axis_angle_vector=pose_cartesian[3:], point=pose_cartesian[:3])
    frame_WCS = robot1.get_frame_in_WCS(frame_RCS)
    
    print frame_RCS
# ---------- end py_5 ----------
panel_23 = Panel(pose)
draw = Draw(frame=py_5)  # -> G, C
preview_5 = CustomPreview(Geometry=draw.G, Shader=draw.C)

get_2 = Button()
pose_2 = PythonScript(get=get_2, get_init=py.trigger)  # -> pose_joints
# ---------- pose_2: Python ----------
from scriptcontext import sticky as st
from ur_online_control.ur_direct import get_current_pose_joints
from compas_fab.robots import Configuration

server_address = st["server_address"]
server_port = 30005
ur_ip1 = st["ur_ip1"]
robot1 = st["robot1"]
tool_angle_axis = list(robot1.tool.tcp_frame.point) + robot1.tool.tcp_frame.axis_angle_vector
print tool_angle_axis

guid = str(ghenv.Component.InstanceGuid)
pose_joints_key = "pose_joints" + guid


if get or get_init:
    st[pose_joints_key] = get_current_pose_joints(server_address, server_port, ur_ip1, tool_angle_axis)
    
if pose_joints_key not in st:
    pose_joints = Configuration.from_revolute_values([0,0,0,0,0,0])
else:
    pose_joints = Configuration.from_revolute_values(st[pose_joints_key])

print pose_joints
# ---------- end pose_2 ----------
panel_24 = Panel("get pose joint")
panel_25 = Panel(pose_2)

stop = Button()
stop_2 = PythonScript(stop=stop)
# ---------- stop_2: Python ----------
from scriptcontext import sticky as st
from ur_online_control.ur_direct import stop as stop_robot

ur_ip1 = st["ur_ip1"]

if stop:
    stop_robot(ur_ip1)
# ---------- end stop_2 ----------

# ----
# Direct UR control
panel_26 = Panel("stop")

get_3 = Button()
pose_3 = PythonScript(get=get_3)  # -> pose_cartesian
# ---------- pose_3: Python ----------
from scriptcontext import sticky as st
from ur_online_control.ur_direct import get_current_pose_cartesian

server_address = st["server_address"]
server_port = 30005
ur_ip2 = st["ur_ip2"]
robot2 = st["robot2"]
tool_angle_axis = list(robot2.tool.tcp_frame.point) + robot2.tool.tcp_frame.axis_angle_vector
print tool_angle_axis

guid = str(ghenv.Component.InstanceGuid)
pose_cartesian_key = "pose_cartesian" + guid


if get:
    st[pose_cartesian_key] = get_current_pose_cartesian(server_address, server_port, ur_ip2, tool_angle_axis)

if pose_cartesian_key not in st:
    pose_cartesian = []
else:
    pose_cartesian = st[pose_cartesian_key]
# ---------- end pose_3 ----------
py_6 = PythonScript(pose_cartesian=pose_3)  # -> frame_WCS; inputs pose_cartesian: list
# ---------- py_6: Python ----------
import Rhino.Geometry as rg
from scriptcontext import sticky as st
from compas.geometry import Frame
from compas.geometry.xforms import Transformation

robot2 = st["robot2"]

print pose_cartesian
if pose_cartesian:
    #frame_RCS = Frame.from_pose_axis_angle_vector(pose_cartesian)
    frame_RCS = Frame.from_axis_angle_vector(axis_angle_vector=pose_cartesian[3:], point=pose_cartesian[:3])
    frame_WCS = robot2.get_frame_in_WCS(frame_RCS)
    
    print frame_RCS
# ---------- end py_6 ----------
panel_28 = Panel(pose_3)
draw_2 = Draw(frame=py_6)  # -> G, C
preview_6 = CustomPreview(Geometry=draw_2.G, Shader=draw_2.C)

get_4 = Button()
pose_4 = PythonScript(get=get_4, get_init=py_2.trigger)  # -> pose_joints
# ---------- pose_4: Python ----------
from scriptcontext import sticky as st
from ur_online_control.ur_direct import get_current_pose_joints
from compas_fab.robots import Configuration

server_address = st["server_address"]
server_port = 30005
ur_ip2 = st["ur_ip2"]
robot2 = st["robot2"]
tool_angle_axis = list(robot2.tool.tcp_frame.point) + robot2.tool.tcp_frame.axis_angle_vector
print tool_angle_axis

guid = str(ghenv.Component.InstanceGuid)
pose_joints_key = "pose_joints" + guid


if get or get_init:
    st[pose_joints_key] = get_current_pose_joints(server_address, server_port, ur_ip2, tool_angle_axis)
    
if pose_joints_key not in st:
    pose_joints = Configuration.from_revolute_values([0,0,0,0,0,0])
else:
    pose_joints = Configuration.from_revolute_values(st[pose_joints_key])

print pose_joints
# ---------- end pose_4 ----------
panel_30 = Panel(pose_4)

stop_3 = Button()
stop_4 = PythonScript(stop=stop_3)
# ---------- stop_4: Python ----------
from scriptcontext import sticky as st
from ur_online_control.ur_direct import stop as stop_robot

ur_ip2 = st["ur_ip2"]

if stop:
    stop_robot(ur_ip2)
# ---------- end stop_4 ----------

# ----
# Direct UR control
panel_31 = Panel("stop")

number_slider_3 = Slider(1, range=0..50)  # disabled
number_slider_4 = Slider(300, range=0..1000)  # disabled
number_slider_5 = Slider(150, range=0..1000)  # disabled
d = Slider(5, range=0..100)  # disabled
number_slider_6 = Slider(30, range=0..100)  # disabled
boolean_toggle = BooleanToggle(True)  # disabled
button = Button()  # disabled
point_5 = Point([<point referenced from the Rhino model> x4])  # disabled
point_6 = Point(<point referenced from the Rhino model>)  # disabled
plane_2 = Plane(Plane(origin=(523.8805311, -0.3481666342, 0), x=(-1, 0, 0), y=(0, 1, 0)))  # disabled
plane_3 = Plane(Plane(origin=(253.3121363, -293.7578269, 0), x=(0, 1, 0), y=(-1, 0, 0)))  # disabled

# ----
# Calculate basis
# Measure basis:
# 1. Clear the recorded poses
# 2. Move robot to origin and press "get pose"
# 3. Move robot to point in positive x-axis and press "get pose"
# 4. Move robot to an other point in your basis and press "get pose"
# (The further away these positions are, the better)
# 
# 5. Alternatively change the order in the component calc base
# 6. Copy output into base component
clear = Button()
list_7 = ValueList({"origin, pt on positive x-axis, pt in xy plane": 0, "origin, pt on positive y-axis, pt in xy plane": 1}, selected="origin, pt on positive x-axis, pt in xy plane")
rec = PythonScript(msg=pose, rec=get, clear=clear)  # -> rec; inputs msg: list
# ---------- rec: Python ----------
from scriptcontext import sticky as st

guid = str(ghenv.Component.InstanceGuid)
recorded_key =  "recorded_" + guid
just_cleared_key = "just_cleared_" + guid


if recorded_key not in st:
    st[recorded_key] = []

if just_cleared_key not in st:
    st[just_cleared_key] = False

if clear:
    st[recorded_key] = []
    st[just_cleared_key] = True
else:
    if len(msg):
        if msg != [None] and not st[just_cleared_key] and rec:
            st[recorded_key].append(msg)
    st[just_cleared_key] = False
        


rec = st[recorded_key]

print rec
# ---------- end rec ----------
calc_base = PythonScript(poses=rec, input_type=list_7)  # -> out; inputs poses: list
# ---------- calc_base: Python ----------
import Rhino.Geometry as rg
import math

print poses
if len(poses) > 2:
    
    
    O = poses[0]
    P1 = poses[1]
    P2 = poses[2]
    
    if input_type == 0:
        # origin, pt on positive x-axis, pt in xy plane
        origin = rg.Point3d(O[0], O[1], O[2])
        pt_on_xaxis = rg.Point3d(P1[0], P1[1], P1[2])
        pt_in_xyplane = rg.Point3d(P2[0], P2[1], P2[2])
        
        xaxis = pt_on_xaxis - origin
        xaxis.Unitize()
        
        v = pt_in_xyplane - origin
        zaxis = rg.Vector3d.CrossProduct(v, xaxis)
        zaxis.Unitize()
        
        # zaxis must look up!
        if math.acos(rg.Vector3d.ZAxis * zaxis) > math.acos(rg.Vector3d.ZAxis * -zaxis):
            zaxis = -zaxis
        
        yaxis = rg.Vector3d.CrossProduct(zaxis, xaxis)
    
    elif input_type == 1:
        # origin, pt on positive y-axis, pt in xy plane
        origin = rg.Point3d(O[0], O[1], O[2])
        pt_on_yaxis = rg.Point3d(P1[0], P1[1], P1[2])
        pt_in_xyplane = rg.Point3d(P2[0], P2[1], P2[2])
        
        yaxis = pt_on_yaxis - origin
        yaxis.Unitize()
        
        v = pt_in_xyplane - origin
        zaxis = rg.Vector3d.CrossProduct(v, yaxis)
        zaxis.Unitize()
        
        # zaxis must look up!
        if math.acos(rg.Vector3d.ZAxis * zaxis) > math.acos(rg.Vector3d.ZAxis * -zaxis):
            zaxis = -zaxis
        
        xaxis = rg.Vector3d.CrossProduct(yaxis, zaxis)
        
        
    print "Copy the following into base component:"
    print " "
    print "origin = [%.2f, %.2f, %.2f]" % tuple(list(origin))
    print "xaxis = [%.5f, %.5f, %.5f]" % tuple(list(xaxis))
    print "yaxis = [%.5f, %.5f, %.5f]" % tuple(list(yaxis))
    

#print rg.Vector3d.CrossProduct(rg.Vector3d.YAxis, rg.Vector3d.ZAxis)
#print rg.Vector3d.CrossProduct(rg.Vector3d.ZAxis, rg.Vector3d.XAxis)
# ---------- end calc_base ----------
panel_32 = Panel(rec)
panel_33 = Panel(calc_base)

# ----
# Calculate basis
clear_2 = Button()
list_8 = ValueList({"origin, pt on positive x-axis, pt in xy plane": 0, "origin, pt on positive y-axis, pt in xy plane": 1}, selected="origin, pt on positive x-axis, pt in xy plane")
rec_2 = PythonScript(msg=pose_3, rec=get_3, clear=clear_2)  # -> rec; inputs msg: list; same code as rec
calc_base_2 = PythonScript(poses=rec_2, input_type=list_8)  # -> out; inputs poses: list
# ---------- calc_base_2: Python ----------
import Rhino.Geometry as rg
import math

print poses
if len(poses) > 2:
    
    O = poses[0]
    P1 = poses[1]
    P2 = poses[2]
    
    if input_type == 0:
        # origin, pt on positive x-axis, pt in xy plane
        origin = rg.Point3d(O[0], O[1], O[2])
        pt_on_xaxis = rg.Point3d(P1[0], P1[1], P1[2])
        pt_in_xyplane = rg.Point3d(P2[0], P2[1], P2[2])
        
        xaxis = pt_on_xaxis - origin
        xaxis.Unitize()
        
        v = pt_in_xyplane - origin
        zaxis = rg.Vector3d.CrossProduct(v, xaxis)
        zaxis.Unitize()
        
        # zaxis must look up!
        if math.acos(rg.Vector3d.ZAxis * zaxis) > math.acos(rg.Vector3d.ZAxis * -zaxis):
            zaxis = -zaxis
        
        yaxis = rg.Vector3d.CrossProduct(zaxis, xaxis)
    
    elif input_type == 1:
        # origin, pt on positive y-axis, pt in xy plane
        origin = rg.Point3d(O[0], O[1], O[2])
        pt_on_yaxis = rg.Point3d(P1[0], P1[1], P1[2])
        pt_in_xyplane = rg.Point3d(P2[0], P2[1], P2[2])
        
        yaxis = pt_on_yaxis - origin
        yaxis.Unitize()
        
        v = pt_in_xyplane - origin
        zaxis = rg.Vector3d.CrossProduct(v, yaxis)
        zaxis.Unitize()
        
        # zaxis must look up!
        if math.acos(rg.Vector3d.ZAxis * zaxis) > math.acos(rg.Vector3d.ZAxis * -zaxis):
            zaxis = -zaxis
        
        xaxis = rg.Vector3d.CrossProduct(yaxis, zaxis)
        
        
    print "Copy the following into base component:"
    print " "
    print "origin = [%.2f, %.2f, %.2f]" % tuple(list(origin))
    print "xaxis = [%.5f, %.5f, %.5f]" % tuple(list(xaxis))
    print "yaxis = [%.5f, %.5f, %.5f]" % tuple(list(yaxis))
    

#print rg.Vector3d.CrossProduct(rg.Vector3d.YAxis, rg.Vector3d.ZAxis)
#print rg.Vector3d.CrossProduct(rg.Vector3d.ZAxis, rg.Vector3d.XAxis)
# ---------- end calc_base_2 ----------
panel_34 = Panel(rec_2)
panel_35 = Panel(calc_base_2)

number_slider_7 = Slider(4, range=0..1000)  # disabled
ghpython_script_3 = PythonScript(
    points=point_5,
    attractor=point_6,
    d=d,
    test=boolean_toggle,
    number_of_bars=number_slider_3,
    bar_len_min=number_slider_5,
    bar_len_max=number_slider_4,
    trys=number_slider_6,
    pickup_station_0=plane_2,
    start_end_position=plane_3)  # -> vert_endpts, vert_lns, edge_lns, fs, lines, b_struct; inputs points: list of Point3d, attractor: Point3d; disabled
# ---------- ghpython_script_3: Python ----------
from compas_ghpython import unload_modules
from compas_ghpython import utilities
from compas_ghpython.utilities import xdraw_frame
from compas_ghpython.artists.networkartist import NetworkArtist
from spatial_structures.bar_structure import Bar_Structure
from coop_assembly.geometry_generation.generate_triangles import generate_first_tetra, generate_structure_no_points
from coop_assembly.geometry_generation.fabrication_planes import generate_planes_glue
from coop_assembly.data_structure.data_structure_compas import Overall_Structure
from coop_assembly.help_functions.helpers_geometry import update_bar_lengths
from coop_assembly.help_functions.drawing import draw_network_inv_gh

import rhinoscriptsyntax as rs

        
unload_modules("coop_assembly")
        
def main():
            
    iterations = int(number_of_bars)
            
    points_compas = [(p[0],p[1],p[2]) for p in points]
    attr_compas = [attractor[0], attractor[1], attractor[2]]
            
    b_struct    = Bar_Structure()
    o_struct    = Overall_Structure(b_struct)
            
    b_struct, o_struct = generate_first_tetra(o_struct, b_struct, d/2, points_compas)
    update_bar_lengths(b_struct)
            
    b_struct = generate_structure_no_points(o_struct, b_struct, True, d/2, iterations, bar_len_min, bar_len_max, trys, attr=attr_compas)
        
            
    vert_endpts, vert_lns, edge_lns = draw_network_inv_gh(b_struct)
            
    global pickup_station_0, start_end_position
    
    pickup_station_0 = rhino_plane_to_frame(pickup_station_0)
    start_end_position = rhino_plane_to_frame(start_end_position)
            
    frames = generate_planes_glue(b_struct, d/2, pickup_station_0, iterations+5, start_end_position, start_end_position)
    print(frames)
    
#   list of three points of a frame (origin, x, y) 
    fs = []
    lines = []
    for frame in frames:
        ps = []
        for point in frame:
            p = rs.AddPoint(point)
            ps.append(p)
        fs.append(rs.PlaneFromPoints(ps[0], ps[1], ps[2]))
    for i in range(1, len(fs)):
        line = rs.AddLine(fs[i][0], fs[i-1][0])
        lines.append(line)
    return vert_endpts, vert_lns, edge_lns, fs, lines, b_struct
   
   
def rhino_plane_to_frame(plane):
# converts rhino planes to 3-pt frames
    origin = plane.Origin
    x_vec = plane.XAxis
    y_vec = plane.YAxis
    x_pt = [origin.X + x_vec.X, origin.Y + x_vec.Y, origin.Z + x_vec.Z]
    y_pt = [origin.X + y_vec.X, origin.Y + y_vec.Y, origin.Z + y_vec.Z]
    new_origin = [origin.X, origin.Y, origin.Z]
    pts = [origin, x_pt, y_pt]
    
    return pts
        
        
vert_endpts, vert_lns, edge_lns, fs, lines, b_struct = main()
# ---------- end ghpython_script_3 ----------
panel_36 = Panel(ghpython_script_3.fs)  # disabled

# ---- group: Define joint positions
base_4 = Slider(0, range=-360..360)
elbow = Slider(0, range=-360..360)
wrist2 = Slider(0, range=-360..360)
shoulder = Slider(0, range=-360..360)
wrist1 = Slider(0, range=-360..360)
wrist3 = Slider(0, range=-360..360)
ur1_q1_q6 = Data([base_4, shoulder, elbow, wrist1, wrist2, wrist3])

# ----
# Visualisation
planes_wcs = Plane(pln_3)
pose_joints = Data(pose_4)
robot_3 = Data(set_params_2)
back = Button()
reset = Button()
py_7 = GhPythonScript(joint_values=ur1_q1_q6)  # -> configuration; inputs joint_values: list
# ---------- py_7: Python ----------
import math
from compas_fab.robots import Configuration

configuration = Configuration.from_revolute_values([math.radians(d) for d in joint_values])
# ---------- end py_7 ----------

# ---- group: Define plane in WCS, calculate joint positions
pt_5 = Point(Point(-57.48867812, -568.9400192, 535.0971902))
xy = XYPlane(Origin=pt_5)
deplane = DeconstructPlane(Plane=xy)  # -> Origin, XAxis, YAxis, ZAxis
multiplication = Multiplication(A=deplane.XAxis, B=-1)
select_configuration = Slider(0, range=0..7)
pl_5 = ConstructPlane(Origin=deplane.Origin, XAxis=multiplication, YAxis=deplane.YAxis)
plane_wcs = Plane(pl_4)
inverse = PythonScript(robot2=robot_3, plane_WCS=plane_wcs, idx=select_configuration)  # -> configuration, plane_WCS; inputs plane_WCS: Plane, idx: Int32
# ---------- inverse: Python ----------
import Rhino.Geometry as rg
from compas.geometry import Frame, Transformation
import math


#plane_WCS.Rotate(math.radians(-10), plane_WCS.YAxis, plane_WCS.Origin)
#plane_WCS.Rotate(math.radians(-10), plane_WCS.ZAxis, plane_WCS.Origin)

plane_WCS.Rotate(math.radians(90), plane_WCS.ZAxis, plane_WCS.Origin)

tcp_WCS = Frame(plane_WCS.Origin, plane_WCS.XAxis, plane_WCS.YAxis)
#print tcp_WCS

# transform frame to robot2 coordinate system
#tool_plane_in_RCS = self.get_tool_plane_in_RCS(tp_WCS)
tcp_RCS = robot2.get_frame_in_RCS(tcp_WCS)

tool0_RCS = robot2.get_tool0_frame_from_tcp_frame(tcp_RCS)

# calculate solutions to frame
solutions = robot2.inverse_kinematics(tool0_RCS)

if not len(solutions):
    q = [0,0,0,0,0,0]
else:
    idx = min(len(solutions) - 1, idx)
    q = solutions[idx]
    
#print q

configuration = q
print configuration
# ---------- end inverse ----------

# ---- group: Calculate joint positions for path
# Add init joint states
joint_states = Data([-0.1728179112, -1.415058186, 1.813991282, -1.971940356, -1.571654205, -3.308720436])
init_configuration = Slider(2, range=0..7)
py_8 = PythonScript(robot2=robot_3, planes_WCS=planes_wcs, configuration_idx=init_configuration, init_configuration=joint_states)  # -> configurations; inputs planes_WCS: list, configuration_idx: Int32, init_configuration: list
# ---------- py_8: Python ----------
from compas_ghpython import unload_modules
unload_modules('ur_online_control')
import Rhino.Geometry as rg
from compas.geometry import Frame 
from compas.geometry.xforms import Transformation
from ur_online_control.ur.kinematics import calculate_configurations_for_path, format_joint_positions


# TODO this must be optimized! matrix multiplication!
frames_tool0_RCS = []
for plane_WCS in planes_WCS:
    tcp_WCS = Frame(plane_WCS.Origin, plane_WCS.XAxis, plane_WCS.YAxis)
    tcp_RCS = robot2.get_frame_in_RCS(tcp_WCS)
    frames_tool0_RCS.append(robot2.get_tool0_frame_from_tcp_frame(tcp_RCS))
    
print frames_tool0_RCS
#configurations = calculate_configurations_for_path(frames_tool0_RCS, robot2.params, init_configuration)
configurations = calculate_configurations_for_path(frames_tool0_RCS, robot2, init_configuration)
#print configurations
configurations = configurations[min([configuration_idx, len(configurations) - 1])]

def format(numbers, k=4):
    #numbers = format_joint_positions(numbers)
    return "[" + ", ".join([("%." + str(k) + "f") % n for n in numbers]) + "]"
# ---------- end py_8 ----------
start_3 = Button()
step = Button()
stop_5 = Button()
counter = CountThroughList(L=py_8, start=start_3, stop=stop_5, step=step, step_back=back, reset=reset, interval=100)  # -> item; inputs L: list, start: Boolean, stop: Boolean, step_back: Boolean
# ---------- counter: Python ----------
from scriptcontext import sticky as st
from compas_ghpython import update_component


# store data in component
guid = str(ghenv.Component.InstanceGuid)
counter_key = "counter_" + guid
running_key = "running_" + guid

if counter_key not in st:
    st[counter_key] = 0

if running_key not in st:
    st[running_key] = False

if start:
    st[running_key] = True

if stop:
    st[running_key] = False

if step:
    if st[counter_key] < len(L) - 1:
        st[counter_key] += 1

if step_back:
    if st[counter_key] < len(L) - 1:
        st[counter_key] -= 1

if reset:
    st[counter_key] = 0

if len(L):
    item = L[st[counter_key]]

if st[running_key]:
    if st[counter_key] < len(L) - 1:
        st[counter_key] += 1
        update_component(ghenv, interval)
    else:
        st[counter_key] = 0
        st[running_key] = False
# ---------- end counter ----------

# ---- group: Calculate joint positions for path / Shows joint positions along path
flip = BooleanToggle(True)
l2t = PythonScript(L=py_8, flip=flip)  # -> T; inputs L: list, flip: Boolean
# ---------- l2t: Python ----------
from compas_ghpython import list_to_ghtree
L = [l.values for l in L]

if flip:
    L = zip(*L)
T = list_to_ghtree(L)
# ---------- end l2t ----------
graph = QuickGraph(l2t, SortOrder=0)

# ---- group: Define joint positions
base_5 = Slider(-329.599, range=-360..360)
elbow_2 = Slider(-111.454, range=-360..360)
wrist2_2 = Slider(-82.725, range=-360..360)
shoulder_2 = Slider(-49.479, range=-360..360)
wrist1_2 = Slider(-190.504, range=-360..360)
wrist3_2 = Slider(91.571, range=-360..360)
ur1_q1_q6_2 = Data([base_5, shoulder_2, elbow_2, wrist1_2, wrist2_2, wrist3_2])

# ----
# Visualisation
planes_wcs_2 = Plane(pln_4)
pose_joints_2 = Data(pose_2)
robot_4 = Data(set_params)
back_2 = Button()
reset_2 = Button()
py_9 = GhPythonScript(joint_values=ur1_q1_q6_2)  # -> configuration; inputs joint_values: list; same code as py_7

# ---- group: Define plane in WCS, calculate joint positions
pt_6 = Point(Point(-57.48867812, -568.9400192, 535.0971902))
xy_2 = XYPlane(Origin=pt_6)
deplane_2 = DeconstructPlane(Plane=xy_2)  # -> Origin, XAxis, YAxis, ZAxis
multiplication_2 = Multiplication(A=deplane_2.XAxis, B=-1)
select_configuration_2 = Slider(0, range=0..7)
pl_6 = ConstructPlane(Origin=deplane_2.Origin, XAxis=multiplication_2, YAxis=deplane_2.YAxis)
plane_wcs_2 = Plane(pl_3)
inverse_2 = PythonScript(robot1=robot_4, plane_WCS=plane_wcs_2, idx=select_configuration_2)  # -> configuration, plane_WCS; inputs plane_WCS: Plane, idx: Int32
# ---------- inverse_2: Python ----------
import Rhino.Geometry as rg
from compas.geometry import Frame, Transformation
#from compas_ghpython import xdraw_frame
import math


#plane_WCS.Rotate(math.radians(-10), plane_WCS.YAxis, plane_WCS.Origin)
#plane_WCS.Rotate(math.radians(-10), plane_WCS.ZAxis, plane_WCS.Origin)

plane_WCS.Rotate(math.radians(90), plane_WCS.ZAxis, plane_WCS.Origin)

tcp_WCS = Frame(plane_WCS.Origin, plane_WCS.XAxis, plane_WCS.YAxis)
#print tcp_WCS

# transform frame to robot1 coordinate system
#tool_plane_in_RCS = self.get_tool_plane_in_RCS(tp_WCS)
tcp_RCS = robot1.get_frame_in_RCS(tcp_WCS)

tool0_RCS = robot1.get_tool0_frame_from_tcp_frame(tcp_RCS)

# calculate solutions to frame
solutions = robot1.inverse_kinematics(tool0_RCS)

if not len(solutions):
    q = [0,0,0,0,0,0]
else:
    idx = min(len(solutions) - 1, idx)
    q = solutions[idx]
    
#print q

configuration = q
print configuration
# ---------- end inverse_2 ----------

# ---- group: Calculate joint positions for path
# Add init joint states
joint_states_2 = Data([-0.1728179112, -1.415058186, 1.813991282, -1.971940356, -1.571654205, -3.308720436])
init_configuration_2 = Slider(2, range=0..7)
py_10 = PythonScript(robot1=robot_4, planes_WCS=planes_wcs_2, configuration_idx=init_configuration_2, init_configuration=joint_states_2)  # -> configurations; inputs planes_WCS: list, configuration_idx: Int32, init_configuration: list
# ---------- py_10: Python ----------
from compas_ghpython import unload_modules
unload_modules('ur_online_control')
import Rhino.Geometry as rg
from compas.geometry import Frame 
from compas.geometry.xforms import Transformation
#from compas_ghpython import xdraw_frame
from ur_online_control.ur.kinematics import calculate_configurations_for_path, format_joint_positions


# TODO this must be optimized! matrix multiplication!
frames_tool0_RCS = []
for plane_WCS in planes_WCS:
    tcp_WCS = Frame(plane_WCS.Origin, plane_WCS.XAxis, plane_WCS.YAxis)
    tcp_RCS = robot1.get_frame_in_RCS(tcp_WCS)
    frames_tool0_RCS.append(robot1.get_tool0_frame_from_tcp_frame(tcp_RCS))
    

#configurations = calculate_configurations_for_path(frames_tool0_RCS, robot1.params, init_configuration)
configurations = calculate_configurations_for_path(frames_tool0_RCS, robot1, init_configuration)
#print configurations
configurations = configurations[min([configuration_idx, len(configurations) - 1])]

def format(numbers, k=4):
    #numbers = format_joint_positions(numbers)
    return "[" + ", ".join([("%." + str(k) + "f") % n for n in numbers]) + "]"
# ---------- end py_10 ----------
start_4 = Button()
step_2 = Button()
stop_6 = Button()
counter_2 = CountThroughList(L=py_10, start=start_4, stop=stop_6, step=step_2, step_back=back_2, reset=reset_2, interval=100)  # -> item; inputs L: list, start: Boolean, stop: Boolean, step_back: Boolean; same code as counter

# ---- group: Calculate joint positions for path / Shows joint positions along path
flip_2 = BooleanToggle(True)
l2t_2 = PythonScript(L=py_10, flip=flip_2)  # -> T; inputs L: list, flip: Boolean; same code as l2t
graph_2 = QuickGraph(l2t_2, SortOrder=0)

# ----
list_item_6 = ListItem(List=panel_36, Index=number_slider_7, Wrap=True)  # disabled
line_3 = Line(ghpython_script_3.lines)  # disabled
division = Division(A=d, B=2)  # disabled
number_slider_8 = Slider(8, range=0..10)  # disabled
panel_37 = Panel(list_item_6)  # disabled
plane_4 = Plane(ghpython_script_3.fs)  # disabled
pipe_2 = Pipe(Curve=ghpython_script_3.vert_lns, Radius=division, Caps=0)  # -> flatten(Pipe); disabled
ghpython_script_4 = GhPythonScript(b_struct=ghpython_script_3.b_struct)  # -> out, planes, planes_all; disabled
# ---------- ghpython_script_4: Python ----------
import Rhino.Geometry as rg

planes = []
for v in b_struct.vertex:
    gp = b_struct.vertex[v]["gripping_plane"]
    pl = rg.Plane(rg.Point3d(gp[0][0], gp[0][1],gp[0][2]), rg.Point3d(gp[1][0], gp[1][1],gp[1][2]), rg.Point3d(gp[2][0], gp[2][1],gp[2][2]))
    planes.append(pl)

planes_all = []
for i,v in enumerate(b_struct.vertex):
    gp_all = b_struct.vertex[v]["gripping_planes_all"]
    planes_all.append([])
    for gp in gp_all:
        pl = rg.Plane(rg.Point3d(gp[0][0], gp[0][1],gp[0][2]), rg.Point3d(gp[1][0], gp[1][1],gp[1][2]), rg.Point3d(gp[2][0], gp[2][1],gp[2][2]))
        planes_all[i].append(pl)
# ---------- end ghpython_script_4 ----------
ur10_brep = UR10Brep([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])

# ---- group: Visualise / robot model brep
py_11 = PythonScript(model=list_6)  # -> n
# ---------- py_11: Python ----------
if model == "UR5":
    n = 0
if model == "UR10":
    n = 1
if model == "UR3":
    n = 2


#n = 2 
print n
# ---------- end py_11 ----------
ur10_brep_2 = UR10Brep([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])
ur5_brep = UR5Brep([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])
show_brep = BooleanToggle(True)
filter = StreamFilter(Gate=py_11, Stream0=ur5_brep, Stream1=ur10_brep_2, Stream2=ur10_brep)

# ---- group: Visualise
# Choose from different options, which robot configuration to visualise
list_9 = ValueList({"0 forward, from angles": 0, "1 inverse, from one plane": 1, "2 inverse, from multiple planes": 2, "3 forward, from robot": 3, "4 forward, from robot during runtime": 4}, selected="0 forward, from angles")
filter_2 = StreamFilter(
    Gate=list_9,
    Stream0=py_7,
    Stream1=inverse.configuration,
    Stream2=counter,
    Stream3=pose_joints,
    Stream4=send_6.pose_joints)
draw_3 = PythonScript(robot2=set_params_2, configuration=filter_2, mesh=filter, brep=filter, show_brep=show_brep)  # -> meshes, tool0_plane, tcp_plane, robot_brep, list_degree; inputs mesh: list, brep: list, show_brep: Boolean
# ---------- draw_3: Python ----------
from compas_ghpython import unload_modules
unload_modules("ur_online_control")

from compas_ghpython import draw_frame
from compas_ghpython import mesh_draw
from compas_ghpython.geometry.xforms import xform_from_transformation
from compas.geometry import Frame
from compas.geometry.xforms import Transformation
from compas_fab.robots import Configuration

import Rhino.Geometry as rg
import Rhino
import math

def mesh_update_vertices(mesh, vertices):
    for i in range(len(vertices)):
        mesh.vertex[i].update({'x': vertices[i][0], 'y': vertices[i][1], 'z': vertices[i][2]})

if configuration:
    list_joint_values = configuration.data["values"]
    list_degree = []
    for degree in list_joint_values:
        degree = math.degrees(degree)
        list_degree.append(degree)
    print list_degree
    #q = BaseConfiguration.from_joints(configuration)
    q = configuration
    print q
    #print q.joint_values
    
    #print robot2.get_forward_transformations(q)
    R0, R1, R2, R3, R4, R5 = robot2.get_forward_transformations(q)
    
    tool0_frame2 = robot2.tool0_frame.transformed(R5)
    tcp_frame2 = Frame.from_transformation(Transformation.from_frame(tool0_frame2) * robot2.transformation_tool0_tcp)
    
    #print robot2.transformation_tool0_tcp
    #print robot2.transformation_tcp_tool0
    #print robot2.transformation_tool0_tcp * robot2.transformation_tcp_tool0
    #print tcp_frame2
    tcp_frame2 = Frame.from_transformation(Transformation.from_frame(tool0_frame2) * robot2.transformation_tcp_tool0)
    #print tcp_frame2
    
    tool0_frame, tcp_frame = robot2.get_transformed_tool_frames(R5)
    
    tool0_frame = tool0_frame2
    tcp_frame = tcp_frame2
    
    m0, m1, m2, m3, m4, m5 = mesh
    for i in range(6):
        exec("R%drg = xform_from_transformation(R%d)" % (i, i))
        exec("m%d.Transform(R%drg)" % (i, i))
    meshes = [m0, m1, m2, m3, m4, m5]
    #print meshes
    mt = robot2.tool.get_transformed_model(Transformation.from_frame(tool0_frame))
    
    if mt:
        meshes.extend(map(mesh_draw, mt))
    
    """
    m0, m1, m2, m3, m4, m5, tool0_frame, tcp_frame = robot2.get_transformed_model(q)
    mt = robot2.get_transformed_tool_model(tcp_frame)
    
    meshes = []
    meshes.append(mesh_draw(m0))
    meshes.append(mesh_draw(m1))
    meshes.append(mesh_draw(m2))
    meshes.append(mesh_draw(m3))
    meshes.append(mesh_draw(m4))
    meshes.append(mesh_draw(m5))
    if mt:
        meshes.append(mesh_draw(mt))
    
    """
    
    tool0_plane = draw_frame(tool0_frame)
    tcp_plane = draw_frame(tcp_frame)
    
    if show_brep:
        
        b0, b1, b2, b3, b4, b5 = brep
        
        b0.Transform(R0rg)
        b1.Transform(R1rg)
        b2.Transform(R2rg)
        b3.Transform(R3rg)
        b4.Transform(R4rg)
        b5.Transform(R5rg)
        
        robot2_brep = [b0, b1, b2, b3, b4, b5]
        print robot2_brep

#print brep
# ---------- end draw_3 ----------
tool0_plane = Plane(draw_3.tool0_plane)
robot_brep = Brep(draw_3.robot_brep)
mesh = Mesh(draw_3.meshes)
preview_7 = CustomPreview(Geometry=mesh, Shader=ColourSwatch(SwatchColor=RGBA(145, 207, 200, 82)))
tcp_plane = Plane(draw_3.tcp_plane)
draw_4 = RepresentPlaneAsLines(plane=[tcp_plane, tool0_plane], size=100)  # -> G, C
# ---------- draw_4: Python ----------
import Rhino.Geometry as rg
from System.Drawing import Color

if plane:

    G = []
    G.append(rg.Line(plane.Origin, size * plane.XAxis))
    G.append(rg.Line(plane.Origin, size * plane.YAxis))
    G.append(rg.Line(plane.Origin, size * plane.ZAxis))
    
    C = []
    C.append(Color.FromArgb(255, 0, 0))
    C.append(Color.FromArgb(0, 255, 0))
    C.append(Color.FromArgb(0, 0, 255))
# ---------- end draw_4 ----------
preview_8 = CustomPreview(Geometry=draw_4.G, Shader=draw_4.C)

# ----
number = Slider(0, range=0..10)
panel_38 = Panel("set digital out")
value = BooleanToggle(False)
digital_out = PythonScript(number=number, value=value)  # -> script; inputs number: Int32, value: Boolean
# ---------- digital_out: Python ----------
script = "def prog():\n"
script += "\ttextmsg(\">> program start\")\n"
script += "\tset_digital_out(%i, %s)\n" % (int(number), str(value))
script += "\ttextmsg(\"<< program end\")\n"
script += "end\n"
script += "prog()\n\n"

print script
# ---------- end digital_out ----------
send_7 = Button()
send_8 = Send(script=digital_out, send=send_7)
panel_39 = Panel(send_8)

panel_40 = Panel("move cartesian")
idx = Slider(0, range=0..100)
commands = Data(send_2.commands)
list_10 = ValueList({"send all positions": 0, "send only one position": 1}, selected="send all positions")
item = ListItem(List=commands, Index=idx, Wrap=True)
filter_3 = StreamFilter(Gate=list_10, Stream0=commands, Stream1=item)
movel = PythonScript(commands=filter_3)  # -> script; inputs commands: list
# ---------- movel: Python ----------
from scriptcontext import sticky as st

script_lines = []
for cmd in commands:
    #q, a=1.4, v=1.05, t=0, r=0)
    x, y, z, ax, ay, az, speed, radius = cmd
    script_lines.append("movel(p%s, v=%f, r=%f)" % (str([x/1000., y/1000., z/1000, ax, ay, az]), speed/1000., radius/1000.))

robot = st["robot"]
tool_angle_axis = list(robot.tool.tcp_frame.point) + robot.tool.tcp_frame.axis_angle_vector
x, y, z, ax, ay, az = tool_angle_axis

script = "def prog():\n"
script += "\ttextmsg(\">> program start\")\n"
script += "\tset_tcp(p%s)\n" % str([x/1000., y/1000., z/1000, ax, ay, az])
script += "".join(["\t%s\n" % line for line in script_lines])
script += "\ttextmsg(\"<< program end\")\n"
script += "end\n"
script += "prog()\n\n"

print script
# ---------- end movel ----------
send_9 = Button()
send_10 = Send(script=movel, send=send_9)
panel_41 = Panel(send_10)

ur10_brep_3 = UR10Brep([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])

# ---- group: Visualise / robot model brep
py_12 = PythonScript(model=list_3)  # -> n; same code as py_11
ur10_brep_4 = UR10Brep([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])
ur5_brep_2 = UR5Brep([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])
show_brep_2 = BooleanToggle(True)
filter_4 = StreamFilter(Gate=py_12, Stream0=ur5_brep_2, Stream1=ur10_brep_4, Stream2=ur10_brep_3)

# ---- group: Visualise
# Choose from different options, which robot configuration to visualise
list_11 = ValueList({"0 forward, from angles": 0, "1 inverse, from one plane": 1, "2 inverse, from multiple planes": 2, "3 forward, from robot": 3, "4 forward, from robot during runtime": 4}, selected="0 forward, from angles")
filter_5 = StreamFilter(
    Gate=list_11,
    Stream0=py_9,
    Stream1=inverse_2.configuration,
    Stream2=counter_2,
    Stream3=pose_joints_2,
    Stream4=send_3.pose_joints)
draw_5 = PythonScript(robot1=robot_4, configuration=filter_5, mesh=filter_4, brep=filter_4, show_brep=show_brep_2)  # -> meshes, tool0_plane, tcp_plane, robot_brep, list_degree; inputs mesh: list, brep: list, show_brep: Boolean
# ---------- draw_5: Python ----------
from compas_ghpython import unload_modules
unload_modules("ur_online_control")

from compas_ghpython import draw_frame
from compas_ghpython import mesh_draw
from compas_ghpython.geometry.xforms import xform_from_transformation
from compas.geometry import Frame
from compas.geometry.xforms import Transformation
from compas_fab.robots import Configuration

import Rhino.Geometry as rg
import Rhino
import math

def mesh_update_vertices(mesh, vertices):
    for i in range(len(vertices)):
        mesh.vertex[i].update({'x': vertices[i][0], 'y': vertices[i][1], 'z': vertices[i][2]})

if configuration:
    list_joint_values = configuration.data["values"]
    list_degree = []
    for degree in list_joint_values:
        degree = math.degrees(degree)
        list_degree.append(degree)
    print list_degree
    #q = BaseConfiguration.from_joints(configuration)
    q = configuration
    print q
    #print q.joint_values
    
    #print robot1.get_forward_transformations(q)
    R0, R1, R2, R3, R4, R5 = robot1.get_forward_transformations(q)
    
    tool0_frame2 = robot1.tool0_frame.transformed(R5)
    tcp_frame2 = Frame.from_transformation(Transformation.from_frame(tool0_frame2) * robot1.transformation_tool0_tcp)
    
    #print robot1.transformation_tool0_tcp
    #print robot1.transformation_tcp_tool0
    #print robot1.transformation_tool0_tcp * robot1.transformation_tcp_tool0
    #print tcp_frame2
    tcp_frame2 = Frame.from_transformation(Transformation.from_frame(tool0_frame2) * robot1.transformation_tcp_tool0)
    #print tcp_frame2
    
    tool0_frame, tcp_frame = robot1.get_transformed_tool_frames(R5)
    
    tool0_frame = tool0_frame2
    tcp_frame = tcp_frame2
    
    m0, m1, m2, m3, m4, m5 = mesh
    for i in range(6):
        exec("R%drg = xform_from_transformation(R%d)" % (i, i))
        exec("m%d.Transform(R%drg)" % (i, i))
    meshes = [m0, m1, m2, m3, m4, m5]
    #print meshes
    mt = robot1.tool.get_transformed_model(Transformation.from_frame(tool0_frame))
    
    if mt:
        meshes.extend(map(mesh_draw, mt))
    
    """
    m0, m1, m2, m3, m4, m5, tool0_frame, tcp_frame = robot1.get_transformed_model(q)
    mt = robot1.get_transformed_tool_model(tcp_frame)
    
    meshes = []
    meshes.append(mesh_draw(m0))
    meshes.append(mesh_draw(m1))
    meshes.append(mesh_draw(m2))
    meshes.append(mesh_draw(m3))
    meshes.append(mesh_draw(m4))
    meshes.append(mesh_draw(m5))
    if mt:
        meshes.append(mesh_draw(mt))
    
    """
    
    tool0_plane = draw_frame(tool0_frame)
    tcp_plane = draw_frame(tcp_frame)
    
    if show_brep:
        
        b0, b1, b2, b3, b4, b5 = brep
        
        b0.Transform(R0rg)
        b1.Transform(R1rg)
        b2.Transform(R2rg)
        b3.Transform(R3rg)
        b4.Transform(R4rg)
        b5.Transform(R5rg)
        
        robot_brep = [b0, b1, b2, b3, b4, b5]
        print robot_brep

#print brep
# ---------- end draw_5 ----------
tool0_plane_2 = Plane(draw_5.tool0_plane)
robot_brep_2 = Brep(draw_5.robot_brep)
mesh_2 = Mesh(draw_5.meshes)
preview_9 = CustomPreview(Geometry=mesh_2, Shader=ColourSwatch(SwatchColor=RGBA(145, 207, 200, 82)))
tcp_plane_2 = Plane(draw_5.tcp_plane)
draw_6 = RepresentPlaneAsLines(plane=[tcp_plane_2, tool0_plane_2], size=100)  # -> G, C; same code as draw_4
preview_10 = CustomPreview(Geometry=draw_6.G, Shader=draw_6.C)

# ----
idx_2 = Slider(0, range=0..100)
panel_42 = Panel("move joints")
joint_configurations = Data(filter_5)
list_12 = ValueList({"send all positions": 0, "send only one position": 1}, selected="send only one position")
item_2 = ListItem(List=joint_configurations, Index=idx_2, Wrap=True)
filter_6 = StreamFilter(Gate=list_12, Stream0=joint_configurations, Stream1=item_2)
movej = PythonScript(joint_configurations=filter_6, velocity=Slider(100, range=0..200))  # -> script; inputs joint_configurations: list
# ---------- movej: Python ----------
script_lines = []


for configuration in joint_configurations:
    #print configuration.joint_values
    script_lines.append("movej(%s, v=%f)" % (str(configuration.values), velocity/1000.))


script = "def prog():\n"
script += "\ttextmsg(\">> program start\")\n"
script += "".join(["\t%s\n" % line for line in script_lines])
script += "\ttextmsg(\"<< program end\")\n"
script += "end\n"
script += "prog()\n\n"


print script

#script = ""
# ---------- end movej ----------
send_11 = Button()
send_12 = Send(script=movej, send=send_11)
panel_43 = Panel(send_12)

idx_3 = Slider(0, range=0..100)
joint_configurations_2 = Data(filter_2)
list_13 = ValueList({"send all positions": 0, "send only one position": 1}, selected="send only one position")
item_3 = ListItem(List=joint_configurations_2, Index=idx_3, Wrap=True)
filter_7 = StreamFilter(Gate=list_13, Stream0=joint_configurations_2, Stream1=item_3)
movej_2 = PythonScript(joint_configurations=filter_7, velocity=Slider(100, range=0..200))  # -> script; inputs joint_configurations: list; same code as movej
send_13 = Button()
send_14 = Send(script=movej_2, send=send_13)
panel_45 = Panel(send_14)

number_2 = Slider(0, range=0..10)
value_2 = BooleanToggle(False)
digital_out_2 = PythonScript(number=number_2, value=value_2)  # -> script; inputs number: Int32, value: Boolean; same code as digital_out
send_15 = Button()
send_16 = Send(script=digital_out_2, send=send_15)
panel_47 = Panel(send_16)

idx_4 = Slider(0, range=0..100)
commands_2 = Data(send_5.commands)
list_14 = ValueList({"send all positions": 0, "send only one position": 1}, selected="send all positions")
item_4 = ListItem(List=commands_2, Index=idx_4, Wrap=True)
filter_8 = StreamFilter(Gate=list_14, Stream0=commands_2, Stream1=item_4)
movel_2 = PythonScript(commands=filter_8)  # -> script; inputs commands: list
# ---------- movel_2: Python ----------
from scriptcontext import sticky as st

script_lines = []
for cmd in commands:
    #q, a=1.4, v=1.05, t=0, r=0)
    x, y, z, ax, ay, az, speed, radius = cmd
    script_lines.append("movel(p%s, v=%f, r=%f)" % (str([x/1000., y/1000., z/1000, ax, ay, az]), speed/1000., radius/1000.))

robot2 = st["robot2"]
tool_angle_axis = list(robot2.tool.tcp_frame.point) + robot2.tool.tcp_frame.axis_angle_vector
x, y, z, ax, ay, az = tool_angle_axis

script = "def prog():\n"
script += "\ttextmsg(\">> program start\")\n"
script += "\tset_tcp(p%s)\n" % str([x/1000., y/1000., z/1000, ax, ay, az])
script += "".join(["\t%s\n" % line for line in script_lines])
script += "\ttextmsg(\"<< program end\")\n"
script += "end\n"
script += "prog()\n\n"

print script
# ---------- end movel_2 ----------
send_17 = Button()
send_18 = Send(script=movel_2, send=send_17)
panel_49 = Panel(send_18)

list_item_7 = ListItem(List=ghpython_script_4.planes_all, Index=0, Wrap=True)  # disabled
list_item_8 = ListItem(List=pipe_2, Index=number_slider_8, Wrap=True)  # disabled
list_item_9 = ListItem(List=ghpython_script_4.planes, Index=number_slider_8, Wrap=True)  # disabled
custom_preview_3 = CustomPreview(
    Geometry=list_item_8,
    Material={diffuse=RGB(221, 160, 221), emission=RGB(66, 48, 66), shine=0.5, specular=RGB(255, 255, 255), transparency=0})  # disabled
custom_preview_4 = CustomPreview(
    Geometry=list_item_9,
    Material={diffuse=RGB(221, 160, 221), emission=RGB(66, 48, 66), shine=0.5, specular=RGB(255, 255, 255), transparency=0})  # disabled
panel_50 = Panel(draw_3.list_degree)
panel_51 = Panel(draw_5.list_degree)

# ----
# move incremental in WCS
number_slider_9 = Slider(5, range=-10..10)
list_15 = ValueList({"xaxis", "yaxis", "zaxis"}, selected="zaxis")
movel_3 = PythonScript(step_size=number_slider_9, direction=list_15)  # -> script
# ---------- movel_3: Python ----------
from scriptcontext import sticky as st

robot = st["robot1"]
tool_angle_axis = list(robot.tool.tcp_frame.point) + robot.tool.tcp_frame.axis_angle_vector
x, y, z, ax, ay, az = tool_angle_axis

script = "def prog():\n"
script += "\ttextmsg(\">> program start\")\n"
script += "\tset_tcp(p%s)\n" % str([x/1000., y/1000., z/1000, ax, ay, az])
script += "\tcurrent_pose = get_forward_kin()\n"


if direction == "xaxis":
    script += "\tmovel(p[current_pose[0] + %f, current_pose[1], current_pose[2], current_pose[3], current_pose[4], current_pose[5]], t=%f)\n" % (step_size/1000., step_size * 0.1)

elif direction == "yaxis":
    script += "\tmovel(p[current_pose[0], current_pose[1] + %f, current_pose[2], current_pose[3], current_pose[4], current_pose[5]], t=%f)\n" % (step_size/1000., step_size * 0.1)

else: # direction == "zaxis":
    script += "\tmovel(p[current_pose[0], current_pose[1], current_pose[2] + %f, current_pose[3], current_pose[4], current_pose[5]], t=%f)\n" % (step_size/1000., step_size * 0.1)

script += "\ttextmsg(\"<< program end\")\n"
script += "end\n"
script += "prog()\n\n"

print script
# ---------- end movel_3 ----------
send_19 = Button()
send_20 = Send(script=movel_3, send=send_19)
panel_52 = Panel(send_20)

panel_53 = Panel("reorient tool vertical")
movel_4 = PythonScript()  # -> script
# ---------- movel_4: Python ----------
from scriptcontext import sticky as st

robot1 = st["robot1"]
tool_angle_axis = list(robot1.tool.tcp_frame.point) + robot1.tool.tcp_frame.axis_angle_vector
x, y, z, ax, ay, az = tool_angle_axis

script = "def prog():\n"
script += "\ttextmsg(\">> program start\")\n"
script += "\tset_tcp(p%s)\n" % str([x/1000., y/1000., z/1000, ax, ay, az])
script += "\tcurrent_pose = get_forward_kin()\n"
script += "\tmovel(p[current_pose[0], current_pose[1], current_pose[2], 0, 0, 0], a=0.1, v=0.1)\n"
script += "\ttextmsg(\"<< program end\")\n"
script += "end\n"
script += "prog()\n\n"

print script
# ---------- end movel_4 ----------
send_21 = Button()
send_22 = Send(script=movel_4, send=send_21)
panel_54 = Panel(send_22)

# ----
# move incremental in TCS
number_slider_10 = Slider(5, range=-10..10)
get_current_pose = Button()
list_16 = ValueList({"xaxis", "yaxis", "zaxis"}, selected="yaxis")
movel_5 = PythonScript(get=get_current_pose, step_size=number_slider_10, direction=list_16)  # -> script; inputs get: list
# ---------- movel_5: Python ----------
from scriptcontext import sticky as st
from compas.geometry import Frame
from compas.geometry import Point, Vector
from ur_online_control.ur_direct import get_current_pose_cartesian

server_address = st["server_address"]
server_port = 30005
ur_ip = st["ur_ip"]
robot = st["robot"]
tool_angle_axis = list(robot.tool.tcp_frame.point) + robot.tool.tcp_frame.axis_angle_vector
print tool_angle_axis

guid = str(ghenv.Component.InstanceGuid)
pose_cartesian_key = "pose_cartesian" + guid

if get:
    st[pose_cartesian_key] = get_current_pose_cartesian(server_address, server_port, ur_ip, tool_angle_axis)

if pose_cartesian_key not in st:
    pose_cartesian = []
    script = ""
else:
    pose_cartesian = st[pose_cartesian_key]

    robot = st["robot"]
    tool_angle_axis = list(robot.tool.tcp_frame.point) + robot.tool.tcp_frame.axis_angle_vector
    x, y, z, ax, ay, az = tool_angle_axis
    
    script = "def prog():\n"
    script += "\ttextmsg(\">> program start\")\n"
    script += "\tset_tcp(p%s)\n" % str([x/1000., y/1000., z/1000, ax, ay, az])
    script += "\tcurrent_pose = get_forward_kin()\n"
    
#    frame = Frame.from_pose_axis_angle_vector(pose_cartesian)
    frame = Frame.from_axis_angle_vector([ax, ay, az])
    frame.point = [x, y, z]

    if direction == "xaxis":
        next_vector = Vector(*frame.xaxis) * step_size
    elif direction == "yaxis":
        next_vector = Vector(*frame.yaxis) * step_size
    else: # direction == "zaxis":
        next_vector = Vector(*frame.zaxis) * step_size
    
    x, y, z = next_vector
    script += "\tmovel(p[current_pose[0] + %f, current_pose[1] + %f, current_pose[2] + %f, current_pose[3], current_pose[4], current_pose[5]], t=%f)\n" % (x/1000., y/1000., z/1000., step_size * 0.1)
    
    script += "\ttextmsg(\"<< program end\")\n"
    script += "end\n"
    script += "prog()\n\n"
    
    print script
# ---------- end movel_5 ----------
send_23 = Button()
send_24 = Send(script=movel_5, send=send_23)
panel_55 = Panel(send_24)

# ----
# move incremental in TCS
number_slider_11 = Slider(5, range=-10..10)
get_current_pose_2 = Button()
list_17 = ValueList({"xaxis", "yaxis", "zaxis"}, selected="yaxis")
movel_6 = PythonScript(get=get_current_pose_2, step_size=number_slider_11, direction=list_17)  # -> script; inputs get: list
# ---------- movel_6: Python ----------
from scriptcontext import sticky as st
from compas.geometry import Frame
from compas.geometry import Point, Vector
from ur_online_control.ur_direct import get_current_pose_cartesian

server_address = st["server_address"]
server_port = 30005
ur_ip2 = st["ur_ip2"]
robot2 = st["robot2"]
tool_angle_axis = list(robot2.tool.tcp_frame.point) + robot2.tool.tcp_frame.axis_angle_vector
print tool_angle_axis

guid = str(ghenv.Component.InstanceGuid)
pose_cartesian_key = "pose_cartesian" + guid

if get:
    st[pose_cartesian_key] = get_current_pose_cartesian(server_address, server_port, ur_ip2, tool_angle_axis)

if pose_cartesian_key not in st:
    pose_cartesian = []
    script = ""
else:
    pose_cartesian = st[pose_cartesian_key]

    robot2 = st["robot2"]
    tool_angle_axis = list(robot2.tool.tcp_frame.point) + robot2.tool.tcp_frame.axis_angle_vector
    x, y, z, ax, ay, az = tool_angle_axis
    
    script = "def prog():\n"
    script += "\ttextmsg(\">> program start\")\n"
    script += "\tset_tcp(p%s)\n" % str([x/1000., y/1000., z/1000, ax, ay, az])
    script += "\tcurrent_pose = get_forward_kin()\n"
    
#    frame = Frame.from_pose_axis_angle_vector(pose_cartesian)
    frame = Frame.from_axis_angle_vector([ax, ay, az])
    frame.point = [x, y, z]

    if direction == "xaxis":
        next_vector = Vector(*frame.xaxis) * step_size
    elif direction == "yaxis":
        next_vector = Vector(*frame.yaxis) * step_size
    else: # direction == "zaxis":
        next_vector = Vector(*frame.zaxis) * step_size
    
    x, y, z = next_vector
    script += "\tmovel(p[current_pose[0] + %f, current_pose[1] + %f, current_pose[2] + %f, current_pose[3], current_pose[4], current_pose[5]], t=%f)\n" % (x/1000., y/1000., z/1000., step_size * 0.1)
    
    script += "\ttextmsg(\"<< program end\")\n"
    script += "end\n"
    script += "prog()\n\n"
    
    print script
# ---------- end movel_6 ----------
send_25 = Button()
send_26 = Send(script=movel_6, send=send_25)
panel_56 = Panel(send_26)

# ----
# move incremental in WCS
number_slider_12 = Slider(5, range=-10..10)
list_18 = ValueList({"xaxis", "yaxis", "zaxis"}, selected="zaxis")
movel_7 = PythonScript(step_size=number_slider_12, direction=list_18)  # -> script
# ---------- movel_7: Python ----------
from scriptcontext import sticky as st

robot2 = st["robot2"]
tool_angle_axis = list(robot2.tool.tcp_frame.point) + robot2.tool.tcp_frame.axis_angle_vector
x, y, z, ax, ay, az = tool_angle_axis

script = "def prog():\n"
script += "\ttextmsg(\">> program start\")\n"
script += "\tset_tcp(p%s)\n" % str([x/1000., y/1000., z/1000, ax, ay, az])
script += "\tcurrent_pose = get_forward_kin()\n"


if direction == "xaxis":
    script += "\tmovel(p[current_pose[0] + %f, current_pose[1], current_pose[2], current_pose[3], current_pose[4], current_pose[5]], t=%f)\n" % (step_size/1000., step_size * 0.1)

elif direction == "yaxis":
    script += "\tmovel(p[current_pose[0], current_pose[1] + %f, current_pose[2], current_pose[3], current_pose[4], current_pose[5]], t=%f)\n" % (step_size/1000., step_size * 0.1)

else: # direction == "zaxis":
    script += "\tmovel(p[current_pose[0], current_pose[1], current_pose[2] + %f, current_pose[3], current_pose[4], current_pose[5]], t=%f)\n" % (step_size/1000., step_size * 0.1)

script += "\ttextmsg(\"<< program end\")\n"
script += "end\n"
script += "prog()\n\n"

print script
# ---------- end movel_7 ----------
send_27 = Button()
send_28 = Send(script=movel_7, send=send_27)
panel_57 = Panel(send_28)

movel_8 = PythonScript()  # -> script
# ---------- movel_8: Python ----------
from scriptcontext import sticky as st

robot2 = st["robot2"]
tool_angle_axis = list(robot2.tool.tcp_frame.point) + robot2.tool.tcp_frame.axis_angle_vector
x, y, z, ax, ay, az = tool_angle_axis

script = "def prog():\n"
script += "\ttextmsg(\">> program start\")\n"
script += "\tset_tcp(p%s)\n" % str([x/1000., y/1000., z/1000, ax, ay, az])
script += "\tcurrent_pose = get_forward_kin()\n"
script += "\tmovel(p[current_pose[0], current_pose[1], current_pose[2], 0, 0, 0], a=0.1, v=0.1)\n"
script += "\ttextmsg(\"<< program end\")\n"
script += "end\n"
script += "prog()\n\n"

print script
# ---------- end movel_8 ----------
send_29 = Button()
send_30 = Send(script=movel_8, send=send_29)
panel_59 = Panel(send_30)

# ==== cluster Send
script = ClusterInput()
send = ClusterInput()
send_2 = PythonScript(script=script, send=send)  # -> out
# ---------- send_2: Python ----------
import socket
from scriptcontext import sticky as st

ur_ip = st["ur_ip"]
ur_port = 30002

if send:
    s = socket.create_connection((ur_ip, ur_port), timeout=0.5) 
    s.send(script)
    s.close()
# ---------- end send_2 ----------
out = ClusterOutput(send_2)

# ==== cluster Draw
frame = ClusterInput()
size = ClusterInput()
draw = PythonScript(frame=frame, size=size)  # -> G, C
# ---------- draw: Python ----------
import Rhino.Geometry as rg
from System.Drawing import Color

if not size:
    size = 100

if frame:
    
    plane = rg.Plane(rg.Point3d(*list(frame.point)), rg.Vector3d(*list(frame.xaxis)), rg.Vector3d(*list(frame.yaxis)))

    G = []
    G.append(rg.Line(plane.Origin, size * plane.XAxis))
    G.append(rg.Line(plane.Origin, size * plane.YAxis))
    G.append(rg.Line(plane.Origin, size * plane.ZAxis))
    
    C = []
    C.append(Color.FromArgb(255, 0, 0))
    C.append(Color.FromArgb(0, 255, 0))
    C.append(Color.FromArgb(0, 0, 255))
# ---------- end draw ----------
G = ClusterOutput(draw.G)
C = ClusterOutput(draw.C)

# ==== cluster Tools

# ---- group: arch_2019july_tool3A
geo = Geometry([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])
mesh = Mesh(geo)
brep = Brep(geo)
mjoin = MeshJoin(Meshes=mesh)
xaxis_line = Curve(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)
yaxis_line = Curve(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)
tool = PythonScript(meshes=mjoin, breps=brep, xline=xaxis_line, yline=yaxis_line)  # -> tool; inputs meshes: list of Mesh, breps: list of Brep
# ---------- tool: Python ----------
import Rhino.Geometry as rg
from compas.geometry import Frame
from ur_online_control.ur.tool import Tool
from compas.datastructures import Mesh
from compas_rhino.helpers import mesh_from_guid

xaxis = rg.Line(xline.PointAtStart, xline.PointAtEnd)
yaxis = rg.Line(yline.PointAtStart, yline.PointAtEnd)

if xaxis.From.DistanceTo(yaxis.From) < 0.01:
    origin = xaxis.From
    xaxis = xaxis.Direction
    yaxis = yaxis.Direction
elif xaxis.To.DistanceTo(yaxis.To) < 0.01:
    origin = xaxis.To
    xaxis = -xaxis.Direction
    yaxis = -yaxis.Direction
elif xaxis.From.DistanceTo(yaxis.To) < 0.01:
    origin = xaxis.From
    xaxis = xaxis.Direction
    yaxis = -yaxis.Direction
elif xaxis.To.DistanceTo(yaxis.From) < 0.01:
    origin = xaxis.To
    xaxis = -xaxis.Direction
    yaxis = yaxis.Direction

xaxis.Unitize()
yaxis.Unitize()

print origin
print xaxis
print yaxis

tcp_frame = Frame(origin, xaxis, yaxis)

tool = Tool(tcp_frame)
tool.model = [mesh_from_guid(Mesh, mesh) for mesh in meshes]
#tool.model_xyz = tool.model.xyz
tool.breps = breps
# ---------- end tool ----------

# ---- group: arch_2019july_tool3B
geo_2 = Geometry([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])
mesh_2 = Mesh(geo_2)
brep_2 = Brep(geo_2)
mjoin_2 = MeshJoin(Meshes=mesh_2)
xaxis_line_2 = Curve(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)
yaxis_line_2 = Curve(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)
tool_2 = PythonScript(meshes=mjoin_2, breps=brep_2, xline=xaxis_line_2, yline=yaxis_line_2)  # -> tool; inputs meshes: list of Mesh, breps: list of Brep; same code as tool

# ---- group: sand deposition tool
geo_3 = Geometry([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])
mesh_3 = Mesh(geo_3)
brep_3 = Brep(geo_3)
mjoin_3 = MeshJoin(Meshes=mesh_3)
yaxis_line_3 = Curve(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)
xaxis_line_3 = Curve(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)
tool_3 = PythonScript(meshes=mjoin_3, breps=brep_3, xline=xaxis_line_3, yline=yaxis_line_3)  # -> tool; inputs meshes: list of Mesh, breps: list of Brep; same code as tool

# ---- group: earth deposition tool
geo_4 = Geometry([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])
brep_4 = Brep(geo_4)
mesh_4 = Mesh(geo_4)
mjoin_4 = MeshJoin(Meshes=mesh_4)
yaxis_line_4 = Curve(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)
xaxis_line_4 = Curve(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)
tool_4 = PythonScript(meshes=mjoin_4, breps=brep_4, xline=xaxis_line_4, yline=yaxis_line_4)  # -> tool; inputs meshes: list of Mesh, breps: list of Brep; same code as tool

# ---- group: vault_test2_A
geo_5 = Geometry([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])
mesh_5 = Mesh(geo_5)
brep_5 = Brep(geo_5)
mjoin_5 = MeshJoin(Meshes=mesh_5)
xaxis_line_5 = Curve(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)
yaxis_line_5 = Curve(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)
tool_5 = PythonScript(meshes=mjoin_5, breps=brep_5, xline=xaxis_line_5, yline=yaxis_line_5)  # -> tool; inputs meshes: list of Mesh, breps: list of Brep; same code as tool

# ---- group: vault_test2_B
geo_6 = Geometry([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])
mesh_6 = Mesh(geo_6)
brep_6 = Brep(geo_6)
mjoin_6 = MeshJoin(Meshes=mesh_6)
xaxis_line_6 = Curve(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)
yaxis_line_6 = Curve(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)
tool_6 = PythonScript(meshes=mjoin_6, breps=brep_6, xline=xaxis_line_6, yline=yaxis_line_6)  # -> tool; inputs meshes: list of Mesh, breps: list of Brep; same code as tool

# ---- group: clay subtraction tool
geo_7 = Geometry([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])
brep_7 = Brep(geo_7)
mesh_7 = Mesh(geo_7)
mjoin_7 = MeshJoin(Meshes=mesh_7)
xaxis_line_7 = Curve(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)
yaxis_line_7 = Curve(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)
tool_7 = PythonScript(meshes=mjoin_7, breps=brep_7, xline=xaxis_line_7, yline=yaxis_line_7)  # -> tool; inputs meshes: list of Mesh, breps: list of Brep; same code as tool

# ---- group: pack tool
geo_8 = Geometry([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])
mesh_8 = Mesh(geo_8)
brep_8 = Brep(geo_8)
mjoin_8 = MeshJoin(Meshes=mesh_8)
yaxis_line_8 = Curve(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)
xaxis_line_8 = Curve(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)
tool_8 = PythonScript(meshes=mjoin_8, breps=brep_8, xline=xaxis_line_8, yline=yaxis_line_8)  # -> tool; inputs meshes: list of Mesh, breps: list of Brep; same code as tool

# ---- group: vault_test2_Measure
geo_9 = Geometry([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])
mesh_9 = Mesh(geo_9)
brep_9 = Brep(geo_9)
mjoin_9 = MeshJoin(Meshes=mesh_9)
xaxis_line_9 = Curve(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)
yaxis_line_9 = Curve(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)
tool_9 = PythonScript(meshes=mjoin_9, breps=brep_9, xline=xaxis_line_6, yline=yaxis_line_6)  # -> tool; inputs meshes: list of Mesh, breps: list of Brep; same code as tool

# ----
tool_id = ClusterInput()
tool_id_2 = Integer(tool_id)

# ---- group: measurement tool
geo_10 = Geometry([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])
mesh_10 = Mesh(geo_10)
mjoin_10 = MeshJoin(Meshes=mesh_10)

# ----
brep_10 = Brep(geo_10)

# ---- group: measurement tool (continued)
tool_10 = PythonScript(meshes=mjoin_10, brep=brep_10)  # -> tool; inputs meshes: list, brep: list
# ---------- tool_10: Python ----------
from ur_online_control.ur.tools import MeasurementTool
from compas.datastructures import Mesh
from compas_rhino.helpers import mesh_from_guid


tool = MeasurementTool()
tool.model = [mesh_from_guid(Mesh, mesh) for mesh in meshes]
#tool.model_xyz = tool.model.xyz
tool.brep = brep
# ---------- end tool_10 ----------

# ----
filter = StreamFilter(
    Gate=tool_id_2,
    Stream1=tool_10,
    Stream2=tool_3,
    Stream3=tool_4,
    Stream4=tool_7,
    Stream5=tool_8,
    Stream6=tool,
    Stream7=tool_2,
    Stream8=tool_5,
    Stream9=tool_6,
    Stream10=tool_9)
py = PythonScript(tool=filter)  # -> tcp_frame, model
# ---------- py: Python ----------
from compas_ghpython import mesh_draw 

if tool:
    tcp_frame = tool.tcp_frame
    model = map(mesh_draw, tool.model)
# ---------- end py ----------
tool_11 = Data(filter)
draw = PythonScript(frame=py.tcp_frame)  # -> G, C
# ---------- draw: Python ----------
import Rhino.Geometry as rg
from System.Drawing import Color

if not size:
    size = 100

if frame:
    plane = rg.Plane(rg.Point3d(*list(frame.point)), rg.Vector3d(*list(frame.xaxis)), rg.Vector3d(*list(frame.yaxis)))

    G = []
    G.append(rg.Line(plane.Origin, size * plane.XAxis))
    G.append(rg.Line(plane.Origin, size * plane.YAxis))
    G.append(rg.Line(plane.Origin, size * plane.ZAxis))
    
    C = []
    C.append(Color.FromArgb(255, 0, 0))
    C.append(Color.FromArgb(0, 255, 0))
    C.append(Color.FromArgb(0, 0, 255))
# ---------- end draw ----------
tool_12 = ClusterOutput(tool_11)
preview = CustomPreview(Geometry=py.model, Shader=ColourSwatch(SwatchColor=RGBA(141, 170, 178, 150)))
preview_2 = CustomPreview(Geometry=draw.G, Shader=draw.C)
