# Grasshopper definition 190906_DesignAndAssembly_yijiangh_1toMany_grasp_gen.ghx (Grasshopper 1.0.7)

panel = Panel("F:\Miniconda\envs\coop_assembly_ws\python.exe")
panel_2 = Panel("C:\ProgramData\Anaconda3\envs\coop_assembly_ws\python.exe")
panel_3 = Panel("D:\Miniconda\envs\coop_assembly_ws\python.exe")
radius = Slider(7.3, range=0..50)

point = Point([Point(150.0100578, -0.1044499903, 0), Point(71.87649037, 132.5068132, 0), Point(0.01005777432, -0.1044499903, 0), Point(64.10027216, 48.49733388, 165.8234961)])
list_item = ListItem(List=point, Index=Slider(0, range=0..11), Wrap=True)
ghpython_script = PythonScript(points=point, r=radius, run=Toggle(True), use_rpc=Toggle(True), restart_rpc_server=Toggle(False), python_path=panel_3)  # -> out, pts_netw, lns_netw, pts_inv, lns_inv, o_st, b_st; inputs points: list of Point3d, use_rpc: Boolean, restart_rpc_server: Boolean
# ---------- ghpython_script: Python ----------
from compas_ghpython import unload_modules
unload_modules("coop_assembly")

if use_rpc:
    from compas.rpc import Proxy
    geo_gen_execute = Proxy('coop_assembly.geometry_generation.execute', python=python_path, url='http://127.0.0.1')
    if restart_rpc_server:
        geo_gen_execute.stop_server()
        geo_gen_execute.start_server()

from compas.geometry import distance_point_point
from compas_ghpython.utilities import draw_network
from compas.datastructures.network import Network
from coop_assembly.geometry_generation.main import main_gh_simple
from coop_assembly.help_functions.drawing import draw_network_inv_gh

dict_nodes = {}

for i, p in enumerate(points):
    if i > 2:
        nodes       = points[0:i]
        dists       = [distance_point_point(points[i], n) for n in nodes]
        nodes_inds  = [j for y,j in sorted(zip(dists,range(0,i)))] 
        nodes_fin = nodes_inds[0:3]
        
        dict_nodes[str(i)]= nodes_fin

points = [(p[0], p[1], p[2]) for p in points]

supports_bars = [(0,1), (1,2), (2,0)]
supports_nodes = [0, 1, 2, 4]
load_bars = [(4,5)]

load = (0,0,-2000)

if run:
    print("about to run in ghpython")
    if not use_rpc:
        # xfunc call
        b_st_data, o_st_data = main_gh_simple(points, dict_nodes, r, \
            supports_nodes, supports_bars, load_bars, load, correct=False)
    else:
        b_st_data, o_st_data = geo_gen_execute.execute_from_points(
            points, dict_nodes, r, support_nodes=supports_nodes,
            support_bars=supports_bars, load_bars=load_bars, load=load, correct=False)
    
    o_st = Network.from_data(o_st_data)
    b_st = Network.from_data(b_st_data)
    
    pts_new, lns_netw = draw_network(o_st)
    pts_inv, lns_inv, lns_conn  = draw_network_inv_gh(b_st)
# ---------- end ghpython_script ----------

shrinked_radius = Slider(4.367, range=0..10)
subtraction = Subtraction(A=radius, B=shrinked_radius)
panel_4 = Panel(ghpython_script.out)
length = Length(Curve=ghpython_script.lns_inv)
vector_xyz = VectorXYZ(XComponent=Slider(387.6, range=0..1000), YComponent=Slider(124.6, range=0..1000), ZComponent=Slider(27.6, range=0..1000))  # -> Vector, Length
pipe = Pipe(Curve=ghpython_script.lns_inv, Radius=subtraction, Caps=0)  # -> simplify(Pipe)
pipe_2 = Pipe(Curve=ghpython_script.lns_inv, Radius=radius, Caps=0)  # -> simplify(Pipe)
panel_5 = Panel(length)
unit_y = UnitY(Factor=length)
unit_x = UnitX(Factor=1)

# ---- group: gripping plane generation
number_slider = Slider(4, range=2..50)
ghpython_script_2 = GhPythonScript(b_struct=ghpython_script.b_st, nb_rot=number_slider, nb_trans=Slider(4, range=2..50), flip=Toggle(False))  # -> out, planes, simplify(planes_out); inputs nb_rot: Int32, nb_trans: Int32, flip: Boolean
# ---------- ghpython_script_2: Python ----------
import Rhino.Geometry as rg
from ghpythonlib.treehelpers import list_to_tree

from coop_assembly.assembly_info_generation.fabrication_planes import calculate_gripping_plane

for v in b_struct.vertex:
    calculate_gripping_plane(b_struct, v, b_struct.vertex[v]["mean_point"], nb_rot=nb_rot, nb_trans=nb_trans, planes_flip=flip)

planes = []
for v in b_struct.vertex:
    gp = b_struct.vertex[v]["gripping_plane"]
    pl = rg.Plane(rg.Point3d(gp[0][0], gp[0][1],gp[0][2]), rg.Vector3d(gp[1][0], gp[1][1],gp[1][2]), rg.Vector3d(gp[2][0], gp[2][1],gp[2][2]))
    planes.append(pl)

planes_all = []
for i,v in enumerate(b_struct.vertex):
    gp_all = b_struct.vertex[v]["gripping_planes_all"]
    planes_all.append([])
    for gp in gp_all:
        pl = rg.Plane(rg.Point3d(gp[0][0], gp[0][1],gp[0][2]), rg.Vector3d(gp[1][0], gp[1][1],gp[1][2]), rg.Vector3d(gp[2][0], gp[2][1],gp[2][2]))
        planes_all[i].append(pl)

planes_out = list_to_tree(planes_all)
# ---------- end ghpython_script_2 ----------
plane = Plane(simplify(ghpython_script_2.planes_out))

# ----
cap_holes = CapHoles(Brep=pipe)
point_2 = Point(vector_xyz.Vector)
move = Move(Geometry=point_2, Motion=unit_y)  # -> Geometry, Transform
vector_xyz_2 = VectorXYZ(XComponent=Slider(180.4, range=0..1000), YComponent=Slider(0, range=-200..200), ZComponent=Slider(31.3, range=0..1000))  # -> Vector, Length
line = Line(StartPoint=point_2, EndPoint=move.Geometry)
move_2 = Move(Geometry=cap_holes, Motion=vector_xyz_2.Vector)  # -> Geometry, Transform
pipe_3 = Pipe(Curve=line, Radius=subtraction, Caps=0)  # -> simplify(Pipe)

# ----
# TCP transformation
deconstruct_plane = DeconstructPlane(Plane=plane)  # -> Origin, XAxis, YAxis, ZAxis
construct_plane = ConstructPlane(Origin=deconstruct_plane.Origin, XAxis=deconstruct_plane.YAxis, YAxis=deconstruct_plane.XAxis)

cap_holes_2 = CapHoles(Brep=pipe_3)

# ----
# sub list of elements
panel_6 = Panel("""0
1
2
3
4
5""")
construct_path = ConstructPath(Indices=graft(panel_6))  # -> simplify(flatten(Branch))

brep = Brep(cap_holes_2)
brep_2 = Brep(move_2.Geometry)
move_3 = Move(Geometry=construct_plane, Motion=vector_xyz_2.Vector)  # -> Geometry, Transform
split_tree = SplitTree(Data=brep_2, Masks=flatten(construct_path))  # -> Positive, Negative
series = Series(Start=0, Step=1, Count=Slider(3, range=0..5))  # -> flatten(Series)
split_tree_2 = SplitTree(Data=brep, Masks=flatten(construct_path))  # -> Positive, Negative
split_tree_3 = SplitTree(Data=move_3.Geometry, Masks=flatten(construct_path))  # -> Positive, Negative
list_item_2 = ListItem(List=flatten(split_tree.Positive), Index=series, Wrap=True)

# ----
# element
# in pick position
brep_3 = Brep(split_tree_2.Positive)

# ----
# element
# in place position
brep_4 = Brep(split_tree.Positive)

# ----
# EE pose in place
plane_2 = Plane(split_tree_3.Positive)

number_slider_2 = Slider(255, range=0..1000)
brep_5 = Brep(brep_3)
colour_rgb = ColourRGB(Alpha=255, Red=number_slider_2, Green=0, Blue=0)
colour_rgb_2 = ColourRGB(Alpha=255, Red=0, Green=0, Blue=number_slider_2)
custom_preview = CustomPreview(Geometry=brep_5, Material=colour_rgb)
custom_preview_2 = CustomPreview(Geometry=brep_4, Material=colour_rgb_2)

# ----
# dms gripper
mesh = Mesh(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)

# ----
# TCP visualization
point_3 = Point(Point(80.52500153, 0, 0))
panel_7 = Panel(point_3)
scale = Scale(Geometry=mesh, Center=Point(0, 0, 0), Factor="1000")  # -> Geometry, Transform
point_4 = Point(point_3)
xz_plane = XZPlane(Origin=Point(0, 0, 0))
point_5 = Point(point_4)
number_slider_3 = Slider(4.2, range=1..10)
plane_origin = PlaneOrigin(Base=xz_plane, Origin=point_5)
deconstruct_plane_2 = DeconstructPlane(Plane=plane_origin)  # -> Origin, XAxis, YAxis, ZAxis
multiplication = Multiplication(A=deconstruct_plane_2.YAxis, B=number_slider_3)
multiplication_2 = Multiplication(A=deconstruct_plane_2.XAxis, B=number_slider_3)
multiplication_3 = Multiplication(A=deconstruct_plane_2.ZAxis, B=number_slider_3)
colour_rgb_3 = ColourRGB(Alpha=255, Red="255", Green=0, Blue=0)
colour_rgb_4 = ColourRGB(Alpha=255, Red=0, Green=0, Blue="255")
colour_rgb_5 = ColourRGB(Alpha=255, Red=0, Green="255", Blue=0)
vector_display_ex = VectorDisplayEx(Point=deconstruct_plane_2.Origin, Vector=multiplication_2, Colour=colour_rgb_3, Width=2)
vector_display_ex_2 = VectorDisplayEx(Point=deconstruct_plane_2.Origin, Vector=multiplication, Colour=colour_rgb_5, Width=2)
vector_display_ex_3 = VectorDisplayEx(Point=deconstruct_plane_2.Origin, Vector=multiplication_3, Colour=colour_rgb_4, Width=2)

# ----
# make element central frame
# (for the picked geometry)
cluster = Cluster(brep=brep_5)

# ----
# make element central frame
# (for the placed geometry)
cluster_2 = Cluster(brep=brep_4)

plane_3 = Plane(cluster)
brep_6 = Brep(brep_5)
brep_7 = Brep(brep_4)

# ----
# element pose in pick
plane_4 = Plane(simplify(plane_3))
brep_8 = Brep(brep_6)

# ----
# element pose in place
plane_5 = Plane(simplify(cluster_2))
brep_9 = Brep(brep_7)

# ----
# symmetric goal frames
panel_8 = Panel("2*pi")
integer = Integer(number_slider)
division = Division(A=panel_8, B=integer)
deconstruct_plane_3 = DeconstructPlane(Plane=plane_5)  # -> Origin, XAxis, YAxis, ZAxis
series_2 = Series(Start=0, Step=1, Count=integer)
multiplication_4 = Multiplication(A=division, B=series_2)
rotate_3d = Rotate3D(Geometry=plane_5, Angle=multiplication_4, Center=deconstruct_plane_3.Origin, Axis=deconstruct_plane_3.XAxis)  # -> simplify(Geometry), Transform

plane_6 = Plane(plane_2)
plane_7 = Plane(plane_6)

# ----
# EE mesh
mesh_2 = Mesh(scale.Geometry)

orient = Orient(Geometry=mesh_2, Source=plane_origin, Target=plane_7)  # -> Geometry, Transform

# ----
# element pose transform
# from pick to place
orient_2 = Orient(Geometry=brep_8, Source=plane_4, Target=rotate_3d.Geometry)  # -> Geometry, simplify(Transform)

plane_8 = Plane(plane_6)

# ----
# in place EE mesh viz
mesh_3 = Mesh(orient.Geometry)

# ----
# from place to pick
inverse_transform = InverseTransform(Transform=orient_2.Transform)

# ----
# rigid correspondance
transform = Transform(Geometry=plane_8, Transform=inverse_transform)
plane_9 = Plane(simplify(transform))

# ----
# flexible correspondance
unit_z = UnitZ(Factor=1)
deconstruct_plane_4 = DeconstructPlane(Plane=plane_9)  # -> Origin, XAxis, YAxis, ZAxis
negative = Negative(Value=unit_z)
construct_plane_2 = ConstructPlane(Origin=deconstruct_plane_4.Origin, XAxis=negative, YAxis=Vector(0, 1, 0))
plane_10 = Plane(construct_plane_2)

# ----
# in place EE mesh viz (flexible correspondance)
# place2pick transf
plane_11 = Plane(plane_10)
orient_3 = Orient(Source=plane_origin, Target=plane_11)  # -> Geometry, Transform
transform_2 = Transform(orient_3.Transform)
mesh_4 = Mesh(mesh_2)
transform_3 = Transform(Geometry=mesh_4, Transform=transform_2)  # -> simplify(Geometry)

mesh_5 = Mesh(transform_3)
plane_12 = Plane(plane_10)
brep_10 = Brep(brep_9)
brep_11 = Brep(simplify(graft(brep_10)))
mesh_6 = Mesh(mesh_3)
brep_12 = Brep(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)
brep_13 = Brep(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)
panel_9 = Panel("    ur5_start_conf = [0,-1.65715,1.71108,-1.62348,-1.55893,2.75828]")
plane_13 = Plane(plane_12)
group = Group(Objects=brep_11)
mesh_brep = MeshBrep(
    Brep=brep_12,
    Settings={GridMaxCount=0, GridMinCount=16, JaggedSeams=False, MaxEdgeLength=0, MinEdgeLength=0.0001, MinTolerance=0, Refine=True, RefineAngle=0, RelativeTolerance=0.65, SimplePlanes=True, Tolerance=0})
data = Data(group)

# ----
# world_from_pick_grasp_poses
plane_14 = Plane(plane_13)

deconstruct_plane_5 = DeconstructPlane(Plane=plane_14)  # -> Origin, XAxis, YAxis, ZAxis
reverse = Reverse(Vector=deconstruct_plane_5.XAxis)

# ----
# picked EE mesh
mesh_7 = Mesh(mesh_5)

ungroup = Ungroup(Group=data)  # -> simplify(Objects)

# ----
# placed EE mesh
mesh_8 = Mesh(mesh_6)

tree_statistics = TreeStatistics(Tree=mesh_8)  # -> Paths, Length, Count
mesh_9 = Mesh(mesh_brep)
deconstruct_path = DeconstructPath(Branch=tree_statistics.Paths)  # -> simplify(Indices)
multiplication_5 = Multiplication(A=reverse, B=Slider(25, range=0..100))
list_item_3 = ListItem(List=deconstruct_path, Index=0, Wrap=True)
move_4 = Move(Geometry=plane_14, Motion=multiplication_5)  # -> Geometry, Transform
create_set = CreateSet(List=flatten(list_item_3))  # -> Set, Map
list_item_4 = ListItem(List=create_set.Set, Index=Slider(2, range=0..13), Wrap=False)
mesh_brep_2 = MeshBrep(
    Brep=ungroup,
    Settings={GridMaxCount=0, GridMinCount=16, JaggedSeams=False, MaxEdgeLength=0, MinEdgeLength=0.0001, MinTolerance=0, Refine=True, RefineAngle=0, RelativeTolerance=0.65, SimplePlanes=True, Tolerance=0})
concatenate = Concatenate(B="{", Fragment_A=list_item_4, A=";", Fragment_B="*", C="}")

# ----
# unit geometries in placed pose
mesh_10 = Mesh(mesh_brep_2)

split_tree_4 = SplitTree(Data=mesh_8, Masks=flatten(concatenate))  # -> Positive, Negative
split_tree_5 = SplitTree(Data=mesh_7, Masks=flatten(concatenate))  # -> Positive, Negative

# ----
# world from approach pose
plane_15 = Plane(move_4.Geometry)

# ----
# world from pick pose
plane_16 = Plane(plane_4)

# ----
# symmetric
# world from place poses
plane_17 = Plane(rotate_3d.Geometry)

number_slider_4 = Slider(0, range=0..50)
list_item_5 = ListItem(List=plane_17, Index=0, Wrap=True)

tree_statistics_2 = TreeStatistics(Tree=plane_16)  # -> Paths, Length, Count
series_3 = Series(Start="0", Step=1, Count=tree_statistics_2.Count)

xy_plane = XYPlane(Origin=Point(0, 0, 0))

list_item_6 = ListItem(List=split_tree_4.Positive, Index=number_slider_4, Wrap=False)
list_item_7 = ListItem(List=split_tree_5.Positive, Index=number_slider_4, Wrap=False)

boolean_toggle = BooleanToggle(True)
generate_pkg = Button()
plane_18 = Plane(flatten(plane_16))
plane_19 = Plane(plane_17)
mesh_11 = Mesh(simplify(graft(mesh_9)))
ghpython_script_3 = GhPythonScript(
    element_geometries_in_place=mesh_10,
    world_from_place_poses=plane_19,
    world_from_pick_poses=plane_18,
    world_from_pick_grasp_poses=plane_14,
    world_from_approach_poses=plane_15,
    base_frame=xy_plane,
    file_path="C:\Users\yijiangh\Desktop\choreo_instances",
    pkg_name="dms_ws_tet_bars",
    assembly_type="picknplace",
    unit="millimeter",
    generate=generate_pkg,
    predefined_sequence=series_3,
    static_obstacle_meshes=mesh_11)  # -> out, output_file_dir; inputs virtual_joint_connected_e_ids: tree of Int32, grounded_element_ids: list of Int32, grounded_virtual_joint_ids: list of Int32, element_geometries_in_place: tree of Mesh, world_from_place_poses: tree of Plane, world_from_pick_poses: list of Plane, world_from_pick_grasp_poses: tree of Plane, world_from_approach_poses: tree of Plane, base_frame: Plane, generate: Boolean, predefined_sequence: list, static_obstacle_meshes: tree of Mesh
# ---------- ghpython_script_3: Python ----------
import sys
import copy
import os
import json
from collections import OrderedDict

import Rhino.Geometry as rg
import ghpythonlib.components as ghcomp
import ghpythonlib.treehelpers as th

from compas.datastructures import Mesh
from compas.geometry import Frame, Point
from compas.geometry import Transformation, transform_points, cross_vectors
from compas_ghpython.utilities import draw_mesh, draw_frame

from compas_ghpython.utilities import unload_modules
unload_modules('compas_fab.assembly.datastructures')

from compas_fab.assembly.datastructures import Assembly, Element, VirtualJoint, UnitGeometry, Grasp
from compas_fab.assembly.datastructures.utils import transform_cmesh, transform_cmesh_to_origin

##########################################
def tree_to_lists(input):
    """converts a depth-2 GH datatree to a list of lists
    """
    all = []
    for path in input.Paths:
        branch_list = []
        for obj in input.Branch(path):
            branch_list.append(obj)
        all.append(branch_list)
    return all

def rPt2cPt(rPt):
    """
    Convert Rhino point to compas point
    :param rPt:
    :return:
    """
    return Point(rPt.X, rPt.Y, rPt.Z)

def rPln2cFrame(rplane):
    """converts a rhino plane to compas frame
    """
    return Frame(rplane.Origin, rplane.XAxis, rplane.YAxis)

def rMesh2cMesh(rg_mesh):
    if type(rg_mesh) == rg.Mesh:
        #single mesh
        compas_mesh_vertices = rg_mesh.Vertices.ToPoint3dArray()
        compas_mesh_faces = rg_mesh.Faces.ToIntArray(True)
        compas_mesh_faces = [compas_mesh_faces[i:i + 3] for i in range(0, len(compas_mesh_faces), 3)]
        return Mesh.from_vertices_and_faces(compas_mesh_vertices, compas_mesh_faces)
    else:
        #array of meshes
        meshes = []
        for m in rg_mesh:
            compas_mesh_vertices = m.Vertices.ToPoint3dArray()
            compas_mesh_faces = m.Faces.ToIntArray(True)
            compas_mesh_faces = [compas_mesh_faces[i:i + 3] for i in range(0, len(compas_mesh_faces), 3)]
            meshes.append( Mesh.from_vertices_and_faces(compas_mesh_vertices, compas_mesh_faces) )
        return meshes


def draw_assembly_object_cmeshes(asm, e_id, stage='place'):
    """
    Parameters:
        stage: flag for 'place', 'pick'
    """
    if stage == 'place':
        return [draw_mesh(*cm.to_vertices_and_faces()) for cm in asm.element_geometry_in_place_pose(e_id)]
    elif 'pick':
        return [draw_mesh(*cm.to_vertices_and_faces()) for cm in asm.element_geometry_in_pick_pose(e_id)]
    else:
        return None

##########################################
# main

# TODO: convert tree of e_ids into virtual joints

if generate:
    asm = Assembly()
    
    # create assembly objects
    e_geos = tree_to_lists(element_geometries_in_place)
    vj_e_ids = tree_to_lists(virtual_joint_connected_e_ids)
    world_from_place_pose_lists = tree_to_lists(world_from_place_poses)
    grasp_pose_lists = tree_to_lists(world_from_pick_grasp_poses)
    approach_pose_lists = tree_to_lists(world_from_approach_poses)
    static_obs_lists = tree_to_lists(static_obstacle_meshes)
    
#    print(e_geos)
    
    for id, rm_list in enumerate(e_geos):
        is_grounded = id in grounded_element_ids
        e = Element(id, is_grounded=is_grounded)
        world_from_place_frames = [rPln2cFrame(gp) for gp in world_from_place_pose_lists[id]]
        world_from_pick_frame = rPln2cFrame(world_from_pick_poses[id])
        print('{}, {}'.format(id, len(grasp_pose_lists[id])))
        
        grasp_frames = [rPln2cFrame(gpose) for gpose in grasp_pose_lists[id]]
        approach_frames = [rPln2cFrame(apppose) for apppose in approach_pose_lists[id]]
        
        grasps = []
        grasp_id_cnt = 0
        for world_from_grasp, world_from_approach in zip(grasp_frames, approach_frames):
            grasps.append(Grasp.from_frames(id, grasp_id_cnt, world_from_pick_frame, world_from_grasp, world_from_approach))
            grasp_id_cnt += 1
        
        cmesh_list = [transform_cmesh_to_origin(rMesh2cMesh(rm), world_from_place_frames[0]) for rm in rm_list]
        unit_geo = UnitGeometry(name='element_'+str(id), mesh=cmesh_list, 
            initial_frame=world_from_pick_frame, goal_frames=world_from_place_frames, grasps=grasps)
        
        asm.add_element(e, unit_geo)
    
    for id, c_e_ids in enumerate(vj_e_ids):
        is_grounded = id in grounded_virtual_joint_ids
        asm.add_virtual_joint(VirtualJoint(id, connected_element_ids=c_e_ids, 
            is_grounded=is_grounded))
    
    so_unit_geos = []
    for so_id, s_list in enumerate(static_obs_lists):
        so_unit_geos.append(UnitGeometry(name='static_obstacle_'+str(so_id), mesh=[rMesh2cMesh(so) for so in s_list]))
        
    asm.static_obstacle_geometries = so_unit_geos

    asm.to_package(file_path, pkg_name, assembly_type, model_type, unit, predefined_sequence)
    

output_file_dir = str(os.path.join(file_path, pkg_name))
# ---------- end ghpython_script_3 ----------
data_dam = DataDam(DataDataA=ghpython_script_3.output_file_dir, BufferDelay=10000000, BufferMode=0)
concatenate_2 = Concatenate(Fragment_A="C:\Users\yijiangh\Desktop\choreo_instances\result", A="\", Fragment_B="choreo_result.json")
panel_10 = Panel(data_dam)
text = Text(panel_3)
point_6 = Point(point_3)
trigger_planner = BooleanToggle(False)
robot_mdoel = ValueList({"UR3", "UR5"}, selected="UR3")
per_conf_step = BooleanToggle(False)
plan_trans = BooleanToggle(True)
sim_traj = BooleanToggle(True)
pb_viz = BooleanToggle(True)
ghpython_script_4 = GhPythonScript(
    pkg_path=data_dam,
    python_path=text,
    run_planner=trigger_planner,
    result_save_path=concatenate_2,
    TCP_translation=point_6,
    enable_pybullet_viewer=pb_viz,
    plan_transit=plan_trans,
    jt_resolution="0.01",
    sim_traj=sim_traj,
    per_conf_step=per_conf_step,
    robot_model=robot_mdoel)  # -> out, plan_result; inputs run_planner: Boolean, TCP_translation: Point3d, enable_pybullet_viewer: Boolean, plan_transit: Boolean, sim_traj: Boolean, per_conf_step: Boolean
# ---------- ghpython_script_4: Python ----------
import sys
import copy
import os
import json

#import Rhino.Geometry as rg
#import ghpythonlib.components as ghcomp
#import ghpythonlib.treehelpers as th
import System
from Grasshopper import DataTree as datatree
from Grasshopper.Kernel.Data import GH_Path as ghpath

from compas.utilities.xfunc import XFunc

assembly_json_path = os.path.join(pkg_path, 'json', pkg_path.split(os.sep)[-1] + '.json')
print(assembly_json_path)
assert os.path.exists(assembly_json_path)

tcp_trans_list = [TCP_translation.X, TCP_translation.Y, TCP_translation.Z]

traj_dict = {}
if run_planner:
    xfunc = XFunc(
            'coop_assembly.choreo_interface.choreo_call.sequenced_picknplace_plan', python=python_path)
    xfunc(assembly_json_path, scale=0.001, result_save_path=result_save_path,
         enable_viewer=enable_pybullet_viewer, 
         plan_transit=plan_transit, transit_res=jt_resolution,
         view_ikfast=False, cart_ts=0.1, trans_ts=0.01, per_conf_step=per_conf_step, robot_model=robot_model)
    print('main_gh_simple: xfnc error: ', xfunc.error)
    traj_dict = xfunc.data

if not run_planner and os.path.exists(result_save_path):
    with open(result_save_path, 'r') as f:
        traj_dict = json.loads(f.read())

# putting traj dict into a tree data
if traj_dict:
    plan_res_tree = datatree[System.Object]()
    for seq_id, unit_pnp in enumerate(traj_dict):
        for i, traj_pt in enumerate(unit_pnp['place2pick']['points']):
                for jt_val in traj_pt['values']:
                    plan_res_tree.Add(jt_val, ghpath(seq_id, 0, i))
        
        for i, traj_pt in enumerate(unit_pnp['pick_approach']['points']):
                for jt_val in traj_pt['values']:
                    plan_res_tree.Add(jt_val, ghpath(seq_id, 1, i))
                    
        for i, traj_pt in enumerate(unit_pnp['pick_retreat']['points']):
                for jt_val in traj_pt['values']:
                    plan_res_tree.Add(jt_val, ghpath(seq_id, 2, i))
                    
        for i, traj_pt in enumerate(unit_pnp['pick2place']['points']):
                for jt_val in traj_pt['values']:
                    plan_res_tree.Add(jt_val, ghpath(seq_id, 3, i))
    
        for i, traj_pt in enumerate(unit_pnp['place_approach']['points']):
                for jt_val in traj_pt['values']:
                    plan_res_tree.Add(jt_val, ghpath(seq_id, 4, i))
                    
        for i, traj_pt in enumerate(unit_pnp['place_retreat']['points']):
                for jt_val in traj_pt['values']:
                    plan_res_tree.Add(jt_val, ghpath(seq_id, 5, i))
        
        if seq_id == len(traj_dict) - 1:
            for i, traj_pt in enumerate(unit_pnp['return2idle']['points']):
                    for jt_val in traj_pt['values']:
                        plan_res_tree.Add(jt_val, ghpath(seq_id + 1, 0, i))
                        
    plan_result = plan_res_tree
# ---------- end ghpython_script_4 ----------
panel_11 = Panel(ghpython_script_4.out)
panel_12 = Panel(ghpython_script_4.plan_result)

# ==== cluster Cluster
brep = ClusterInput()
brep_2 = Brep(brep)
deconstruct_brep = DeconstructBrep(Brep=brep_2)  # -> Faces, Edges, Vertices
volume = Volume(Geometry=brep_2)  # -> Volume, Centroid
list_item = ListItem(List=deconstruct_brep.Faces, Index=0, Wrap=True)
point = Point(volume.Centroid)
area = Area(Geometry=list_item)  # -> Area, Centroid
point_2 = Point(area.Centroid)
vector_2pt = Vector2Pt(PointA=point, PointB=point_2, Unitize=False)  # -> Vector, Length
plane_normal = PlaneNormal(Origin=point, ZAxis=vector_2pt.Vector)
deconstruct_plane = DeconstructPlane(Plane=plane_normal)  # -> Origin, XAxis, YAxis, ZAxis
construct_plane = ConstructPlane(Origin=deconstruct_plane.Origin, XAxis=deconstruct_plane.ZAxis, YAxis=deconstruct_plane.XAxis)
plane = ClusterOutput(construct_plane)
