# Grasshopper definition 190906_DesignAndAssembly_yijiangh_simplied_version.ghx (Grasshopper 1.0.7)

# ----
# Wire clean up util
number_slider = Slider(2, range=0..2)
wirecleaner = WireCleaner(on=Button(), wire_type=number_slider)  # -> out, a
# ---------- wirecleaner: Python ----------
from Grasshopper.Kernel import GH_ParamWireDisplay
from Grasshopper.Kernel import GH_RuntimeMessageLevel 

# A dictionary of wire types 
wire_display = {'0':GH_ParamWireDisplay.default, 
                '1':GH_ParamWireDisplay.faint,
                '2':GH_ParamWireDisplay.hidden}

# Get selected components and change the wire display
if on:
    doc = ghenv.Component.OnPingDocument()
    sel_objs = doc.SelectedObjects()
    if not len(sel_objs):
        ghenv.Component.AddRuntimeMessage(GH_RuntimeMessageLevel.Warning, 'Nothing was selected')
    for sel_obj  in sel_objs:
        if hasattr(sel_obj, 'Params'):
            for p in sel_obj.Params.Input:
                p.WireDisplay = wire_display[wire_type]
        else:
                sel_obj.WireDisplay = wire_display[wire_type]
# ---------- end wirecleaner ----------

# ----
# Python path
# Result saving path
panel = Panel("D:\Miniconda\envs\coop_assembly_ws\python.exe")
panel_2 = Panel("C:\Users\yijiangh\Desktop\choreo_instances")

unit_y = UnitY(Factor=1)
unit_x = UnitX(Factor=1)
point = Point("38.89, 300, 27")
move = Move(Geometry=point, Motion=unit_y)  # -> Geometry, Transform
series = Series(Start=0, Step=1, Count=Slider(4, range=0..10))
point_2 = Point([Point(150.0100578, -0.1044499903, 0), Point(71.87649037, 132.5068132, 0), Point(0.01005777432, -0.1044499903, 0), Point(64.10027216, 48.49733388, 165.8234961)])
point_3 = Point([<point referenced from the Rhino model> x4])

# ----
# manual selection
point_4 = Point([<point referenced from the Rhino model> x3])
point_5 = Point([<point referenced from the Rhino model> x3])
entwine = Entwine(Branch03=point_5, FlattenInputs=True)  # -> simplify(Result)
ghpython_script = GhPythonScript(full_points_list=point_3, selected_tet_pts=entwine)  # -> out, tet_node_id; inputs full_points_list: list of Point3d, selected_tet_pts: tree of Point3d
# ---------- ghpython_script: Python ----------
import System
import Grasshopper.Kernel.Data.GH_Path as ghpath
import Grasshopper.DataTree as datatree
from ghpythonlib.treehelpers import tree_to_list

from compas.geometry import distance_point_point

eps = 1e-7

tet_node_id = datatree[System.Object]()
selected_t_lists = tree_to_list(selected_tet_pts, lambda x : x)

for i, pts in enumerate(selected_t_lists):
    if pts:
        for pt in pts:
            for orig_id, orig_pt in enumerate(full_points_list):
                if distance_point_point(orig_pt, pt) < eps:
                    tet_node_id.Add(orig_id, ghpath(i))
# ---------- end ghpython_script ----------

# ----
# sub list of elements
panel_3 = Panel(series)
construct_path = ConstructPath(Indices=graft(panel_3))  # -> simplify(flatten(Branch))

number_of_grasp_rotation = Slider(6, range=2..50)
number_of_grasp_position = Slider(4, range=2..50)

# ----
# TCP calibration point
point_6 = Point(Point(80.52500153, 0, 0))

# ----
# dms gripper
mesh = Mesh(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)

# ----
# rack start pt
# rack direction pt
point_7 = Point(point)
point_8 = Point(move.Geometry)

# ----
# shortest distance
ghpython_script_2 = GhPythonScript(full_points_list=point_3)  # -> out, tet_node_id; inputs full_points_list: list of Point3d
# ---------- ghpython_script_2: Python ----------
import System
import Grasshopper.Kernel.Data.GH_Path as ghpath
import Grasshopper.DataTree as datatree

from compas.geometry import distance_point_point

tet_node_id = datatree[System.Object]()
for i, p in enumerate(full_points_list):
    if i > 2:
        nodes       = full_points_list[0:i]
        dists       = [distance_point_point(full_points_list[i], n) for n in nodes]
        nodes_inds  = [j for y,j in sorted(zip(dists,range(0,i)))] 
        nodes_fin = nodes_inds[0:3]
        
        for fin in nodes_fin: tet_node_id.Add(fin, ghpath(i))
# ---------- end ghpython_script_2 ----------
ghpython_script_3 = GhPythonScript()  # -> out, out_pts, out_tet_ids
# ---------- ghpython_script_3: Python ----------
__author__ = "yijiangh"
__version__ = "2019.09.15"

import rhinoscriptsyntax as rs
from Rhino.Geometry import Point3d

import System
import Grasshopper.DataTree as datatree
import Grasshopper.Kernel.Data.GH_Path as ghpath

# example inputs
points = [(866.02540378443905, 500.0, 0.0), (0.0, 0.0, 0.0), (0.0, 1000.0, 0.0), (288.67513720801298, 500.0, 818.08450024563103), \
    (769.63370557686096, 1333.0446812766299, 544.74326601771895), (-160.70791990805799, 1388.88716089995, 907.16026675621299), \
    (117.857296010868, 1981.4332041832699, 151.32258105017999), (-798.20078255574094, 1580.5022372901301, 160.91197525036301), \
    (-560.70093861717601, 2300.5484023076901, 812.92987741903903), (-666.65502975497805, 2519.4354019355501, -176.536520678389), \
    (58.742324089034398, 2934.6909001409299, 527.67951271342201)]

dict_nodes = {'5': [4, 2, 3], '4': [3, 0, 2], '7': [6, 5, 2], \
              '6': [2, 4, 5], '10': [8, 6, 9], '3': [0, 2, 1], '9': [6, 7, 8], '8': [5, 7, 6]}
              

out_pts = []
for pt in points:
    out_pts.append(Point3d(*pt))

out_tet_ids = datatree[System.Object]()
for key, ids in dict_nodes.items():
    for id in ids: out_tet_ids.Add(id, ghpath(int(key)))
# ---------- end ghpython_script_3 ----------

panel_4 = Panel(point_6)
integer = Integer(ghpython_script_2.tet_node_id)
shrinked_radius = Slider(3.5, range=0..10)
ideal_radius = Slider(6.35, range=0..50)
panel_5 = Panel(ghpython_script.tet_node_id)
list_item = ListItem(List=point_3, Index=integer, Wrap=True)
polyline = PolyLine(Vertices=list_item, Closed=True)
subtraction = Subtraction(A=ideal_radius, B=shrinked_radius)

ghpython_script_4 = PythonScript(points=point_3, tet_point_ids=integer, r=ideal_radius, run=Toggle(True), use_rpc=Toggle(True), python_path=panel)  # -> out, pts_netw, lns_netw, pts_inv, lns_inv, o_st, b_st; inputs points: list of Point3d, tet_point_ids: tree of Int32, use_rpc: Boolean
# ---------- ghpython_script_4: Python ----------
import System
import Grasshopper.Kernel.Data.GH_Path as ghpath
import Grasshopper.DataTree as datatree
from ghpythonlib.treehelpers import tree_to_list

from compas_ghpython import unload_modules
unload_modules("coop_assembly")

if use_rpc:
    from compas.rpc import Proxy
    geo_gen_execute = Proxy('coop_assembly.geometry_generation.execute', python=python_path, url='http://127.0.0.1')

from compas.geometry import distance_point_point
from compas_ghpython.utilities import draw_network
from compas.datastructures.network import Network
from coop_assembly.geometry_generation.main import main_gh_simple
from coop_assembly.help_functions.drawing import draw_network_inv_gh

dict_nodes = {}
tet_point_lists = tree_to_list(tet_point_ids, lambda x: x)
for i, tet_ids in enumerate(tet_point_lists):
    if tet_ids : dict_nodes[str(i)] = tet_ids
print(dict_nodes)

points = [(p[0], p[1], p[2]) for p in points]

if run:
    print("about to run in ghpython")
    if not use_rpc:
        # xfunc call
        b_st_data, o_st_data = main_gh_simple(points, dict_nodes, r, correct=False)
    else:
        b_st_data, o_st_data = geo_gen_execute.execute_from_points(
            points, dict_nodes, r, correct=False)
    
    o_st = Network.from_data(o_st_data)
    b_st = Network.from_data(b_st_data)
    
    pts_new, lns_netw = draw_network(o_st)
    pts_inv, lns_inv, lns_conn  = draw_network_inv_gh(b_st)
# ---------- end ghpython_script_4 ----------

ghpython_script_5 = GhPythonScript(b_struct=ghpython_script_4.b_st, nb_rot=number_of_grasp_rotation, nb_trans=number_of_grasp_position)  # -> out, planes, simplify(planes_out); inputs nb_rot: Int32, nb_trans: Int32
# ---------- ghpython_script_5: Python ----------
import Rhino.Geometry as rg
from ghpythonlib.treehelpers import list_to_tree

from coop_assembly.assembly_info_generation.fabrication_planes import calculate_gripping_plane

for v in b_struct.vertex:
    calculate_gripping_plane(b_struct, v, b_struct.vertex[v]["mean_point"], nb_rot=nb_rot, nb_trans=nb_trans, planes_flip=False)

planes = []
for v in b_struct.vertex:
    gp = b_struct.vertex[v]["gripping_plane"]
    pl = rg.Plane(rg.Point3d(gp[0][0], gp[0][1],gp[0][2]), rg.Vector3d(gp[1][0], gp[1][1],gp[1][2]), rg.Vector3d(gp[2][0], gp[2][1],gp[2][2]))
    planes.append(pl)

planes_all = []
for i,v in enumerate(b_struct.vertex):
    gp_all = b_struct.vertex[v]["gripping_planes_all"]
    planes_all.append([])
    for gp in gp_all:
        pl = rg.Plane(rg.Point3d(gp[0][0], gp[0][1],gp[0][2]), rg.Vector3d(gp[1][0], gp[1][1],gp[1][2]), rg.Vector3d(gp[2][0], gp[2][1],gp[2][2]))
        planes_all[i].append(pl)

planes_out = list_to_tree(planes_all)
# ---------- end ghpython_script_5 ----------

# ----
# TCP transformation
cluster = Cluster_4(plane=ghpython_script_5.planes_out)

pipe = Pipe(Curve=ghpython_script_4.lns_inv, Radius=subtraction, Caps=0)  # -> simplify(Pipe)
panel_6 = Panel(ghpython_script_4.out)
cluster_2 = Cluster_6(
    curve=ghpython_script_4.lns_inv,
    number=subtraction,
    geometry=point_7,
    point_b=point_8,
    data_path=construct_path,
    integer=number_of_grasp_rotation,
    data=cluster)  # -> plane_11, goal_frames, brep_9, plane_9, plane_10

# ----
# TCP definition
cluster_3 = Cluster_3(point=point_6, geometry=mesh)  # -> plane, geometry_2

plane = Plane(cluster_2.plane_9)
cluster_4 = Cluster(
    plane=cluster_2.plane_10,
    plane_2=plane,
    plane_3=cluster_3.plane,
    mesh=cluster_3.geometry_2,
    index=Slider(2, range=0..13))  # -> mesh_10, mesh_9, result
number_slider_2 = Slider(18, range=0..50)
split_tree = SplitTree(Data=cluster_4.mesh_10, Masks=flatten(cluster_4.result))  # -> Positive, Negative
split_tree_2 = SplitTree(Data=cluster_4.mesh_9, Masks=flatten(cluster_4.result))  # -> Positive, Negative

list_item_2 = ListItem(List=split_tree.Positive, Index=number_slider_2, Wrap=False)
list_item_3 = ListItem(List=split_tree_2.Positive, Index=number_slider_2, Wrap=False)

# ----
# world_from_pick_grasp_poses
plane_2 = Plane(plane)

# ----
# approach pose generation
number_slider_3 = Slider(30, range=0..100)
deconstruct_plane = DeconstructPlane(Plane=plane_2)  # -> Origin, XAxis, YAxis, ZAxis
reverse = Reverse(Vector=deconstruct_plane.XAxis)
multiplication = Multiplication(A=reverse, B=number_slider_3)
move_2 = Move(Geometry=plane_2, Motion=multiplication)  # -> Geometry, Transform

# ----
# brep_to_mesh (tree)
cluster_5 = Cluster_2(brep=cluster_2.brep_9)

# ----
# symmetric
# world from place poses
plane_3 = Plane(cluster_2.goal_frames)

# ----
# world from pick pose
plane_4 = Plane(cluster_2.plane_11)

# ----
# unit geometries in placed pose
mesh_2 = Mesh(cluster_5)

# ----
# world from approach pose
plane_5 = Plane(move_2.Geometry)

# ----
# static collision meshes
brep = Brep(<brep referenced from the Rhino model>)
brep_2 = Brep(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)
mesh_brep = MeshBrep(
    Brep=[brep, brep_2],
    Settings={GridMaxCount=0, GridMinCount=16, JaggedSeams=False, MaxEdgeLength=0, MinEdgeLength=0.0001, MinTolerance=0, Refine=True, RefineAngle=0, RelativeTolerance=0.65, SimplePlanes=True, Tolerance=0})
mesh_3 = Mesh(mesh_brep)
mesh_4 = Mesh(simplify(graft(mesh_3)))

boolean_toggle = BooleanToggle(True)
generate_pkg = Button()
plane_6 = Plane(flatten(plane_4))
plane_7 = Plane(plane_3)
ghpython_script_6 = GhPythonScript(
    element_geometries_in_place=mesh_2,
    world_from_place_poses=plane_7,
    world_from_pick_poses=plane_6,
    world_from_pick_grasp_poses=plane_2,
    world_from_approach_poses=plane_5,
    file_path=panel_2,
    pkg_name="dms_ws_tet_bars",
    generate=generate_pkg,
    static_obstacle_meshes=mesh_4)  # -> out, output_file_dir; inputs element_geometries_in_place: tree of Mesh, world_from_place_poses: tree of Plane, world_from_pick_poses: list of Plane, world_from_pick_grasp_poses: tree of Plane, world_from_approach_poses: tree of Plane, generate: Boolean, static_obstacle_meshes: tree of Mesh
# ---------- ghpython_script_6: Python ----------
import sys
import copy
import os
import json
from collections import OrderedDict

import Rhino.Geometry as rg
import ghpythonlib.components as ghcomp
import ghpythonlib.treehelpers as th

from compas.datastructures import Mesh
from compas.geometry import Frame, Point
from compas.geometry import Transformation, transform_points, cross_vectors
from compas_ghpython.utilities import draw_mesh, draw_frame

from compas_ghpython.utilities import unload_modules
unload_modules('compas_fab.assembly.datastructures')

from compas_fab.assembly.datastructures import Assembly, Element, VirtualJoint, UnitGeometry, Grasp
from compas_fab.assembly.datastructures.utils import transform_cmesh, transform_cmesh_to_origin

##########################################
def tree_to_lists(input):
    """converts a depth-2 GH datatree to a list of lists
    """
    all = []
    for path in input.Paths:
        branch_list = []
        for obj in input.Branch(path):
            branch_list.append(obj)
        all.append(branch_list)
    return all

def rPt2cPt(rPt):
    """
    Convert Rhino point to compas point
    :param rPt:
    :return:
    """
    return Point(rPt.X, rPt.Y, rPt.Z)

def rPln2cFrame(rplane):
    """converts a rhino plane to compas frame
    """
    return Frame(rplane.Origin, rplane.XAxis, rplane.YAxis)

def rMesh2cMesh(rg_mesh):
    if type(rg_mesh) == rg.Mesh:
        #single mesh
        compas_mesh_vertices = rg_mesh.Vertices.ToPoint3dArray()
        compas_mesh_faces = rg_mesh.Faces.ToIntArray(True)
        compas_mesh_faces = [compas_mesh_faces[i:i + 3] for i in range(0, len(compas_mesh_faces), 3)]
        return Mesh.from_vertices_and_faces(compas_mesh_vertices, compas_mesh_faces)
    else:
        #array of meshes
        meshes = []
        for m in rg_mesh:
            compas_mesh_vertices = m.Vertices.ToPoint3dArray()
            compas_mesh_faces = m.Faces.ToIntArray(True)
            compas_mesh_faces = [compas_mesh_faces[i:i + 3] for i in range(0, len(compas_mesh_faces), 3)]
            meshes.append( Mesh.from_vertices_and_faces(compas_mesh_vertices, compas_mesh_faces) )
        return meshes


def draw_assembly_object_cmeshes(asm, e_id, stage='place'):
    """
    Parameters:
        stage: flag for 'place', 'pick'
    """
    if stage == 'place':
        return [draw_mesh(*cm.to_vertices_and_faces()) for cm in asm.element_geometry_in_place_pose(e_id)]
    elif 'pick':
        return [draw_mesh(*cm.to_vertices_and_faces()) for cm in asm.element_geometry_in_pick_pose(e_id)]
    else:
        return None

##########################################
# main

# TODO: convert tree of e_ids into virtual joints

if generate:
    asm = Assembly()
    
    # create assembly objects
    e_geos = tree_to_lists(element_geometries_in_place)
#    vj_e_ids = tree_to_lists(virtual_joint_connected_e_ids)
    world_from_place_pose_lists = tree_to_lists(world_from_place_poses)
    grasp_pose_lists = tree_to_lists(world_from_pick_grasp_poses)
    approach_pose_lists = tree_to_lists(world_from_approach_poses)
    static_obs_lists = tree_to_lists(static_obstacle_meshes)
    
#    print(e_geos)
    
    for id, rm_list in enumerate(e_geos):
#        is_grounded = id in grounded_element_ids
        is_grounded = False
        e = Element(id, is_grounded=is_grounded)
        world_from_place_frames = [rPln2cFrame(gp) for gp in world_from_place_pose_lists[id]]
        world_from_pick_frame = rPln2cFrame(world_from_pick_poses[id])
        print('{}, {}'.format(id, len(grasp_pose_lists[id])))
        
        grasp_frames = [rPln2cFrame(gpose) for gpose in grasp_pose_lists[id]]
        approach_frames = [rPln2cFrame(apppose) for apppose in approach_pose_lists[id]]
        
        grasps = []
        grasp_id_cnt = 0
        for world_from_grasp, world_from_approach in zip(grasp_frames, approach_frames):
            grasps.append(Grasp.from_frames(id, grasp_id_cnt, world_from_pick_frame, world_from_grasp, world_from_approach))
            grasp_id_cnt += 1
        
        cmesh_list = [transform_cmesh_to_origin(rMesh2cMesh(rm), world_from_place_frames[0]) for rm in rm_list]
        unit_geo = UnitGeometry(name='element_'+str(id), mesh=cmesh_list, 
            initial_frame=world_from_pick_frame, goal_frames=world_from_place_frames, grasps=grasps)
        
        asm.add_element(e, unit_geo)
    
#    for id, c_e_ids in enumerate(vj_e_ids):
#        is_grounded = id in grounded_virtual_joint_ids
#        asm.add_virtual_joint(VirtualJoint(id, connected_element_ids=c_e_ids, 
#            is_grounded=is_grounded))
    
    so_unit_geos = []
    for so_id, s_list in enumerate(static_obs_lists):
        so_unit_geos.append(UnitGeometry(name='static_obstacle_'+str(so_id), mesh=[rMesh2cMesh(so) for so in s_list]))
        
    asm.static_obstacle_geometries = so_unit_geos

    asm.to_package(file_path, pkg_name, 'picknplace', 'spatial_bars', 'millimeter')
    

output_file_dir = str(os.path.join(file_path, pkg_name))
# ---------- end ghpython_script_6 ----------
data_dam = DataDam(DataDataA=ghpython_script_6.output_file_dir, BufferDelay=10000000, BufferMode=0)
panel_7 = Panel(ghpython_script_6.out)
trigger_planner = BooleanToggle(False)
cluster_6 = Cluster_7(fragment_a=panel_2)
plan_trans = BooleanToggle(True)
pb_viz = BooleanToggle(True)
text = Text(panel)
robot_mdoel = ValueList({"UR3": "ur3", "UR5": "ur5"}, selected="UR3")
per_conf_step = BooleanToggle(False)
sim_traj = BooleanToggle(True)
point_9 = Point(point_6)
radians = Panel("0.5")
sec_step = Panel("0.1")
ghpython_script_7 = GhPythonScript(
    pkg_path=data_dam,
    python_path=text,
    run_planner=trigger_planner,
    result_save_path=cluster_6,
    TCP_translation=point_9,
    enable_pybullet_viewer=pb_viz,
    plan_transit=plan_trans,
    jt_resolution=radians,
    sim_traj=sim_traj,
    per_conf_step=per_conf_step,
    robot_model=robot_mdoel,
    trans_viz_time_step=sec_step)  # -> out, plan_result; inputs run_planner: Boolean, TCP_translation: Point3d, enable_pybullet_viewer: Boolean, plan_transit: Boolean, sim_traj: Boolean, per_conf_step: Boolean
# ---------- ghpython_script_7: Python ----------
import sys
import copy
import os
import json

#import Rhino.Geometry as rg
#import ghpythonlib.components as ghcomp
#import ghpythonlib.treehelpers as th
import System
from Grasshopper import DataTree as datatree
from Grasshopper.Kernel.Data import GH_Path as ghpath

from compas.utilities.xfunc import XFunc

assembly_json_path = os.path.join(pkg_path, 'json', pkg_path.split(os.sep)[-1] + '.json')
print('result file path: ', assembly_json_path)
assert os.path.exists(assembly_json_path)

tcp_trans_list = [TCP_translation.X, TCP_translation.Y, TCP_translation.Z]

traj_dict = {}
if run_planner:
    xfunc = XFunc(
            'coop_assembly.choreo_interface.choreo_call.sequenced_picknplace_plan', python=python_path)
    xfunc(assembly_json_path, scale=0.001, result_save_path=result_save_path,
         enable_viewer=enable_pybullet_viewer, 
         plan_transit=plan_transit, transit_res=jt_resolution,
         view_ikfast=False, cart_ts=0.1, trans_ts=trans_viz_time_step, per_conf_step=per_conf_step, robot_model=robot_model)
    print('main_gh_simple: xfnc error: ', xfunc.error)
    traj_dict = xfunc.data

if not run_planner and os.path.exists(result_save_path):
    with open(result_save_path, 'r') as f:
        traj_dict = json.loads(f.read())

# putting traj dict into a tree data
if traj_dict:
    plan_res_tree = datatree[System.Object]()
    for seq_id, unit_pnp in enumerate(traj_dict):
        for i, traj_pt in enumerate(unit_pnp['place2pick']['points']):
                for jt_val in traj_pt['values']:
                    plan_res_tree.Add(jt_val, ghpath(seq_id, 0, i))
        
        for i, traj_pt in enumerate(unit_pnp['pick_approach']['points']):
                for jt_val in traj_pt['values']:
                    plan_res_tree.Add(jt_val, ghpath(seq_id, 1, i))
                    
        for i, traj_pt in enumerate(unit_pnp['pick_retreat']['points']):
                for jt_val in traj_pt['values']:
                    plan_res_tree.Add(jt_val, ghpath(seq_id, 2, i))
                    
        for i, traj_pt in enumerate(unit_pnp['pick2place']['points']):
                for jt_val in traj_pt['values']:
                    plan_res_tree.Add(jt_val, ghpath(seq_id, 3, i))
    
        for i, traj_pt in enumerate(unit_pnp['place_approach']['points']):
                for jt_val in traj_pt['values']:
                    plan_res_tree.Add(jt_val, ghpath(seq_id, 4, i))
                    
        for i, traj_pt in enumerate(unit_pnp['place_retreat']['points']):
                for jt_val in traj_pt['values']:
                    plan_res_tree.Add(jt_val, ghpath(seq_id, 5, i))
        
        if seq_id == len(traj_dict) - 1:
            for i, traj_pt in enumerate(unit_pnp['return2idle']['points']):
                    for jt_val in traj_pt['values']:
                        plan_res_tree.Add(jt_val, ghpath(seq_id + 1, 0, i))
                        
    plan_result = plan_res_tree
# ---------- end ghpython_script_7 ----------
panel_8 = Panel(ghpython_script_7.out)

# ==== cluster Cluster
mesh = ClusterInput()
plane = ClusterInput()
plane_2 = ClusterInput()
plane_3 = ClusterInput()
index = ClusterInput()

# ----
# EE mesh
mesh_2 = Mesh(mesh)

# ----
# placed element pose
plane_4 = Plane(plane)

# ----
# picked element pose
plane_5 = Plane(plane_2)

# ----
# TCP def pose
plane_6 = Plane(plane_3)

orient = Orient(Geometry=mesh_2, Source=plane_6, Target=plane_4)  # -> Geometry, Transform

# ----
# in place EE mesh viz
mesh_3 = Mesh(orient.Geometry)

# ----
# in place EE mesh viz (flexible correspondance)
# place2pick transf
orient_2 = Orient(Source=plane_6, Target=plane_5)  # -> Geometry, Transform
mesh_4 = Mesh(mesh_2)
transform = Transform(orient_2.Transform)
transform_2 = Transform(Geometry=mesh_4, Transform=transform)  # -> simplify(Geometry)

mesh_5 = Mesh(transform_2)
mesh_6 = Mesh(mesh_3)

# ----
# picked EE mesh
mesh_7 = Mesh(mesh_5)

# ----
# placed EE mesh
mesh_8 = Mesh(mesh_6)

tree_statistics = TreeStatistics(Tree=mesh_8)  # -> Paths, Length, Count
deconstruct_path = DeconstructPath(Branch=tree_statistics.Paths)  # -> simplify(Indices)
mesh_9 = ClusterOutput(mesh_7)
mesh_10 = ClusterOutput(mesh_8)
list_item = ListItem(List=deconstruct_path, Index=0, Wrap=True)
create_set = CreateSet(List=flatten(list_item))  # -> Set, Map
list_item_2 = ListItem(List=create_set.Set, Index=index, Wrap=False)
concatenate = Concatenate(B="{", Fragment_A=list_item_2, A=";", Fragment_B="*", C="}")
result = ClusterOutput(concatenate)

# ==== cluster Cluster_2
brep = ClusterInput()
brep_2 = Brep(simplify(graft(brep)))
group = Group(Objects=brep_2)
ungroup = Ungroup(Group=group)  # -> simplify(Objects)
mesh_brep = MeshBrep(
    Brep=ungroup,
    Settings={GridMaxCount=0, GridMinCount=16, JaggedSeams=False, MaxEdgeLength=0, MinEdgeLength=0.0001, MinTolerance=0, Refine=True, RefineAngle=0, RelativeTolerance=0.65, SimplePlanes=True, Tolerance=0})
mesh = ClusterOutput(mesh_brep)

# ==== cluster Cluster_3
geometry = ClusterInput()
point = ClusterInput()
xz_plane = XZPlane(Origin=Point(0, 0, 0))
scale = Scale(Geometry=geometry, Center=Point(0, 0, 0), Factor="1000")  # -> Geometry, Transform
point_2 = Point(point)
plane_origin = PlaneOrigin(Base=xz_plane, Origin=point_2)
geometry_2 = ClusterOutput(scale.Geometry)
plane = ClusterOutput(plane_origin)

# ==== cluster Cluster_4
plane = ClusterInput()

# ---- group: gripping plane generation
plane_2 = Plane(simplify(plane))

# ----
deconstruct_plane = DeconstructPlane(Plane=plane_2)  # -> Origin, XAxis, YAxis, ZAxis
negative = Negative(Value=deconstruct_plane.ZAxis)
construct_plane = ConstructPlane(Origin=deconstruct_plane.Origin, XAxis=deconstruct_plane.YAxis, YAxis=negative)
plane_3 = ClusterOutput(construct_plane)

# ==== cluster Cluster_6
geometry = ClusterInput()

# ----
# generated bars' central lines
curve = ClusterInput()

number = ClusterInput()
point_b = ClusterInput()

# ----
# number of rotations
integer = ClusterInput()

# ----
# EE pose in place
data = ClusterInput()

data_path = ClusterInput()
vector_2pt = Vector2Pt(PointA=geometry, PointB=point_b, Unitize=True)  # -> Vector, Length
length = Length(Curve=curve)

# ----
# shrinked bar radius
number_2 = Number(number)

# ----
# desired branch paths
data_path_2 = DataPath(data_path)

multiplication = Multiplication(A=length, B=vector_2pt.Vector)
move = Move(Geometry=geometry, Motion=multiplication)  # -> Geometry, Transform
line = Line(StartPoint=geometry, EndPoint=move.Geometry)
split_tree = SplitTree(Data=data, Masks=flatten(data_path_2))  # -> Positive, Negative
pipe = Pipe(Curve=line, Radius=number_2, Caps=0)  # -> simplify(Pipe)
pipe_2 = Pipe(Curve=curve, Radius=number_2, Caps=0)  # -> simplify(Pipe)

# ----
# EE pose in place
plane = Plane(split_tree.Positive)

cap_holes = CapHoles(Brep=pipe)
cap_holes_2 = CapHoles(Brep=pipe_2)
brep = Brep(cap_holes_2)
brep_2 = Brep(cap_holes)
split_tree_2 = SplitTree(Data=brep, Masks=flatten(data_path_2))  # -> Positive, Negative
split_tree_3 = SplitTree(Data=brep_2, Masks=flatten(data_path_2))  # -> Positive, Negative

# ----
# element
# in pick position
brep_3 = Brep(split_tree_3.Positive)

# ----
# element
# in place position
brep_4 = Brep(split_tree_2.Positive)

# ----
# make element central frame
# (for the picked geometry)
cluster = Cluster_5(brep=brep_3)

# ----
# make element central frame
# (for the placed geometry)
cluster_2 = Cluster_5(brep=brep_4)

plane_2 = Plane(cluster)
brep_5 = Brep(brep_3)
brep_6 = Brep(brep_4)

# ----
# element pose in pick
plane_3 = Plane(simplify(plane_2))
brep_7 = Brep(brep_5)

# ----
# element pose in place
plane_4 = Plane(simplify(cluster_2))
brep_8 = Brep(brep_6)

# ----
# symmetric goal frames
# number of rotations
integer_2 = Integer(integer)
division = Division(A="2*pi", B=integer_2)
deconstruct_plane = DeconstructPlane(Plane=plane_4)  # -> Origin, XAxis, YAxis, ZAxis
series = Series(Start=0, Step=1, Count=integer_2)
multiplication_2 = Multiplication(A=division, B=series)
rotate_3d = Rotate3D(Geometry=plane_4, Angle=multiplication_2, Center=deconstruct_plane.Origin, Axis=deconstruct_plane.XAxis)  # -> simplify(Geometry), Transform

plane_5 = Plane(plane)

# ----
# element pose transform
# from pick to place
orient = Orient(Geometry=brep_7, Source=plane_3, Target=rotate_3d.Geometry)  # -> Geometry, simplify(Transform)

# ----
# from place to pick
inverse_transform = InverseTransform(Transform=orient.Transform)

# ----
# rigid correspondance
plane_6 = Plane(plane_5)
transform = Transform(Geometry=plane_6, Transform=inverse_transform)
plane_7 = Plane(simplify(transform))

# ----
# flexible correspondance
unit_z = UnitZ(Factor=1)
deconstruct_plane_2 = DeconstructPlane(Plane=plane_7)  # -> Origin, XAxis, YAxis, ZAxis
vector = Vector(vector_2pt.Vector)
negative = Negative(Value=unit_z)
cross_product = CrossProduct(VectorA=negative, VectorB=vector, Unitize=False)  # -> Vector, Length
construct_plane = ConstructPlane(Origin=deconstruct_plane_2.Origin, XAxis=negative, YAxis=cross_product.Vector)
plane_8 = Plane(construct_plane)

# ----
# EE pose in pick
plane_9 = ClusterOutput(plane_8)

# ----
# bar brep in place
brep_9 = ClusterOutput(brep_8)

# ----
# EE pose in place
plane_10 = ClusterOutput(plane_5)

# ----
# goal_frames
goal_frames = ClusterOutput(rotate_3d.Geometry)

# ----
# initial frames
plane_11 = ClusterOutput(plane_3)

# ==== cluster Cluster_7
fragment_a = ClusterInput()
concatenate = Concatenate(Fragment_A=fragment_a, B="\", C="result", A="\", Fragment_B="choreo_result.json")
result = ClusterOutput(concatenate)

# ==== cluster Cluster_5
brep = ClusterInput()
brep_2 = Brep(brep)
deconstruct_brep = DeconstructBrep(Brep=brep_2)  # -> Faces, Edges, Vertices
volume = Volume(Geometry=brep_2)  # -> Volume, Centroid
list_item = ListItem(List=deconstruct_brep.Faces, Index=0, Wrap=True)
point = Point(volume.Centroid)
area = Area(Geometry=list_item)  # -> Area, Centroid
point_2 = Point(area.Centroid)
vector_2pt = Vector2Pt(PointA=point, PointB=point_2, Unitize=False)  # -> Vector, Length
plane_normal = PlaneNormal(Origin=point, ZAxis=vector_2pt.Vector)
deconstruct_plane = DeconstructPlane(Plane=plane_normal)  # -> Origin, XAxis, YAxis, ZAxis
construct_plane = ConstructPlane(Origin=deconstruct_plane.Origin, XAxis=deconstruct_plane.ZAxis, YAxis=deconstruct_plane.XAxis)
plane = ClusterOutput(construct_plane)
