# Grasshopper definition 180301_TetrasFromPoints_yijiangh.ghx (Grasshopper 1.0.7)

# ----
# all points
point = Point([Point(866.0254038, 500, 0), Point(0, 0, 0), Point(0, 1000, 0), Point(288.6751372, 500, 818.0845002), Point(769.6337056, 1333.044681, 544.743266), Point(-160.7079199, 1388.887161, 907.1602668), Point(117.857296, 1981.433204, 151.3225811), Point(-798.2007826, 1580.502237, 160.9119753), Point(-560.7009386, 2300.548402, 812.9298774), Point(-666.6550298, 2519.435402, -176.5365207), Point(58.74232409, 2934.6909, 527.6795127)])

# ----
# support nodes
panel = Panel("""0
1
2
4""")
list_item = ListItem(List=point, Index=panel, Wrap=True)

# ----
# support lines
curve = Curve([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])

# ----
# load lines
curve_2 = Curve(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)

construct_domain = ConstructDomain(DomainStart=Slider(0, range=0..100), DomainEnd=Slider(10, range=0..100))
sub_list = SubList(List=point, Domain=construct_domain, Wrap=True)  # -> List, Index
curve_3 = Curve(reparameterize(curve))
curve_4 = Curve(reparameterize(curve_2))
point_2 = Point(list_item)
point_3 = Point(sub_list.List)
ghpython_script = GhPythonScript(points=point_3, support_lines=curve_3, support_points=point_2, load_lines=curve_4)  # -> out, tree_nodes, out_support_nodes_id, out_support_lines, out_load_lines; inputs points: list of Point3d, support_lines: list of Curve, support_points: list of Point3d, load_lines: list of Curve
# ---------- ghpython_script: Python ----------
__author__ = "yijiangh"
__version__ = "2019.09.04"

import rhinoscriptsyntax as rs
import System
from Grasshopper import DataTree as datatree
from Grasshopper.Kernel.Data import GH_Path as ghpath

from compas.geometry.distance import distance_point_point

# distance comparision tolerance
tol = 1e-6

# structural node info
tree_nodes = datatree[System.Int64]()
for i,p in enumerate(points):
    if i > 2:
        nodes       = points[0:i]
        dists       = [distance_point_point(points[i], n) for n in nodes]
        nodes_inds  = [j for y,j in sorted(zip(dists,range(0,i)))] 
        nodes_fin = nodes_inds[0:3] # take the nearest 2 points in the list
#        tree_br_cnt = tree_nodes.BranchCount
        tree_br_cnt = i
        for n_id in nodes_fin: tree_nodes.Add(n_id, ghpath(tree_br_cnt))

# support node ids
support_node_ids = []
for pt in support_points:
    for n_id, p in enumerate(points):
        if pt.DistanceTo(p) < tol:
            support_node_ids.append(n_id)

# support lines
tree_support_lines = datatree[System.Object]()
for crv_id, crv in enumerate(support_lines):
    for n_id, p in enumerate(points):
        if p.DistanceTo(crv.PointAt(0)) < tol or p.DistanceTo(crv.PointAt(1)) < tol:
            tree_support_lines.Add(n_id, ghpath(crv_id))

# load lines
tree_load_lines = datatree[System.Object]()
for crv_id, crv in enumerate(load_lines):
    for n_id, p in enumerate(points):
        if p.DistanceTo(crv.PointAt(0)) < tol or p.DistanceTo(crv.PointAt(1)) < tol:
            tree_load_lines.Add(n_id, ghpath(crv_id))

# output
out_support_nodes_id = support_node_ids
out_support_lines = tree_support_lines
out_load_lines = tree_load_lines
# ---------- end ghpython_script ----------

# ----
# unit ?
panel_2 = Panel("""0
0
-2000""")

ghpython_script_2 = PythonScript(
    points=point_3,
    tree_nodes=ghpython_script.tree_nodes,
    support_bars=ghpython_script.out_support_lines,
    support_nodes=ghpython_script.out_support_nodes_id,
    load_bars=ghpython_script.out_load_lines,
    load=panel_2,
    run=Toggle(False),
    restart_rpc_server=Toggle(False))  # -> out, pts_netw, lns_netw, pts_inv, lns_inv; inputs points: list of Point3d, tree_nodes: tree of Int32, support_bars: tree of Int32, support_nodes: list of Int32, load_bars: tree of Int32, load: list, restart_rpc_server: Boolean
# ---------- ghpython_script_2: Python ----------
from ghpythonlib.treehelpers import list_to_tree, tree_to_list

from compas_ghpython import unload_modules
unload_modules("coop_assembly")
#unload_modules("compas_fab")

from compas.datastructures import Network

from coop_assembly.geometry_generation import main_gh_simple
from compas_ghpython.utilities.drawing import draw_network
from coop_assembly.help_functions.drawing import draw_network_inv_gh

from compas.rpc import Proxy
geo_gen_execute = Proxy('coop_assembly.geometry_generation.execute')

if restart_rpc_server:
    geo_gen_execute.stop_server()
    geo_gen_execute.start_server()

# example format
#dict_nodes = {'5': [4, 2, 3], '4': [3, 0, 2], '7': [6, 5, 2], \
#              '6': [2, 4, 5], '10': [8, 6, 9], '3': [0, 2, 1], '9': [6, 7, 8], '8': [5, 7, 6]}
#supports_bars = [(0,1), (1,2), (2,0)]
#supports_nodes = [0, 1, 2, 4]
#load_bars = [(4,5)]
#load = (0, 0, -2000)

list_nodes = tree_to_list(tree_nodes, lambda x : list(x))
dict_nodes = {str(tri_id) : n_ids for tri_id, n_ids in enumerate(list_nodes) if n_ids}

supports_bars = tree_to_list(support_bars, lambda x : [tuple(var) for var in x])
supports_nodes = support_nodes
load_bars = tree_to_list(load_bars, lambda x : [tuple(var) for var in x])
load = (load[0], load[1], load[2])

#print(dict_nodes)
#print(supports_bars)
#print(supports_nodes)
#print(load_bars)
#print(load)

# convert rhino points to tuple
points = [(p[0], p[1], p[2]) for p in points]

if run:
    print("about to run in gh python")
    b_st_data, o_st_data = geo_gen_execute.execute_from_points(
        points, dict_nodes, support_nodes=supports_nodes,
        support_bars=supports_bars, load_bars=load_bars, load=load)
    
#    Stefana's xfunc call
#    data = main_gh_simple(points, dict_nodes, supports_nodes, supports_bars, load_bars, load)
#    o_st_data = data[1]
#    b_st_data = data[0]
    
    b_st = Network.from_data(b_st_data)
    o_st = Network.from_data(o_st_data)
    
    pts_new, lns_netw = draw_network(o_st)
#    pts_inv, lns_inv, lns_conn  = draw_network_inv_gh(b_st)
# ---------- end ghpython_script_2 ----------
panel_3 = Panel(ghpython_script_2.out)
line = Line(ghpython_script_2.lns_inv)
line_2 = Line(ghpython_script_2.lns_netw)
pipe = Pipe(Curve=ghpython_script_2.lns_inv, Radius=Slider(12.5, range=0..100), Caps=0)
point_4 = Point(ghpython_script_2.pts_netw)
list_item_2 = ListItem(List=line, Index=Slider(3, range=0..50), Wrap=True)
list_item_3 = ListItem(List=point_4, Index=Slider(3, range=0..20), Wrap=True)
custom_preview = CustomPreview(Geometry=pipe, Shader=ColourSwatch(SwatchColor=RGBA(61, 200, 255, 168)))
